# Dynamo custom node Boolean_FaceFlipped.dyf "Boolean.FaceFlipped|DanEDU" (Dynamo 1.3.2.2480)
# category: DanEDU.Elements.Boolean.Query
# Determines if element is flipped. Input takes familyinstance, output return boolean (flipped or not)

# group: read source code from the package
filename = StringInput("Boolean_FaceFlipped")
csharp_script_reader_danedu = Custom[Csharp Script Reader|DanEDU](file=filename)  # This node acts as the 'script' input to a 'CsharpScript.FromString' node. NOTE: The Input file must be without file extension!

element = Input()

# group: script input
in_input = CodeBlock(in0=element) { {in0}; }
fromString = Scripting.CSharpScript.FromString(csharp_script_reader_danedu, in_input)

boolean = Output(fromString)
