# Dynamo custom node Csharp Script Reader.dyf "Csharp Script Reader|DanEDU" (Dynamo 1.3.0.875)
# category: DanEDU.Core.Scripting.Actions
# This node acts as the 'script' input to a 'CsharpScript.FromString' node.
# NOTE:
# The Input file must be without file extension!

path = Input(path : string = ".")  # Path to file
file = Input(file : string)  # Python file
refresh = Input(refresh : bool = true)  # Toggle true/false for refreshing
python_script = Python(IN[0]=path, IN[1]=file, IN[2]=refresh)
# ---------- python_script.python (43 lines) ----------
# coding=utf-8
# This file is covered by the LICENSE in this dynamo package 'extra' folder
'''
Input reader to a 'CsharpScript.FromString' node. Return strings.
'''

# Set sys.path
import sys
import System
sys.path.insert(0, 'C:\Program files (x86)\IronPython 2.7\Lib')
for app in System.AppDomain.CurrentDomain.GetAssemblies():
    if 'DanEDUicon' in app.FullName:
        loc = app.Location
app_path = System.IO.Path.GetDirectoryName(loc).rsplit('\\', 1)[0]

# Python and DanEDU modules
import os
import codecs

# input assigned the IN variable
path = IN[0]
source_file = IN[1]

# add path if not is default
if path != '.':
    sys.path.insert(1, path)
    sys.path.insert(2, app_path + '\extra\scr')
else:
    sys.path.insert(1, app_path + '\extra\scr')

# get path to the source file
def sfile():
    for _path in sys.path:
        fname = _path + '\\' + source_file + '.cs'      
        if os.path.exists(fname):
            return fname

with codecs.open(sfile(), 'rb', 'utf-8') as src:
    source = ''.join(src.readlines())

# output assigned the OUT variable
OUT = source
      
# ----------------------------------------
script = Output(python_script)
