# Dynamo custom node Directory_ContentsAll.dyf "Directory.ContentsAll|DanEDU" (Dynamo 1.3.0.875)
# category: DanEDU.Core.Directory.Actions
# Get the files in a directory or a directory and its subdirectories (use bool value for deepsearch). Does not include hidden or readonly files (and thereby system files). Use string for extension type or * for all filetypes!

# group: read source code from the package
filename = StringInput("Directory_ContentsAll")
python_script_reader_danedu = Custom[Python Script Reader|DanEDU](file=filename)  # This node acts as the 'script' input to a 'Python Script From String' node. NOTE: The Input file must be without file extension!

directory = Input(directory : string)  # Directory to get contents of
searchString = Input(searchString : string = "*")  # Search string used to filter results
deepSearch = Input(deepSearch : bool = true)  # Search option used to search in all subfolders
python_source = PythonStringNode(script=python_script_reader_danedu, IN[0]=directory, IN[1]=searchString, IN[2]=deepSearch)
file = Output(python_source)
