# Dynamo custom node Dynamo Settings Path.dyf "Dynamo Settings Path|DanEDU" (Dynamo 1.3.0.875)
# category: DanEDU.Core.Scripting.Query
# Get paths set in the DynamoSettings.xml

python_script = Python()
# ---------- python_script.python (45 lines) ----------
# coding=utf-8
# This file is covered by the LICENSE in this dynamo package 'extra' folder
'''
Get paths set in the DynamoSettings.xml
'''

from System import AppDomain, Environment

import sys
sys.path.append('C:\Program Files (x86)\IronPython 2.7\Lib')
import xml.etree.ElementTree as ET
import os

# get Dynamo Settings path(s)
def dynamo_settings(sandbox=False):
    # get path to application source folder.
    for app in AppDomain.CurrentDomain.GetAssemblies():
        if 'ProtoGeometry' in app.FullName:
            loc = app.Location
        if 'DynamoSandbox' in app.FullName:
            sandbox = True

    dynamo_path = ('\\').join(loc.split('\\')[-4:-1])
    if not sandbox:
        dynamo_path = dynamo_path.replace('Dynamo Core', 'Dynamo Revit')

    appdata = (
        Environment.GetFolderPath(Environment.SpecialFolder.ApplicationData))

    # read the DynamoSettings file
    settings = appdata + '\\' + dynamo_path + '\\' + 'DynamoSettings.xml'
    with open(settings, 'r') as i:
        root = ET.parse(i).getroot()
    i.close()
    custom_package_folders = root.find('CustomPackageFolders')
    paths = []
    for custom_package in custom_package_folders.iter():
        if custom_package.tag == 'string':
            paths.append(custom_package.text)

    return paths

# output assigned the OUT variable
OUT = dynamo_settings()
      
# ----------------------------------------
path = Output(python_script)
