# Dynamo custom node Element_ByCategory.dyf "Element.ByCategory|DanEDU" (Dynamo 1.3.0.875)
# category: DanEDU.Elements.Element.Actions
# Takes Categories as strings (in a list), return elements grouped by categories and the category list

# group: read source code from the package
filename = StringInput("Element_ByCategory")
python_script_reader_danedu = Custom[Python Script Reader|DanEDU](file=filename)  # This node acts as the 'script' input to a 'Python Script From String' node. NOTE: The Input file must be without file extension!

document = Input(document : var[]..[] = "Current.Document")  # Revit.Application.Document
category = Input()  # Category
python_source = PythonStringNode(script=python_script_reader_danedu, IN[0]=document, IN[1]=category)
code_block = CodeBlock(Out=python_source) { Out[0]; Out[1]; }
element = Output(code_block.out0)  # Element
category_2 = Output(code_block.out1)  # "category"; Category
