# Dynamo custom node Element_Delete.dyf "Element.Delete|DanEDU" (Dynamo 1.3.0.875)
# category: DanEDU.Elements.Element.Actions
# Delete elements

# group: read source code from the package
filename = StringInput("Element_Delete")
python_script_reader_danedu = Custom[Python Script Reader|DanEDU](file=filename)  # This node acts as the 'script' input to a 'Python Script From String' node. NOTE: The Input file must be without file extension!

element = Input()  # Element to delete
python_source = PythonStringNode(script=python_script_reader_danedu, IN[0]=element)
void = Output(python_source)
