# Dynamo custom node Element_FaceFlipped.dyf "Element.FaceFlipped|DanEDU" (Dynamo 1.3.2.2480)
# category: DanEDU.Elements.Element.Query
# Determines if element is flipped. Input takes familyinstance, output return two lists (flipped or not)

# group: read source code from the package
filename = StringInput("Element_FaceFlipped")
csharp_script_reader_danedu = Custom[Csharp Script Reader|DanEDU](file=filename)  # This node acts as the 'script' input to a 'CsharpScript.FromString' node. NOTE: The Input file must be without file extension!

element = Input()

# group: script input
in_input = CodeBlock(in0=element) { {in0}; }
fromString = Scripting.CSharpScript.FromString(csharp_script_reader_danedu, in_input)

code_block = CodeBlock(Out=fromString) { Out[0]; Out[1]; }
true = Output(code_block.out0)
false = Output(code_block.out1)
