# Dynamo custom node Element_HasMaterialQuantities.dyf "Element.HasMaterialQuantities|DanEDU" (Dynamo 1.3.0.875)
# category: DanEDU.Elements.Element.Query
# Retrieve elements that has material quantities, return elements grouped by categories and the category list

# group: read source code from the package
filename = StringInput("Element_HasMaterialQuantities")
python_script_reader_danedu = Custom[Python Script Reader|DanEDU](file=filename)  # This node acts as the 'script' input to a 'Python Script From String' node. NOTE: The Input file must be without file extension!

python_source = PythonStringNode(script=python_script_reader_danedu)
code_block = CodeBlock(Out=python_source) { Out[0]; Out[1]; }
element = Output(code_block.out0)  # Element
category = Output(code_block.out1)  # Category
