# Dynamo custom node Element_MaterialDensity.dyf "Element.MaterialDensity|DanEDU" (Dynamo 1.3.0.875)
# category: DanEDU.Elements.Element.Query
# Get material density, return physical and thermal values in SI unit (kg/m3)

# group: read source code from the package
filename = StringInput("Element_MaterialDensity")
python_script_reader_danedu = Custom[Python Script Reader|DanEDU](file=filename)  # This node acts as the 'script' input to a 'Python Script From String' node. NOTE: The Input file must be without file extension!

material = Input()
python_source = PythonStringNode(script=python_script_reader_danedu, IN[0]=material)
code_block = CodeBlock(Out=python_source) { Out[0]; Out[1]; Out[2]; }
physical = Output(code_block.out0)
thermal = Output(code_block.out1)
name = Element.Name(code_block.out2)
name_2 = Output(name)  # "name"
