# Dynamo custom node Element_SetAnalyticalLocation.dyf "Element.SetAnalyticalLocation|DanEDU" (Dynamo 1.3.0.875)
# category: DanEDU.Elements.Element.Actions
# Set (structural) element analytical location

# group: read source code from the package
filename = StringInput("Element_SetAnalyticalLocation")
python_script_reader_danedu = Custom[Python Script Reader|DanEDU](file=filename)  # This node acts as the 'script' input to a 'Python Script From String' node. NOTE: The Input file must be without file extension!

element = Input()  # Element(s)
location = Input(location : string)  # Element analytical location
python_source = PythonStringNode(script=python_script_reader_danedu, IN[0]=element, IN[1]=location)
element_2 = Output(python_source)  # "element"; Analytical floor element
