# Dynamo custom node FEM-design_GetElementID.dyf "FEM-design.GetElementID|DanEDU" (Dynamo 1.3.0.875)
# category: DanEDU.Applications.FEM-design.Query
# Get element id from FEM-design

# group: read source code from the package
filename = StringInput("FEM-design_GetElementID")
python_script_reader_danedu = Custom[Python Script Reader|DanEDU](file=filename)  # This node acts as the 'script' input to a 'Python Script From String' node. NOTE: The Input file must be without file extension!

file = Input(file : string)  # Path and Filename to the FEM-design xml file including extension!
element = Input()  # Element(s)
code_block = CodeBlock(elements=element) { t1 = Flatten({elements}); t1.GetParameterValueByName("StruXML Guid"); }
python_source = PythonStringNode(script=python_script_reader_danedu, IN[0]=file, IN[1]=code_block.t1, IN[2]=code_block.out1)
FEMid = Output(python_source)  # FEM element id
