# Dynamo custom node FEM-design_GetReinforcement.dyf "FEM-design.GetReinforcement|DanEDU" (Dynamo 1.3.0.875)
# category: DanEDU.Applications.FEM-design.Query
# Get reinforcement from FEM-design

# group: read source code from the package
filename = StringInput("FEM-design_GetReinforcement")
python_script_reader_danedu = Custom[Python Script Reader|DanEDU](file=filename)  # This node acts as the 'script' input to a 'Python Script From String' node. NOTE: The Input file must be without file extension!

file = Input(file : string)  # Path and Filename to the FEM-design xml file including extension!
element = Input()  # Element(s)
code_block = CodeBlock(elements=element) { t1 = Flatten({elements}); t1.GetParameterValueByName("StruXML Guid"); }
python_source = PythonStringNode(script=python_script_reader_danedu, IN[0]=file, IN[1]=code_block.t1, IN[2]=code_block.out1)
code_block_2 = CodeBlock(OUT=python_source) { OUT[0]; OUT[1]; OUT[2]; OUT[3]; }
element_2 = Output(code_block_2.out0)  # "element"; Element(s)
wire = Output(code_block_2.out1)  # Reinforcement wire
mesh = Output(code_block_2.out2)  # Reinforcement mesh size
location = Output(code_block_2.out3)  # Reinforcement location
