# Dynamo custom node FEM-design_SetLinearRelease.dyf "FEM-design.SetLinearRelease|DanEDU" (Dynamo 1.3.0.875)
# category: DanEDU.Applications.FEM-design.Actions
# Write (set) linear release in FEM-design xml-file

# group: read source code from the package
filename = StringInput("FEM-design_SetLinearRelease")
python_script_reader_danedu = Custom[Python Script Reader|DanEDU](file=filename)  # This node acts as the 'script' input to a 'Python Script From String' node. NOTE: The Input file must be without file extension!

file = Input(file : string)  # Path and Filename to the FEM-design xml file including extension!
element = Input()  # Element(s)
code_block = CodeBlock(elements=element) { t1 = Flatten({elements}); t1.GetParameterValueByName("StruXML Guid"); }
release = Input(release : string[]..[])  # Release List order: Top, Bottom, Right & Left
XYaxis = Input()  # Element XY-axis value (in meter) List order: XY StartPoint, XY EndPoint, StruXML Guid
Zaxis = Input()  # Element Z-axis value (in meter) List order: Z MinPoint, Z MaxPoint, StruXML Guid
python_source = PythonStringNode(script=python_script_reader_danedu, IN[0]=file, IN[1]=code_block.t1, IN[2]=code_block.out1, IN[3]=release, IN[4]=XYaxis, IN[5]=Zaxis)
release_2 = Output(python_source)  # "release"; FEM release
