# Dynamo custom node FEM-design_SetStiffnessValue.dyf "FEM-design.SetStiffnessValue|DanEDU" (Dynamo 1.3.0.875)
# category: DanEDU.Applications.FEM-design.Actions
# Set stiffness value globally in FEM-design

# group: read source code from the package
filename = StringInput("FEM-design_SetStiffnessValue")
python_script_reader_danedu = Custom[Python Script Reader|DanEDU](file=filename)  # This node acts as the 'script' input to a 'Python Script From String' node. NOTE: The Input file must be without file extension!

file = Input(file : string)  # Path and Filename to the FEM-design xml file including extension!
stiffness = Input(stiffness : string)  # Stiffness to set
value = Input()  # Value to set
python_source = PythonStringNode(script=python_script_reader_danedu, IN[0]=file, IN[1]=stiffness, IN[2]=value)
file_2 = Output(python_source)  # "file"; Path and Filename to the FEM-design xml file including extension!
