# Dynamo custom node FamilyInstance_ByFamilyName.dyf "FamilyInstance.ByFamilyName|DanEDU" (Dynamo 1.3.0.875)
# category: DanEDU.Elements.FamilyInstance.Query
# Obtain a collection of FamilyInstances loaded into the Revit Document and use them in the Dynamo graph

# group: read source code from the package
filename = StringInput("FamilyInstance_ByFamilyName")
python_script_reader_danedu = Custom[Python Script Reader|DanEDU](file=filename)  # This node acts as the 'script' input to a 'Python Script From String' node. NOTE: The Input file must be without file extension!

FamilyName = Input()  # The name of the family type
python_source = PythonStringNode(script=python_script_reader_danedu, IN[0]=FamilyName)
FamilyInstance = Output(python_source)
