# Dynamo custom node Family_AddSharedParameter.dyf "Family.AddSharedParameter|DanEDU" (Dynamo 1.3.0.875)
# category: DanEDU.Elements.Family.Create
# Add shared parameter by name in a family document. Please note that a default shared parameter file must be set in Revit

# group: read source code from the package
filename = StringInput("Family_AddSharedParameter")
python_script_reader_danedu = Custom[Python Script Reader|DanEDU](file=filename)  # This node acts as the 'script' input to a 'Python Script From String' node. NOTE: The Input file must be without file extension!

document = Input(document : var[]..[] = "Current.Document")  # Revit.Application.Document
SP_parameterName = Input(SP_parameterName : string[]..[])  # Parameter name in the shared parameter file
SP_parameterGroup = Input(SP_parameterGroup : string)  # Group of the parameter in the shared parameter file
parameterGroup = Input(parameterGroup : var)  # Group of the parameter in the family document
instance = Input(instance : bool = false)  # Is instance parameter, otherwise its a type parameter
python_source = PythonStringNode(script=python_script_reader_danedu, IN[0]=document, IN[1]=SP_parameterName, IN[2]=SP_parameterGroup, IN[3]=parameterGroup, IN[4]=instance)
document_2 = Output(python_source)  # "document"
