# Dynamo custom node Family_CreateParameter.dyf "Family.CreateParameter|DanEDU" (Dynamo 1.3.0.875)
# category: DanEDU.Elements.Family.Create
# Create a new parameter by name in a family document.

# group: read source code from the package
filename = StringInput("Family_CreateParameter")
python_script_reader_danedu = Custom[Python Script Reader|DanEDU](file=filename)  # This node acts as the 'script' input to a 'Python Script From String' node. NOTE: The Input file must be without file extension!

document = Input(document : var[]..[] = "Current.Document")  # Revit.Application.Document
parameterName = Input(parameterName : string[]..[])  # Parameter Name
parameterType = Input(parameterType : var)  # Parameter Type
parameterGroup = Input(parameterGroup : var)  # Parameter Group
instance = Input(instance : bool = false)  # Is instance parameter, otherwise its a type parameter
python_source = PythonStringNode(script=python_script_reader_danedu, IN[0]=document, IN[1]=parameterName, IN[2]=parameterType, IN[3]=parameterGroup, IN[4]=instance)
document_2 = Output(python_source)  # "document"
