# Dynamo custom node Family_LoadFamily.dyf "Family.LoadFamily|DanEDU" (Dynamo 1.3.0.875)
# category: DanEDU.Elements.Family.Actions
# Load family document into project, existing families will be overwritten, and families is upgraded if needed

# group: read source code from the package
filename = StringInput("Family_LoadFamily")
python_script_reader_danedu = Custom[Python Script Reader|DanEDU](file=filename)  # This node acts as the 'script' input to a 'Python Script From String' node. NOTE: The Input file must be without file extension!

document = Input()  # Revit.Application.Document
python_source = PythonStringNode(script=python_script_reader_danedu, IN[0]=document)
document_2 = Output(python_source)  # "document"
