# Dynamo custom node Family_RemoveFormula.dyf "Family.RemoveFormula|DanEDU" (Dynamo 1.3.0.875)
# category: DanEDU.Elements.Family.Actions
# Remove formula in parameter by name in a family document

# group: read source code from the package
filename = StringInput("Family_RemoveFormula")
python_script_reader_danedu = Custom[Python Script Reader|DanEDU](file=filename)  # This node acts as the 'script' input to a 'Python Script From String' node. NOTE: The Input file must be without file extension!

document = Input(document : var[]..[] = "Current.Document")  # Revit.Application.Document
parameterName = Input(parameterName : string[]..[])  # The name of the parameter to set
python_source = PythonStringNode(script=python_script_reader_danedu, IN[0]=document, IN[1]=parameterName)
document_2 = Output(python_source)  # "document"
