# Dynamo custom node Family_SetFormulaByName.dyf "Family.SetFormulaByName|DanEDU" (Dynamo 1.3.2.2480)
# category: DanEDU.Elements.Family.Actions
# Set formula value by name in a family document.
# It is mandatory that 'value' input is string(s)
# The accepted inputs are as following using 'Code Block'
# string -->  "\"string\""
# number -->  "1"
# formula -->  "formula"

# group: read source code from the package
filename = StringInput("Family_SetFormulaByName")
python_script_reader_danedu = Custom[Python Script Reader|DanEDU](file=filename)  # This node acts as the 'script' input to a 'Python Script From String' node. NOTE: The Input file must be without file extension!

document = Input(document : var[]..[] = "Current.Document")  # Revit.Application.Document
parameterName = Input(parameterName : string[]..[])  # The name of the parameter to set formula
value = Input(value : string[]..[])  # It is mandatory that 'value' input is string(s) The accepted inputs are as following using 'Code Block' string -->  "\"string\"" number -->  "1" formula -->  "formula"
python_source = PythonStringNode(script=python_script_reader_danedu, IN[0]=document, IN[1]=parameterName, IN[2]=value)
document_2 = Output(python_source)  # "document"
