# Dynamo custom node File_LoadFamily.dyf "File.LoadFamily|DanEDU" (Dynamo 1.3.0.875)
# category: DanEDU.Core.File.Actions
# Load family by path, existing families will be overwritten, and families is upgraded if needed

# group: read source code from the package
filename = StringInput("File_LoadFamily")
python_script_reader_danedu = Custom[Python Script Reader|DanEDU](file=filename)  # This node acts as the 'script' input to a 'Python Script From String' node. NOTE: The Input file must be without file extension!

path = Input()  # Path to the file(s)
python_source = PythonStringNode(script=python_script_reader_danedu, IN[0]=path)
file = Output(python_source)
