# Dynamo custom node File_NewProject.dyf "File.NewProject|DanEDU" (Dynamo 1.3.0.875)
# category: DanEDU.Core.File.Create
# Create new project(s) based on a template. Takes also lists of new projects and templates of equal length.

# group: read source code from the package
filename = StringInput("File_NewProject")
python_script_reader_danedu = Custom[Python Script Reader|DanEDU](file=filename)  # This node acts as the 'script' input to a 'Python Script From String' node. NOTE: The Input file must be without file extension!

file = Input(file: string[]..[])  # File(s), must be new project file name(s) incl. path
template = Input(template: string[]..[])  # Template(s) incl. path
python_source = PythonStringNode(script=python_script_reader_danedu, IN[0]=file, IN[1]=template)
file_2 = Output(python_source)  # "file"
