# Dynamo custom node File_Rename.dyf "File.Rename|DanEDU" (Dynamo 1.3.0.875)
# category: DanEDU.Core.File.Actions
# Rename files in a directory, takes two list of identical length. Existing file names must be exact names. Use string for extension type or * for all filetypes!

# group: read source code from the package
filename = StringInput("File_Rename")
python_script_reader_danedu = Custom[Python Script Reader|DanEDU](file=filename)  # This node acts as the 'script' input to a 'Python Script From String' node. NOTE: The Input file must be without file extension!

directory = Input()
extension = Input()
existing_filename = Input()
new_filename = Input()
python_source = PythonStringNode(script=python_script_reader_danedu, IN[0]=directory, IN[1]=extension, IN[2]=existing_filename, IN[3]=new_filename)
file = Output(python_source)
