# Dynamo custom node File_SaveFamily.dyf "File.SaveFamily|DanEDU" (Dynamo 1.3.0.875)
# category: DanEDU.Core.File.Actions
# Save family to path

# group: read source code from the package
filename = StringInput("File_SaveFamily")
python_script_reader_danedu = Custom[Python Script Reader|DanEDU](file=filename)  # This node acts as the 'script' input to a 'Python Script From String' node. NOTE: The Input file must be without file extension!

path = Input()  # Path to save files(s)
family = Input()  # Family to be saved
subfolder = Input(subfolder : bool = false)  # Create subfolder by category?
overwrite = Input(overwrite : bool = true)  # Overwrite existing families?
python_source = PythonStringNode(script=python_script_reader_danedu, IN[0]=path, IN[1]=family, IN[2]=subfolder, IN[3]=overwrite)
saved = Output(python_source)
