# Dynamo custom node Floor_SetAreaLoad.dyf "Floor.SetAreaLoad|DanEDU" (Dynamo 1.3.0.875)
# category: DanEDU.Elements.Floor.Actions
# Set (structural) floor area load

# group: read source code from the package
filename = StringInput("Floor_SetAreaLoad")
python_script_reader_danedu = Custom[Python Script Reader|DanEDU](file=filename)  # This node acts as the 'script' input to a 'Python Script From String' node. NOTE: The Input file must be without file extension!

element = Input()  # Element(s)
value = Input()  # Load value
AreaLoadType = Input()  # AreaLoadType
python_source = PythonStringNode(script=python_script_reader_danedu, IN[0]=element, IN[1]=value, IN[2]=AreaLoadType)
value_2 = Output(python_source)  # "value"; Load value
