# Dynamo custom node List_Clean.dyf "List.Clean|DanEDU" (Dynamo 1.3.0.875)
# category: DanEDU.Core.List.Actions
# Remove empty list, null and blank values
# - former named as RemoveNull

# group: read source code from the package
filename = StringInput("List_Clean")
python_script_reader_danedu = Custom[Python Script Reader|DanEDU](file=filename)  # This node acts as the 'script' input to a 'Python Script From String' node. NOTE: The Input file must be without file extension!

list = Input()
searchFor = Input(searchFor : var[]..[] = { {}, null, "" })  # Item(s) to search for
python_source = PythonStringNode(script=python_script_reader_danedu, IN[0]=list, IN[1]=searchFor)
list_2 = Output(python_source)  # "list"
