# Dynamo custom node List_GetItemAtIndex.dyf "List.GetItemAtIndex|DanEDU" (Dynamo 1.3.2.2480)
# category: DanEDU.Core.List.Actions
# Fetch an item from the given list that's located at the specified index (the full path)

# group: read source code from the package
filename = StringInput("List_GetItemAtIndex")
python_script_reader_danedu = Custom[Python Script Reader|DanEDU](file=filename)  # This node acts as the 'script' input to a 'Python Script From String' node. NOTE: The Input file must be without file extension!

list = Input()  # list to fetch an item from
index = Input()  # index of the item to be fetched
python_source = PythonStringNode(script=python_script_reader_danedu, IN[0]=list, IN[1]=index)
item = Output(python_source)  # item in the list at the given indes
