# Dynamo custom node List_IndexOf.dyf "List.IndexOf|DanEDU" (Dynamo 1.3.0.875)
# category: DanEDU.Core.List.Query
# Returns the index (the full path) of the member in the list

# group: read source code from the package
filename = StringInput("List_IndexOf")
python_script_reader_danedu = Custom[Python Script Reader|DanEDU](file=filename)  # This node acts as the 'script' input to a 'Python Script From String' node. NOTE: The Input file must be without file extension!

list = Input()  # list of values
element = Input()
python_source = PythonStringNode(script=python_script_reader_danedu, IN[0]=list, IN[1]=element)
index = Output(python_source)  # index
