# Dynamo custom node List_Replace.dyf "List.Replace|DanEDU" (Dynamo 1.3.0.875)
# category: DanEDU.Core.List.Actions
# Replace empty list, null and blank values
# - former named as ReplaceNull

# group: read source code from the package
filename = StringInput("List_Replace")
python_script_reader_danedu = Custom[Python Script Reader|DanEDU](file=filename)  # This node acts as the 'script' input to a 'Python Script From String' node. NOTE: The Input file must be without file extension!

list = Input()
searchFor = Input(searchFor : var[]..[] = { {}, null, "" })  # Item(s) to search for
replaceWith = Input(replaceWith : var[]..[])  # replacement value
python_source = PythonStringNode(script=python_script_reader_danedu, IN[0]=list, IN[1]=searchFor, IN[2]=replaceWith)
list_2 = Output(python_source)  # "list"
