# Dynamo custom node List_ReplaceItemAtIndex.dyf "List.ReplaceItemAtIndex|DanEDU" (Dynamo 1.3.0.875)
# category: DanEDU.Core.List.Actions
# Replace an item from the given list that's located at the specified index (the full path)

# group: read source code from the package
filename = StringInput("List_ReplaceItemAtIndex")
python_script_reader_danedu = Custom[Python Script Reader|DanEDU](file=filename)  # This node acts as the 'script' input to a 'Python Script From String' node. NOTE: The Input file must be without file extension!

list = Input()  # list to replace an item in
index = Input()  # index of the item to be replaced
item = Input()  # the item to insert
python_source = PythonStringNode(script=python_script_reader_danedu, IN[0]=list, IN[1]=index, IN[2]=item)
list_2 = Output(python_source)  # "list"; a new list with the item replaced
