# Dynamo custom node List_SortGroupByKey.dyf "List.Sort&GroupByKey|DanEDU" (Dynamo 1.3.0.875)
# category: DanEDU.Core.List.Actions
# Sort items by reference level

# group: read source code from the package
filename = StringInput("List_SortGroupByKey")
python_script_reader_danedu = Custom[Python Script Reader|DanEDU](file=filename)  # This node acts as the 'script' input to a 'Python Script From String' node. NOTE: The Input file must be without file extension!

list = Input()  # List of items to group as sublists
keys = Input()  # Key values, one per item in the input list, used for grouping the items
sortedKeys = Input()  # List of sorted keys
python_source = PythonStringNode(script=python_script_reader_danedu, IN[0]=list, IN[1]=keys, IN[2]=sortedKeys)
code_block = CodeBlock(OUT=python_source) { OUT[0]; OUT[1]; }
groups = Output(code_block.out0)
keys_2 = Output(code_block.out1)  # "keys"
