# Dynamo custom node List_SortNatural.dyf "List.SortNatural|DanEDU" (Dynamo 1.3.0.875)
# category: DanEDU.Core.List.Actions
# Natural sort order is an ordering of elements in alphabetical order. Natural sort order has been promoted as being more human-friendly (natural) than the machine-oriented classical alphanumerical order (en.wikipedia.org/wiki/Natural_sort_order).

# group: read source code from the package
filename = StringInput("List_SortNatural")
python_script_reader_danedu = Custom[Python Script Reader|DanEDU](file=filename)  # This node acts as the 'script' input to a 'Python Script From String' node. NOTE: The Input file must be without file extension!

list = Input()  # list of values
descending = Input(descending : bool = false)
python_source = PythonStringNode(script=python_script_reader_danedu, IN[0]=list, IN[1]=descending)
list_2 = Output(python_source)  # "list"; sorted list
