# Dynamo custom node List_SummationByKey.dyf "List.SummationByKey|DanEDU" (Dynamo 1.3.0.875)
# category: DanEDU.Core.List.Actions
# Summation of values and group items into sub-lists based on their like key values

# group: read source code from the package
filename = StringInput("List_SummationByKey")
python_script_reader_danedu = Custom[Python Script Reader|DanEDU](file=filename)  # This node acts as the 'script' input to a 'Python Script From String' node. NOTE: The Input file must be without file extension!

list = Input()  # List of items as int and double to group and summarize as sublists
keys = Input()  # Key values, one per item in the input list, used for grouping the items
python_source = PythonStringNode(script=python_script_reader_danedu, IN[0]=list, IN[1]=keys)
code_block = CodeBlock(Out=python_source) { Out[1]; Out[0]; }
# note: list of sublist, with items grouped and summarized by like key values
summarized_groups = Output(code_block.out0)
# note: key value corresponding to each group
unique_keys = Output(code_block.out1)
