# Dynamo custom node Object_Hashing.dyf "Object.Hashing|DanEDU" (Dynamo 1.3.0.875)
# category: DanEDU.Core.Object.Actions
# Input is transferred to output along with its hassing value.

# group: read source code from the package
filename = StringInput("Object_Hashing")
python_script_reader_danedu = Custom[Python Script Reader|DanEDU](file=filename)  # This node acts as the 'script' input to a 'Python Script From String' node. NOTE: The Input file must be without file extension!

var = Input()  # "var[]..[]"
python_source = PythonStringNode(script=python_script_reader_danedu, IN[0]=var)
code_block = CodeBlock(OUT=python_source) { OUT[0]; OUT[1]; }
var_2 = Output(code_block.out0)  # "var[]..[]"
hassing = Output(code_block.out1)
