# Dynamo custom node Sigma_Component.dyf "Sigma.Component|DanEDU" (Dynamo 1.3.0.875)
# category: DanEDU.Applications.Sigma.Actions
# Creates list containing a Sigma Component

# group: read source code from the package
filename = StringInput("Sigma_Component")
python_script_reader_danedu = Custom[Python Script Reader|DanEDU](file=filename)  # This node acts as the 'script' input to a 'Python Script From String' node. NOTE: The Input file must be without file extension!

instances = Input(instances : bool = false)  # Component as instances or summarized True select Data to be Instances, False select Data to be summarized
componentTree = Input()  # List containing the structure as strings {"number","text"} At least one 'level' is needed!
element = Input()  # Element(s)
parameterName = Input(parameterName : string = "Type Code")  # Property identity field for Sigma
revitUnit = Input(revitUnit : string = "Area")  # Element quantity (Pcs, Length, Area, Volume)
sigmaUnit = Input(sigmaUnit : string = "m2")  # Unit identifier for Sigma
sigmaRegulation = Input(sigmaRegulation : double = 1.00)  # Regulation for the Sigma Component
sigmaUnit_2 = CodeBlock(element, parameterName, revitUnit, sigmaUnit, sigmaRegulation)
# ---------- sigmaUnit_2.designscript (33 lines) ----------
t1 = Flatten(elements);
t2 = t1.GetParameterValueByName("Type");
t3 = t2.GetParameterValueByName(sigTypeCode);
t4 = rvtUnit;
t5 = sigUnit;
t6 = sigRegulation;

unitBuilder(t3, t4, t5, t1, t6, t1.Id);

//Sigma Units, valid inputs -> pcs, len, area, vol
def unitBuilder(code, rUnit, sUnit, qty, regul, id) {
 return = [Imperative] {
  if(String.ToLower(rUnit) == "pcs") {
   t = Count(qty);
   return = {code, sUnit, t, regul, id};
  }
  elseif (String.ToLower(rUnit) == "length") {
   t = qty.GetParameterValueByName("Length")/1000;
   return = {code, sUnit, t, regul, id};
  }
  elseif (String.ToLower(rUnit) == "area") {
   t = qty.GetParameterValueByName("Area");
   return = {code, sUnit, t, regul, id};
  }
  elseif (String.ToLower(rUnit) == "volume") {
   t = qty.GetParameterValueByName("Volume");
   return = {code, sUnit, t, regul, id};
  }
  else {
   return = {code, null, null, regul, id};
  }
 }
};
# ----------------------------------------
code_block = CodeBlock(tree=componentTree, comp=sigmaUnit_2.out6) { {tree,comp}; }
python_source = PythonStringNode(script=python_script_reader_danedu, IN[0]=instances, IN[1]=code_block)
component = Output(python_source)
