# Dynamo custom node Sigma_ComponentByQuantity.dyf "Sigma.ComponentByQuantity|DanEDU" (Dynamo 1.3.0.875)
# category: DanEDU.Applications.Sigma.Actions
# Creates list containing a Sigma Component by Quantity

# group: read source code from the package
filename = StringInput("Sigma_Component")
python_script_reader_danedu = Custom[Python Script Reader|DanEDU](file=filename)  # This node acts as the 'script' input to a 'Python Script From String' node. NOTE: The Input file must be without file extension!

instances = Input(instances : bool = false)  # Component as instances or summarized True select Data to be Instances, False select Data to be summarized
componentTree = Input()  # List containing the structure as strings {"number","text"} At least one 'level' is needed!
element = Input()  # Element(s)
parameterName = Input(parameterName : string = "Type Code")  # Property identity field for Sigma
revitUnit = Input(revitUnit : double = 1.00)  # Quantity (int or double)
sigmaUnit = Input(sigmaUnit : string = "m2")  # Unit identifier for Sigma
sigmaRegulation = Input(sigmaRegulation : double = 1.00)  # Regulation for the Sigma Component
sigmaUnit_2 = CodeBlock(elements=element, sigTypeCode=parameterName, rvtUnit=revitUnit, sigUnit=sigmaUnit, sigRegulation=sigmaRegulation)
# ---------- sigmaUnit_2.designscript (9 lines) ----------
t1 = Flatten(elements);
t2 = t1.GetParameterValueByName("Type");
t3 = t2.GetParameterValueByName(sigTypeCode);
t4 = DSCore.List.Cycle(rvtUnit,Count(t1));
t5 = DSCore.List.Cycle(sigUnit,Count(t1));
t6 = DSCore.List.Cycle(sigRegulation,Count(t1));

//code, rUnit, sUnit, qty, regul, id
DSCore.List.Transpose({t3[], t5, t4, t6[], t1[].Id});
# ----------------------------------------
code_block = CodeBlock(tree=componentTree, comp=sigmaUnit_2.out6) { {tree,comp}; }
python_source = PythonStringNode(script=python_script_reader_danedu, IN[0]=instances, IN[1]=code_block)
component = Output(python_source)
