# Dynamo custom node Sigma_WriteData.dyf "Sigma.WriteData|DanEDU" (Dynamo 1.3.0.875)
# category: DanEDU.Applications.Sigma.Actions
# Writes data from Revit to Sigma (.sig) fileformat

# group: read source code from the package
filename = StringInput("Sigma_WriteData")
python_script_reader_danedu = Custom[Python Script Reader|DanEDU](file=filename)  # This node acts as the 'script' input to a 'Python Script From String' node. NOTE: The Input file must be without file extension!

file = Input(file : string)  # Path and Filename for Sigma file including extension!
componentRoot = Input(componentRoot : string = "null")  # Component Root where data should be written (or None)
clearing = Input(clearing : bool = false)  # Component Root must exist when using clearning!
component = Input()  # Data from Sigma.Component node
python_source = PythonStringNode(script=python_script_reader_danedu, IN[0]=file, IN[1]=componentRoot, IN[2]=clearing, IN[3]=component)
result = Output(python_source)
