# Dynamo custom node deprecated_BoolFlipped.dyf "deprecated.BoolFlipped|DanEDU" (Dynamo 1.3.0.875)
# category: DanEDU.Deprecated
# This node is deprecated, please use
# Boolean.FaceFlipped and
# Boolean.HandFlipped

element = Input()
string = StringInput("""This node is deprecated, please use
Boolean.FaceFlipped and
Boolean.HandFlipped""")
out = Output(string)
