# Dynamo custom node deprecated_ElemFlipped.dyf "deprecated.ElemFlipped|DanEDU" (Dynamo 1.3.0.875)
# category: DanEDU.Deprecated
# This node is deprecated, please use
# Element.FaceFlipped and
# Element.HandFlipped

element = Input()
string = StringInput("""This node is deprecated, please use
Element.FaceFlipped and
Element.HandFlipped""")
out = Output(string)
