# Dynamo custom node LinearRegressionGradientDescent.dyf (Dynamo 1.2.2.270)
# category: DynamoAI.Algorithms
# For a given initial theta it computes modified theta based on the Gradient descent algorithm for a given input matrix(training data) and corresponding expected output vector.

iterator = Input()
theta = Input(theta : var)
inputMatrix = Input(inputMatrix : Matrix)
transpose = Dynamo.AI.Data.Matrix.Transpose(inputMatrix)
multiply = Dynamo.AI.Data.Matrix.Multiply(inputMatrix, theta)
outputVector = Input(outputVector : var)
subtract = Dynamo.AI.Data.Vector.Subtract(multiply, outputVector)
multiply_2 = Dynamo.AI.Data.Matrix.Multiply(transpose, subtract)
alpha = Input(alpha : double)
code_block = CodeBlock(alpha=alpha, y=outputVector) { alpha/y.Size; }
multiply_3 = Dynamo.AI.Data.Vector.Multiply(multiply_2, code_block)
subtract_2 = Dynamo.AI.Data.Vector.Subtract(theta, multiply_3)
theta_2 = Output(subtract_2)  # "theta : Dynamo.Vector"
