# Dynamo custom node LinearRegressionModel.dyf (Dynamo 1.2.2.270)
# category: DynamoAI.Algorithms
# Creates a linear regression model

TrainingMatrix = Input(TrainingMatrix : Matrix)

# group: Create the input vector by inserting a columns of ones in front
rowCount = Dynamo.AI.Data.Matrix.RowCount(TrainingMatrix)
code_block = CodeBlock { 1; }
ones = Dynamo.AI.Data.Matrix.Ones(rowCount, code_block)
columnCount = Dynamo.AI.Data.Matrix.ColumnCount(TrainingMatrix)
code_block_2 = CodeBlock(c=columnCount) { 0..c-2; }
column = Dynamo.AI.Data.Matrix.Column(TrainingMatrix, code_block_2)
byColumns = Dynamo.AI.Data.Matrix.ByColumns(column)
append = Dynamo.AI.Data.Matrix.Append(ones, byColumns)

# group: The last column is the Output Vector
code_block_3 = CodeBlock(c=columnCount) { c-1; }
column_2 = Dynamo.AI.Data.Matrix.Column(TrainingMatrix, code_block_3)

# group: Solve the linear equation X * a = y for a. X' * X * a = X' * y => a = inv(X'*X) * X' * y
transpose = Dynamo.AI.Data.Matrix.Transpose(append)
multiply = Dynamo.AI.Data.Matrix.Multiply(transpose, append)
inverse = Dynamo.AI.Data.Matrix.Inverse(multiply)
multiply_2 = Dynamo.AI.Data.Matrix.Multiply(inverse, transpose)
multiply_3 = Dynamo.AI.Data.Matrix.Multiply(multiply_2, column_2)

Model = Output(multiply_3)
