# Dynamo custom node NormalizeForGradientDescent.dyf (Dynamo 1.2.2.270)
# category: DynamoAI.Algorithms
# Parses the given matrix for input and output data and then normalizes the input matrix. Returns input matrix, output vector and the normalization function

matrix = Input(matrix : Matrix)
code_block = CodeBlock(matrix=matrix) { size = matrix.ColumnCount; idx = 0..size-2; x = matrix.Column(idx); y = matrix.Column(size-1); m = y.Size; }

# group: Normalized input matrix
code_block_2 = CodeBlock { 1; }
ones = Dynamo.AI.Data.Matrix.Ones(code_block.m, code_block_2)
byColumns = Dynamo.AI.Data.Matrix.ByColumns(code_block.x)
standardDeviation = Dynamo.AI.Data.Statistics.StandardDeviation(byColumns)
normalize = Dynamo.AI.Data.Statistics.Normalize(byColumns, standardDeviation.out1, standardDeviation.out0)
append = Dynamo.AI.Data.Matrix.Append(ones, normalize)

input = Output(append)  # "input : Matrix"
output = Output(code_block.y)  # "output: Dynamo.Vector"
normalize_2 = Dynamo.AI.Data.Statistics.Normalize(arg1=standardDeviation.out1, arg2=standardDeviation.out0)  # unwired: arg0
Normalizer = Output(normalize_2)
