# Dynamo custom node ReadTrainingData.dyf (Dynamo 1.2.2.270)
# category: DynamoAI.Algorithms
# Reads CSV Data from the given file path and normalizes it to output training matrix and expected output vector

filePath = Input(filePath : string)
readFromCSV = Dynamo.AI.Data.Matrix.ReadFromCSV(filePath)
code_block = CodeBlock(matrix=readFromCSV) { size = matrix.ColumnCount; idx = 0..size-2; x = matrix.Column(idx); y = matrix.Column(size-1); m = y.Size; }
ones = Dynamo.AI.Data.Vector.Ones(code_block.m)
byColumns = Dynamo.AI.Data.Matrix.ByColumns(code_block.x)
standardDeviation = Dynamo.AI.Data.Statistics.StandardDeviation(byColumns)
normalize = Dynamo.AI.Data.Statistics.Normalize(byColumns, standardDeviation.out1, standardDeviation.out0)
column = Dynamo.AI.Data.Matrix.Column(normalize, code_block.idx)
addItemToFront = List.AddItemToFront(item=ones, list=column)
byColumns_2 = Dynamo.AI.Data.Matrix.ByColumns(addItemToFront)
input = Output(byColumns_2)  # "input : Matrix"
output = Output(code_block.y)  # "output: Dynamo.Vector"
normalize_2 = Dynamo.AI.Data.Statistics.Normalize(arg1=standardDeviation.out1, arg2=standardDeviation.out0)  # unwired: arg0
Normalizer = Output(normalize_2)
