# Dynamo graph Linear Regression - Normal Equation.dyn (Dynamo 1.2.2.270)

file_path = Filename("data.txt")
importFromCSV = ImportFromCSV(file_path)

# group: Scatter Plot uses Grapher package
code_block = CodeBlock(a=importFromCSV) { a[0]; a[2]; }
code_block_2 = CodeBlock { "Floor Size"; "House Price"; 5; }
chartOptions = Grapher.scatterPlot.chartOptions(arg1=code_block_2.out0, arg2=code_block_2.out1, arg6=code_block_2.out2)
code_block_3 = CodeBlock(code_block.out0, code_block.out1, chartOptions) { scatterPlot.create(x, y, opt); }
watch_image = WatchImageCore(code_block_3)

# group: The last column contains the output values and rest of the columns are input values. Prepare X matrix by inserting column of ones at front and y vector using last column from the data.
code_block_4 = CodeBlock(a=importFromCSV) { a[0..1]; a[2]; }
byColumns = Dynamo.AI.Data.Matrix.ByColumns(code_block_4.out0)
size = Dynamo.AI.Data.Matrix.Size(byColumns)
code_block_5 = CodeBlock { 1; }
ones = Dynamo.AI.Data.Matrix.Ones(size, code_block_5)
append = Dynamo.AI.Data.Matrix.Append(ones, byColumns)
byValues = Dynamo.AI.Data.Vector.ByValues(code_block_4.out1)

code_block_6 = CodeBlock(X=append, y=byValues) { X; y; }

# group: Solve the linear equation X * a = y for a. X' * X * a = X' * y => a = inv(X'*X) * X' * y
transpose = Dynamo.AI.Data.Matrix.Transpose(code_block_6.X)
multiply = Dynamo.AI.Data.Matrix.Multiply(transpose, code_block_6.X)
inverse = Dynamo.AI.Data.Matrix.Inverse(multiply)
multiply_2 = Dynamo.AI.Data.Matrix.Multiply(inverse, transpose)
multiply_3 = Dynamo.AI.Data.Matrix.Multiply(multiply_2, code_block_6.y)

# group: Define the feature vector for the input values
code_block_7 = CodeBlock { size = 1650; rooms = 3; }
code_block_8 = CodeBlock(size=code_block_7.size, rooms=code_block_7.rooms) { {1, size, rooms}; }
byValues_2 = Dynamo.AI.Data.Vector.ByValues(code_block_8)

code_block_9 = CodeBlock(X=byValues_2) { X; }

# group: Now find y = A*X, which can also be represented as DotProduct of two vectors
model = CodeBlock(A=multiply_3) { A; }
dotProduct = Dynamo.AI.Data.Vector.DotProduct(model, code_block_9)
predicted_price = Watch(dotProduct)
