# Dynamo graph LinearRegression-GD.dyn (Dynamo 1.2.2.270)

# group: Load the training data
file_path = Filename(".\data.txt")
readFromCSV = Dynamo.AI.Data.Matrix.ReadFromCSV(file_path)

# group: Input for Prediction
code_block = CodeBlock { 1650; 3; }
code_block_2 = CodeBlock(size=code_block.out0, rooms=code_block.out1) { {size, rooms}; }

# group: Normal Equation
linearRegressionModel = Custom[LinearRegressionModel](TrainingMatrix=readFromCSV)  # Creates a linear regression model
predictLinearRegression = Custom[PredictLinearRegression](Model=linearRegressionModel, Input_Values=code_block_2)  # Predicts a value using linear regression model
toArray = Dynamo.AI.Data.Vector.ToArray(linearRegressionModel)

# group: Training Gradient Descent Model
normalizeForGradientDescent = Custom[NormalizeForGradientDescent](matrix=readFromCSV)  # Parses the given matrix for input and output data and then normalizes the input matrix. Returns input matrix, output vector and the normalization function
code_block_3 = CodeBlock { alpha=0.05; }
linearRegressionGradientDescent = Custom[LinearRegressionGradientDescent](inputMatrix=normalizeForGradientDescent.input, outputVector=normalizeForGradientDescent.output, alpha=code_block_3)  # For a given initial theta it computes modified theta based on the Gradient descent algorithm for a given input matrix(training data) andcorresponding expected output vector.; unwired: iterator, theta
columnCount = Dynamo.AI.Data.Matrix.ColumnCount(readFromCSV)
zeros = Dynamo.AI.Data.Vector.Zeros(columnCount)
code_block_4 = CodeBlock { 400; }
ofRepeatedItem = List.OfRepeatedItem(item=zeros, amount=code_block_4)
reduce = List.Reduce(linearRegressionGradientDescent, zeros, ofRepeatedItem)

# group: Prediction using Gradient Descent Model
byValues = Dynamo.AI.Data.Vector.ByValues(code_block_2)
apply = ApplyFunction(normalizeForGradientDescent.Normalizer, byValues)  # "Function.Apply"
toArray_2 = Dynamo.AI.Data.Vector.ToArray(apply)
predictLinearRegression_2 = Custom[PredictLinearRegression](Model=reduce, Input_Values=toArray_2)
