# Dynamo graph Polynomial Regression.dyn (Dynamo 1.2.2.270)

# group: Define the feature vector for the input values
code_block = CodeBlock { size = 1650; rooms = 3; }
code_block_2 = CodeBlock(size=code_block.size, rooms=code_block.rooms) { {1, size, rooms, size*rooms, size*size, rooms*rooms}; }
byValues = Dynamo.AI.Data.Vector.ByValues(code_block_2)

# group: 1. Read the dataset for training
file_path = Filename("data.txt")
importFromCSV = ImportFromCSV(file_path)

# group: 2. Construct feature vector from the input data, shuffle the input set to separate 80% for training and 20% for testing and creating the X matrix for training.
code_block_3 = CodeBlock(a=importFromCSV) { size = a[0]; rooms = a[1]; price = a[2]; }
code_block_4 = CodeBlock(code_block_3.size, code_block_3.rooms)
# ---------- code_block_4.designscript (9 lines) ----------
def FeatureVector(size : double, rooms : double)
{
    x ={1, size, rooms, size*rooms,
         size*size, rooms*rooms};
 return = Dynamo.Vector.ByValues(x);
};

//Create feature vector for all the data
FeatureVector(size, rooms);
# ----------------------------------------
code_block_5 = CodeBlock(a=code_block_4) { n = Count(a); 0..n-1; train : int = n * 0.8; test = n - train; }
shuffle = List.Shuffle(code_block_5.out1)
code_block_6 = CodeBlock(ids=shuffle, train=code_block_5.train, test=code_block_5.test, data=code_block_4, price=code_block_3.price)
# ---------- code_block_6.designscript (6 lines) ----------
trainIds = ids[0..train-1];
testIds = ids[0..test-1];
trainData = data[trainIds];
trainPrice = price[trainIds];
testData = data[testIds];
testPrice = price[testIds];
# ----------------------------------------
byRows = Dynamo.AI.Data.Matrix.ByRows(code_block_6.trainData)
byValues_2 = Dynamo.AI.Data.Vector.ByValues(code_block_6.trainPrice)

code_block_7 = CodeBlock(X=byRows, y=byValues_2) { X; y; }

# group: Solve the linear equation X * a = y for a. X' * X * a = X' * y => a = inv(X'*X) * X' * y
transpose = Dynamo.AI.Data.Matrix.Transpose(code_block_7.X)
multiply = Dynamo.AI.Data.Matrix.Multiply(transpose, code_block_7.X)
inverse = Dynamo.AI.Data.Matrix.Inverse(multiply)
multiply_2 = Dynamo.AI.Data.Matrix.Multiply(inverse, transpose)
multiply_3 = Dynamo.AI.Data.Matrix.Multiply(multiply_2, code_block_7.y)

code_block_8 = CodeBlock(X=code_block_6.testData) { X; }

# group: Now find y = A*X, which can also be represented as DotProduct of two vectors
model = CodeBlock(A=multiply_3) { A; }
dotProduct = Dynamo.AI.Data.Vector.DotProduct(model, code_block_8)

code_block_9 = CodeBlock(y=dotProduct, y1=code_block_6.testPrice) { diff=y-y1; Math.Sum(diff*diff); }

# group (continued): Now find y = A*X, which can also be represented as DotProduct of two vectors
predicted_price = Watch(code_block_9.diff)

toArray = Dynamo.AI.Data.Vector.ToArray(multiply_3)
readFromCSV = Dynamo.AI.Data.Matrix.ReadFromCSV(file_path)

# group: Prediction based on linear regression model
linearRegressionModel = Custom[LinearRegressionModel](TrainingMatrix=readFromCSV)  # Creates a linear regression model
code_block_10 = CodeBlock(size=code_block.size, rooms=code_block.rooms) { {size, rooms}; }
predictLinearRegression = Custom[PredictLinearRegression](Model=linearRegressionModel, Input_Values=code_block_10)  # Predicts a value using linear regression model
