# Dynamo graph Polynomial regression and model comparison.dyn (Dynamo 1.2.2.270)

# group: 1. Read the data into matrix where last column represents the housing price
file_path = Filename("data.txt")
readFromCSV = Dynamo.AI.Data.Matrix.ReadFromCSV(file_path)

# group: 2. Create additional features based on the polynomial hypothesis and then construct the feature vector X
size = Dynamo.AI.Data.Matrix.Size(readFromCSV)
ones = Dynamo.AI.Data.Vector.Ones(size)
enumerateColumns = Dynamo.AI.Data.Matrix.EnumerateColumns(readFromCSV)
code_block = CodeBlock(a=enumerateColumns) { x1 = a[0]; x2 = a[1]; }
dotMultiply = Dynamo.AI.Data.Vector.DotMultiply(code_block.x1, code_block.x2)
code_block_2 = CodeBlock { 2; }
dotHat = Dynamo.AI.Data.Vector.DotHat(code_block.x1, code_block_2)
dotHat_2 = Dynamo.AI.Data.Vector.DotHat(code_block.x2, code_block_2)

lastItem = List.LastItem(enumerateColumns)

# group (continued): 2. Create additional features based on the polynomial hypothesis and then construct the feature vector X
create = List.Create(ones, code_block.x1, code_block.x2, dotMultiply, dotHat, dotHat_2, lastItem)
byColumns = Dynamo.AI.Data.Matrix.ByColumns(create)

# group: 3. Shuffle the data and extract 80% for training and 20% for testing
shuffleRows = Dynamo.AI.Data.Matrix.ShuffleRows(byColumns)
size_2 = Dynamo.AI.Data.Matrix.Size(shuffleRows)
code_block_3 = CodeBlock(rows=size_2.out0, cols=size_2.out1) { train : int = rows*0.8; test : int = rows - train; {3, cols - 1}; 0; lastColumnIndex = cols -1; }
subMatrix = Dynamo.AI.Data.Matrix.SubMatrix(shuffleRows, code_block_3.out3, code_block_3.train, code_block_3.out3, code_block_3.out2)
column = Dynamo.AI.Data.Matrix.Column(shuffleRows, code_block_3.lastColumnIndex)
subVector = Dynamo.AI.Data.Vector.SubVector(column, code_block_3.out3, code_block_3.train)
subMatrix_2 = Dynamo.AI.Data.Matrix.SubMatrix(shuffleRows, code_block_3.train, code_block_3.test, code_block_3.out3, code_block_3.out2)
subVector_2 = Dynamo.AI.Data.Vector.SubVector(column, code_block_3.train, code_block_3.test)

# group: 4. Solve the linear Equation to get the prediction model
code_block_4 = CodeBlock(trainingFeatures=subMatrix) { trainingFeatures; }
code_block_5 = CodeBlock(trainingPrice=subVector) { trainingPrice; }
solveLinearEquation = Dynamo.AI.Data.Matrix.SolveLinearEquation(code_block_4, code_block_5)

# group: Define the feature vector for the input values
code_block_6 = CodeBlock { size = 1650; rooms = 3; }
code_block_7 = CodeBlock(size=code_block_6.size, rooms=code_block_6.rooms) { v = {1, size, rooms, size*rooms, size*size, rooms*rooms}; {v[0..2], v}; }
byValues = Dynamo.AI.Data.Vector.ByValues(code_block_7.out1)

# group: 6. Now find y = A*X, which can also be represented as DotProduct of two vectors
model = CodeBlock(A=solveLinearEquation) { A; }
code_block_8 = CodeBlock(X=byValues) { X; }
dotProduct = Dynamo.AI.Data.Vector.DotProduct(model, code_block_8)
predicted_price = Watch(dotProduct)

# group: 5. Compute error value based on the test dataset
code_block_9 = CodeBlock(testFeatures=subMatrix_2) { testFeatures; }
multiply = Dynamo.AI.Data.Matrix.Multiply(code_block_9, solveLinearEquation)
code_block_10 = CodeBlock(testPrice=subVector_2) { testPrice; }
subtract = Dynamo.AI.Data.Vector.Subtract(multiply, code_block_10)
sumMagnitudes = Dynamo.AI.Data.Vector.SumMagnitudes(subtract)

toArray = Dynamo.AI.Data.Vector.ToArray(solveLinearEquation)
