# Dynamo custom node Elements.Rotate.dyf (Dynamo 0.8.1.830)
# category: ABT
# Rotates Element(s) over axis (Vector) by list of angles (radian and counterclockwise)

elements = Input()
angles = Input()
vector = Input()
X = Vector.X(vector)
Y = Vector.Y(vector)
Z = Vector.Z(vector)
code_block = CodeBlock(listElements=elements, listAngles=angles, listX=X, listY=Y, listZ=Z)
# ---------- code_block.designscript (5 lines) ----------
List.Flatten({listElements},999);
List.Flatten({listAngles},999);
List.Flatten({listX},999);
List.Flatten({listY},999);
List.Flatten({listZ},999);
# ----------------------------------------
rotate_elements = Python(IN[0]=code_block.out0, IN[1]=code_block.out1, IN[2]=code_block.out2, IN[3]=code_block.out3, IN[4]=code_block.out4)
# ---------- rotate_elements.python (62 lines) ----------
import clr

# Import RevitAPI
clr.AddReference("RevitAPI")
import Autodesk
#from Autodesk.Revit.DB import ReferencePointArray
from Autodesk.Revit.DB import ElementTransformUtils
from Autodesk.Revit.DB import Line
from Autodesk.Revit.DB import Transaction
from Autodesk.Revit.DB import ElementId
from Autodesk.Revit.DB import XYZ
#from Autodesk.Revit import *

# Import DocumentManager and TransactionManager
clr.AddReference("RevitServices")
import RevitServices
from RevitServices import *
from RevitServices.Persistence import DocumentManager
from RevitServices.Transactions import TransactionManager

# Import ToDSType(bool) extension method
clr.AddReference("RevitNodes")
import Revit
clr.ImportExtensions(Revit.Elements)


angle = IN[1]
axisX = IN[2]
axisY = IN[3]
axisZ = IN[4]

changelist = []

# Unwrap
elem = UnwrapElement( IN[0] )

for item in IN[0]:
	nr = IN[0].index(item)

# Start Transaction
	doc = DocumentManager.Instance.CurrentDBDocument
	TransactionManager.Instance.EnsureInTransaction(doc)

# Make changes in model
#axis = NewLineBound(point (0, 0, 0), point (0, 0, 1))


	#for elem_, angle_, axisX_, axisY_, axisZ_ in zip(elem, angle, axisX, axisY, axisZ):
	axisX_ = axisX[0]
	axisY_ = axisY[0]
	axisZ_ = axisZ[0]
	elem_ = elem[nr]
	angle_ = angle[nr]
	
	axis = Line.CreateBound( XYZ(0, 0, 0), XYZ(axisX_, axisY_, axisZ_))
	changelist.append(ElementTransformUtils.RotateElement(doc, elem_.Id, axis, angle_))

# End Transaction
	TransactionManager.Instance.TransactionTaskDone()

# exit
OUT = IN[0]
# ----------------------------------------
elements_2 = Output(rotate_elements)  # "elements"
