# Dynamo custom node Elements.get.Rotation.dyf (Dynamo 0.8.2.1601)
# category: ABT
# This node give the rotation in radians and degrees of elements that are placed in a project/family.
# The rotation is counterclockwise and based on the original orientation.
# Input is an elements or list of elements
# output is a list in radian and degrees

Elements = Input()
get_rotation = Python(IN[0]=Elements)
# ---------- get_rotation.python (33 lines) ----------
import clr
import math

clr.AddReference('ProtoGeometry')
from Autodesk.DesignScript.Geometry import *

# Import RevitAPI
clr.AddReference('RevitAPI')
import Autodesk
#The inputs to this node will be stored as a list in the IN variable.
dataEnteringNode = IN
resultsRadian = []
resultsDegree = []
input = []

#verify that IN[0] is a list, if not make a list out of it
try:
	for items in IN[0]:
		input.append(items)
except:
	input.append(IN[0])

#make unwrapped list of elements
elements = []
for i in input:
	elements.append(UnwrapElement(i))

#get rotation parameter
for item in elements:
	resultsRadian.append(item.Location.Rotation)
	resultsDegree.append(math.degrees(item.Location.Rotation))
	
OUT = resultsRadian, resultsDegree
# ----------------------------------------
firstItem = List.FirstItem(get_rotation)
Radian = Output(firstItem)
lastItem = List.LastItem(get_rotation)
Degrees = Output(lastItem)
