# Dynamo graph VisibilityGraph-Connectivity.dyn (Dynamo 2.0.1.5055)

file_path = Filename(".\spaceSyntax-GalleryExample.json")

# group: JsonData Package - Deserializing lines from json file
fromJsonFile = JsonData.Utilities.Read.FromJsonFile(filepath=file_path)
code_block = CodeBlock { "lines"; }
getValueByKey = JsonObject.GetValueByKey(jsonObject=fromJsonFile, keys=code_block, Nesting=true, Option="None")
values = JsonData.Elements.JsonObject.Values(jsonObject=getValueByKey)
transpose = List.Transpose(lists=values)
code_block_2 = CodeBlock(jsonPoints=transpose) { jsonPoints.GetValueByKey("x", true); jsonPoints.GetValueByKey("y", true); jsonPoints.GetValueByKey("z", true); }
byCoordinates = Point.ByCoordinates(x=code_block_2.out0, y=code_block_2.out1, z=code_block_2.out2)
code_block_3 = CodeBlock(points=byCoordinates) { start = points[0]; end = points[1]; }
byStartPointEndPoint = Line.ByStartPointEndPoint(startPoint=code_block_3.start, endPoint=code_block_3.end)

# group: Group as polygons
buildPolygons = GraphicalDynamo.Geometry.Curves.BuildPolygons(lines=byStartPointEndPoint)
length = Curve.Length()  # unwired: curve
sortByFunction = List.SortByFunction(list=buildPolygons.polygons, func=length)
reverse = List.Reverse(list=sortByFunction)
deconstruct = List.Deconstruct(list=reverse)

# group: Visibility Graph
byBoundaryAndInternalPolygons = GraphicalDynamo.Graphs.BaseGraph.ByBoundaryAndInternalPolygons(boundaries=deconstruct.first, internals=deconstruct.rest)
byBaseGraph = GraphicalDynamo.Graphs.VisibilityGraph.ByBaseGraph(baseGraph=byBoundaryAndInternalPolygons)  # frozen
number_slider = DoubleSlider(0.48, range=0..1 step 0.01)
number_slider_2 = DoubleSlider(1, range=0..1 step 0.01)
code_block_4 = CodeBlock(min=number_slider, max=number_slider_2) { low = Color.ByARGB(150,0,255,0); high = Color.ByARGB(255,255,0,0); colours = [low, high]; indices = [min, max]; }
connectivity = GraphicalDynamo.Graphs.VisibilityGraph.Connectivity(visGraph=byBaseGraph, colours=code_block_4.colours, indices=code_block_4.indices)

number_slider_3 = DoubleSlider(-19022.541, range=-21023.7..44301.768 step 0.1)
number_slider_4 = DoubleSlider(-6370.056, range=-23930.767..8271.476 step 0.1)
byCoordinates_2 = Point.ByCoordinates(x=number_slider_3, y=number_slider_4)
vertexVisibility = GraphicalDynamo.Graphs.BaseGraph.VertexVisibility(graph=byBoundaryAndInternalPolygons, point=byCoordinates_2)
