# Dynamo graph VisibilityGraph-VertexVisibilityArea.dyn (Dynamo 2.0.1.5055)

file_path = Filename(".\spaceSyntax-GalleryExample.json")

# group: JsonData Package - Deserializing lines from json file
fromJsonFile = JsonData.Utilities.Read.FromJsonFile(filepath=file_path)
code_block = CodeBlock { "lines"; }
getValueByKey = JsonObject.GetValueByKey(jsonObject=fromJsonFile, keys=code_block, Nesting=true, Option="None")
values = JsonData.Elements.JsonObject.Values(jsonObject=getValueByKey)
transpose = List.Transpose(lists=values)
code_block_2 = CodeBlock(jsonPoints=transpose) { jsonPoints.GetValueByKey("x", true); jsonPoints.GetValueByKey("y", true); jsonPoints.GetValueByKey("z", true); }
byCoordinates = Point.ByCoordinates(x=code_block_2.out0, y=code_block_2.out1, z=code_block_2.out2)
code_block_3 = CodeBlock(points=byCoordinates) { start = points[0]; end = points[1]; }
byStartPointEndPoint = Line.ByStartPointEndPoint(startPoint=code_block_3.start, endPoint=code_block_3.end)

# group: Group as polygons
buildPolygons = GraphicalDynamo.Geometry.Curves.BuildPolygons(lines=byStartPointEndPoint)
length = Curve.Length()  # unwired: curve
sortByFunction = List.SortByFunction(list=buildPolygons.polygons, func=length)
reverse = List.Reverse(list=sortByFunction)
deconstruct = List.Deconstruct(list=reverse)

number_slider = DoubleSlider(-12818.451, range=-23066.674..77727.618 step 0.1)
number_slider_2 = DoubleSlider(-7350.833, range=-39803.545..110253.284 step 0.1)
byCoordinates_2 = Point.ByCoordinates(x=number_slider, y=number_slider_2)

# group: Visibility Area from Point
byBoundaryAndInternalPolygons = GraphicalDynamo.Graphs.BaseGraph.ByBoundaryAndInternalPolygons(boundaries=deconstruct.first, internals=deconstruct.rest)
isovistFromPoint = GraphicalDynamo.Graphs.BaseGraph.IsovistFromPoint(baseGraph=byBoundaryAndInternalPolygons, point=byCoordinates_2)
code_block_4 = CodeBlock { low = Color.ByARGB(150,0,255,0); }

byGeometryColor = Modifiers.GeometryColor.ByGeometryColor(geometry=isovistFromPoint, color=code_block_4)
number_slider_3 = DoubleSlider(1930.936, range=-107073.321..43014.639 step 0.1)
number_slider_4 = DoubleSlider(-18556.309, range=-54628.746..17062.499 step 0.1)
byCoordinates_3 = Point.ByCoordinates(x=number_slider_3, y=number_slider_4)
list_create = List.Create(item0=byCoordinates_3, item1=byCoordinates_2)
