# Dynamo custom node LunchBox Area Element Collector.dyf (Dynamo 1.2.1.3083)
# category: LunchBox.Revit.Elements
# Collects rooms from the Revit document

Toggle = Input()
python_script = Python(IN[0]=Toggle)
# ---------- python_script.python (110 lines) ----------
#Copyright(c) 2014, Nathan Miller
# The Proving Ground, http://theprovingground.org

import clr

# Import RevitAPI
clr.AddReference("RevitAPI")
import Autodesk
from Autodesk.Revit.DB import *

# Import DocumentManager and TransactionManager
clr.AddReference("RevitServices")
import RevitServices
from RevitServices.Persistence import DocumentManager
from RevitServices.Transactions import TransactionManager

# Import ToDSType(bool) extension method
clr.AddReference("RevitNodes")
import Revit
clr.ImportExtensions(Revit.Elements)
clr.ImportExtensions(Revit.GeometryConversion)

import clr
clr.AddReference('ProtoGeometry')
from Autodesk.DesignScript.Geometry import *

#The input to this node will be stored in the IN[0] variable.

doc =  DocumentManager.Instance.CurrentDBDocument
app =  DocumentManager.Instance.CurrentUIApplication.Application

toggle = IN[0]

output = []
rooms = []
names = []
numbers = []
areas = []
levels = []
boundaries = []
locations = []
areaschemes = []
elementids = []
uniqueids = []

if toggle == True:

	collector = FilteredElementCollector(doc)
	collector.OfCategory(BuiltInCategory.OST_Areas)
 
	famtypeitr = collector.GetElementIdIterator()
	famtypeitr.Reset()


	for item in famtypeitr:
		famtypeID = item
		faminst = doc.GetElement(famtypeID)
    
		#print faminst
		if faminst.Area > 0:
			room = faminst
			for p in room.Parameters:
				if p.Definition.Name == 'Name':		
					roomname = p.AsString()
				if p.Definition.Name == 'Level':			
					level = p.AsValueString()
					if (level is None):
						level = p.AsString()

			number = faminst.Number
			area = faminst.Area
			location = faminst.Location.Point.ToPoint()
			areascheme = faminst.AreaScheme.Name
			elementid = faminst.Id.ToString()
			uniqueid = faminst.UniqueId
    	
			boptions = Autodesk.Revit.DB.SpatialElementBoundaryOptions()
			boundsegs = room.GetBoundarySegments(boptions)
			boundcurves = []
			for bound in boundsegs:
				crvs = []
				for seg in bound:
					crv = seg.GetCurve()
					crvs.append(Revit.GeometryConversion.RevitToProtoCurve.ToProtoType( crv, True ))
				boundcurves.append(crvs)
    	
			rooms.append(room)
			names.append(roomname)
			numbers.append(number)
			areas.append(area)
			levels.append(level)
			boundaries.append(boundcurves)
			areaschemes.append(areascheme)
			locations.append(location)
			elementids.append(elementid)
			uniqueids.append(uniqueid)
        
	output.append(rooms)
	output.append(names)
	output.append(numbers)
	output.append(areas)
	output.append(levels)
	output.append(locations)
	output.append(boundaries)
	output.append(areaschemes)
	output.append(elementids)
	output.append(uniqueids)
        
#Assign your output to the OUT variable
OUT = output
# ----------------------------------------
number = DoubleInput(0)
getItemAtIndex = List.GetItemAtIndex(list=python_script, index=number)
Element = Output(getItemAtIndex)
number_2 = DoubleInput(1)
getItemAtIndex_2 = List.GetItemAtIndex(list=python_script, index=number_2)
Name = Output(getItemAtIndex_2)
number_3 = DoubleInput(2)
getItemAtIndex_3 = List.GetItemAtIndex(list=python_script, index=number_3)
Number = Output(getItemAtIndex_3)
number_4 = DoubleInput(3)
getItemAtIndex_4 = List.GetItemAtIndex(list=python_script, index=number_4)
Area = Output(getItemAtIndex_4)
number_5 = DoubleInput(4)
getItemAtIndex_5 = List.GetItemAtIndex(list=python_script, index=number_5)
Level_Name = Output(getItemAtIndex_5)
number_6 = DoubleInput(5)
getItemAtIndex_6 = List.GetItemAtIndex(list=python_script, index=number_6)
Location = Output(getItemAtIndex_6)
number_7 = DoubleInput(6)
getItemAtIndex_7 = List.GetItemAtIndex(list=python_script, index=number_7)
Boundaries = Output(getItemAtIndex_7)
number_8 = DoubleInput(7)
getItemAtIndex_8 = List.GetItemAtIndex(list=python_script, index=number_8)
AreaScheme = Output(getItemAtIndex_8)
number_9 = DoubleInput(8)
getItemAtIndex_9 = List.GetItemAtIndex(list=python_script, index=number_9)
Element_ID = Output(getItemAtIndex_9)
number_10 = DoubleInput(9)
getItemAtIndex_10 = List.GetItemAtIndex(list=python_script, index=number_10)
Unique_ID = Output(getItemAtIndex_10)
