# Dynamo graph LBML_LinearRegression.dyn (Dynamo 1.3.0.875)

# group: Data to Test
sequence = Sequence(lacing=Longest)

# group: Training Data
number = DoubleInput(10)
number_2 = DoubleInput(20)
# note: Linear Regression with LunchBoxML
# note: Copyright (c) Proving Ground LLC
randomList = Math.RandomList(number_2)
mul = number * randomList
number_3 = DoubleInput(5)
randomList_2 = Math.RandomList(number_2)
mul_2 = number_3 * randomList_2
byCoordinates = Point.ByCoordinates(x=mul, y=mul_2)

# group: LunchBoxML
number_4 = DoubleInput(10)
linearRegression = MachineLearning.Regression.LinearRegression(sequence, mul, mul_2, number_4)

# group: Prediction Curve
byCoordinates_2 = Point.ByCoordinates(x=sequence, y=linearRegression)
byPoints = PolyCurve.ByPoints(points=byCoordinates_2)
