# Dynamo graph LBML_NaiveBayes.dyn (Dynamo 1.3.0.875)

# group: Room Data
# note: Naive Bayes Classifier
# note: Copyright (c) Proving Ground LLC 2017
boolean = BoolSelector(true)
lunchbox_room_element_collector = Custom[LunchBox Room Element Collector](Toggle=boolean)  # Collects rooms from the Revit document

# group: Create Datatable
string = StringInput("Rooms")
string_2 = StringInput("ID")
string_3 = StringInput("Name")
string_4 = StringInput("Department")
create = List.Create(string_2, string_3, string_4)
string_5 = StringInput("Department")
getParameterValueByName = Element.GetParameterValueByName(element=lunchbox_room_element_collector.Element, parameterName=string_5)
create_2 = List.Create(lunchbox_room_element_collector.Element_ID, lunchbox_room_element_collector.Name, getParameterValueByName)
transpose = List.Transpose(create_2)
createDataTable = Lists.DataSets.CreateDataTable(string, create, transpose)

# group: LunchBoxML
string_6 = StringInput("Bath")
string_7 = StringInput("Bedroom")
string_8 = StringInput("Living")
create_3 = List.Create(string_6, string_7, string_8)
string_9 = StringInput("Name")
string_10 = StringInput("Department")
number = DoubleInput(5)
naiveBayesClassifier = MachineLearning.Classification.NaiveBayesClassifier(arg1=createDataTable, arg2=string_9, arg3=string_10, arg4=number)  # unwired: arg0

# group: Result
map = List.Map(list=create_3, f_x=naiveBayesClassifier)
