# Dynamo graph LBML_NonlinearRegression.dyn (Dynamo 1.3.0.875)

# group: Training Data
number = DoubleInput(10)
number_2 = DoubleInput(20)
# note: Nonlinear Regression with LunchBoxML
# note: Copyright (c) Proving Ground LLC
randomList = Math.RandomList(number_2)
mul = number * randomList
number_3 = DoubleInput(5)
randomList_2 = Math.RandomList(number_2)
mul_2 = number_3 * randomList_2
byCoordinates = Point.ByCoordinates(x=mul, y=mul_2)

# group: Test Data
number_4 = DoubleInput(0)
number_5 = DoubleInput(40)
rangeDivision = Lists.Sequence.RangeDivision(number_4, number, number_5)

create = List.Create(rangeDivision)
transpose = List.Transpose(create)
create_2 = List.Create(mul)
transpose_2 = List.Transpose(create_2)
number_slider = DoubleSlider(3.251, range=0..10 step 0.001)
number_6 = DoubleInput(65)
number_7 = DoubleInput(5)

# group: LunchBoxML
nonLinearRegression = MachineLearning.Regression.NonLinearRegression(transpose, transpose_2, mul_2, number_slider, number_6, number_7)

# group: Prediction Curve
byCoordinates_2 = Point.ByCoordinates(x=rangeDivision, y=nonLinearRegression)
byPoints = NurbsCurve.ByPoints(byCoordinates_2)
