# Dynamo graph LBML_NonlinearRegression3D.dyn (Dynamo 1.3.0.875)

# group: Training Data
number = DoubleInput(10)
number_2 = DoubleInput(20)
# note: Nonlinear Regression 3D with LunchBoxML
# note: Copyright (c) Proving Ground LLC
randomList = Math.RandomList(number_2)
mul = number * randomList
number_3 = DoubleInput(10)
randomList_2 = Math.RandomList(number_2)
mul_2 = number_3 * randomList_2
number_4 = DoubleInput(2)
randomList_3 = Math.RandomList(number_2)
mul_3 = number_4 * randomList_3
byCoordinates = Point.ByCoordinates(x=mul, y=mul_2, z=mul_3)
number_5 = DoubleInput(0.25)
byCenterPointRadius = Sphere.ByCenterPointRadius(centerPoint=byCoordinates, radius=number_5)

# group: Test Data
number_6 = DoubleInput(0)
number_7 = DoubleInput(50)
rangeDivision = Lists.Sequence.RangeDivision(number_6, number, number_7)
rangeDivision_2 = Lists.Sequence.RangeDivision(number_6, number, number_7)
byCoordinates_2 = Point.ByCoordinates(x=rangeDivision, y=rangeDivision_2, lacing=CrossProduct)
flatten = Flatten(byCoordinates_2)
deconstructPoint = Geometry.Points.DeconstructPoint(flatten)
create = List.Create(deconstructPoint.out0, deconstructPoint.out1)
transpose = List.Transpose(create)

create_2 = List.Create(mul, mul_2)
transpose_2 = List.Transpose(create_2)
number_slider = DoubleSlider(1.788, range=0..10 step 0.001)
number_8 = DoubleInput(65)
number_9 = DoubleInput(5)

# group: LunchBoxML
nonLinearRegression = MachineLearning.Regression.NonLinearRegression(transpose, transpose_2, mul_3, number_slider, number_8, number_9)

# group: Prediction Surface Plot
byCoordinates_3 = Point.ByCoordinates(x=deconstructPoint.out0, y=deconstructPoint.out1, z=nonLinearRegression)
