# Dynamo custom node All categories in document.dyf (Dynamo 1.2.1.3083)
# category: MEPover.Revit.Elements
# Retrieves all categories from the current document and splits them up in Model, Annotation, Analytic and Internal Categories

python_script = Python()  # unwired: IN[0]
# ---------- python_script.python (37 lines) ----------
import clr
clr.AddReference('RevitAPI')
from Autodesk.Revit.DB import *

clr.AddReference("RevitNodes")
import Revit
clr.ImportExtensions(Revit.Elements)
clr.ImportExtensions(Revit.GeometryConversion)

clr.AddReference("RevitServices")
import RevitServices
from RevitServices.Persistence import DocumentManager
from RevitServices.Transactions import TransactionManager

doc = DocumentManager.Instance.CurrentDBDocument
categories = doc.Settings.Categories

model_cat = []
anno_cat = []
ana_cat = []
internal_cat = []

for c in categories:
	if c.CategoryType == CategoryType.Model:
		if c.SubCategories.Size > 0 or c.CanAddSubcategory:
			model_cat.append(Revit.Elements.Category.ById(c.Id.IntegerValue))
		else:
			continue
	elif c.CategoryType == CategoryType.Annotation:
		anno_cat.append(Revit.Elements.Category.ById(c.Id.IntegerValue))
	elif c.CategoryType == CategoryType.AnalyticalModel:
		ana_cat.append(Revit.Elements.Category.ById(c.Id.IntegerValue))
	elif c.CategoryType == CategoryType.Internal:
		internal_cat.append(Revit.Elements.Category.ById(c.Id.IntegerValue))
		

OUT = model_cat, anno_cat, ana_cat, internal_cat
# ----------------------------------------
code_block = CodeBlock(x=python_script) { x[0]; }
Model_categories = Output(code_block)
code_block_2 = CodeBlock(x=python_script) { x[1]; }
Annotation_categories = Output(code_block_2)
code_block_3 = CodeBlock(x=python_script) { x[2]; }
Analytical_categories = Output(code_block_3)
code_block_4 = CodeBlock(x=python_script) { x[3]; }
Internal_categories = Output(code_block_4)
