# Dynamo custom node Connector.ConnectorSystemType.dyf (Dynamo 1.3.2.2480)
# category: MEPover.Revit.Connectors
# Returns the Connector System Type of the connector

Connector = Input()
python_script = Python(IN[0]=Connector)
# ---------- python_script.python (44 lines) ----------
import clr

clr.AddReference("RevitServices")
import RevitServices
from RevitServices.Persistence import DocumentManager
from RevitServices.Transactions import TransactionManager
doc = DocumentManager.Instance.CurrentDBDocument

clr.AddReference("RevitAPI")
import Autodesk
from Autodesk.Revit.DB import *

clr.AddReference("RevitNodes")
import Revit
clr.ImportExtensions(Revit.Elements)
clr.ImportExtensions(Revit.GeometryConversion)

#Many thanks to Konrad K Sobon for his awesome ProcessList function!
def Unwrap(item):
	return UnwrapElement(item)

def ProcessList(_func, _list):
    return map( lambda x: ProcessList(_func, x) if type(x)==list else _func(x), _list )

if isinstance(IN[0], list):
	connectors = ProcessList(Unwrap, IN[0])
else:
	connectors = [Unwrap(IN[0])]
	
	
def getConnSysType(connector):
	domain = connector.Domain
	if domain == Domain.DomainHvac:
		return connector.DuctSystemType.ToString()
	elif domain == Domain.DomainPiping:
		return connector.PipeSystemType.ToString()
	elif domain == Domain.DomainElectrical:
		return connector.ElectricalSystemType.ToString()
	else:
		return None



OUT = ProcessList(getConnSysType, connectors)
# ----------------------------------------
ConnectorSystemType = Output(python_script)
