# Dynamo custom node FamilyManager.CreateNewType.dyf (Dynamo 1.3.1.1736)
# category: MEPover.Revit.Family
# Creates a new family type with the given name (only works in Family Editor)

NewType = Input(NewType : string)
create_new_types = Python(IN[0]=NewType)
# ---------- create_new_types.python (29 lines) ----------
import clr

clr.AddReference("RevitServices")
import RevitServices
from RevitServices.Persistence import DocumentManager
from RevitServices.Transactions import TransactionManager
doc = DocumentManager.Instance.CurrentDBDocument

clr.AddReference("RevitAPI")
import Autodesk
from Autodesk.Revit.DB import *

clr.AddReference("RevitNodes")
import Revit
clr.ImportExtensions(Revit.Elements)
clr.ImportExtensions(Revit.GeometryConversion)

types = IN[0]


FamilyMan = doc.FamilyManager
TransactionManager.Instance.EnsureInTransaction(doc)
try:
	newtype = FamilyMan.NewType(types)
except:
	newtype = "could not create new type"
TransactionManager.Instance.TransactionTaskDone()

OUT = newtype
# ----------------------------------------
NewType_2 = Output(create_new_types)  # "NewType"
