# Dynamo custom node FamilyManager.RemoveParameter.dyf (Dynamo 1.3.1.1736)
# category: MEPover.Revit.Family
# Searches every family parameter for the given (sub)string and removes that parameter (only works in Family Editor)

Search = Input(Search : string)
python_script = Python(IN[0]=Search)
# ---------- python_script.python (37 lines) ----------
import clr

clr.AddReference("RevitServices")
import RevitServices
from RevitServices.Persistence import DocumentManager
from RevitServices.Transactions import TransactionManager
doc = DocumentManager.Instance.CurrentDBDocument

clr.AddReference("RevitAPI")
import Autodesk
from Autodesk.Revit.DB import *

clr.AddReference("RevitNodes")
import Revit
clr.ImportExtensions(Revit.Elements)
clr.ImportExtensions(Revit.GeometryConversion)

search = IN[0]

FamilyMan = doc.FamilyManager
removed = []

TransactionManager.Instance.EnsureInTransaction(doc)
for param in FamilyMan.Parameters:
	paramName = param.Definition.Name
	if search in paramName:
		try:
			FamilyMan.RemoveParameter(param)
			removed.append(paramName)
		except:
			pass
	
	
TransactionManager.Instance.TransactionTaskDone()
	
	
OUT = removed
# ----------------------------------------
Removed = Output(python_script)  # "Removed : string"
