# Dynamo custom node FamilyManager.RenameFamilyType.dyf (Dynamo 1.3.1.1736)
# category: MEPover.Revit.Family
# Searches every family type for the given (sub)string and replace that the (sub)string with the replace string (only works in Family Editor)

Search = Input(Search : string)
Replace = Input(Replace : string)
rename_family_type = Python(IN[0]=Search, IN[1]=Replace)
# ---------- rename_family_type.python (40 lines) ----------
import clr

clr.AddReference("RevitServices")
import RevitServices
from RevitServices.Persistence import DocumentManager
from RevitServices.Transactions import TransactionManager
doc = DocumentManager.Instance.CurrentDBDocument

clr.AddReference("RevitAPI")
import Autodesk
from Autodesk.Revit.DB import *

clr.AddReference("RevitNodes")
import Revit
clr.ImportExtensions(Revit.Elements)
clr.ImportExtensions(Revit.GeometryConversion)

search = IN[0]
replace = IN[1]

FamilyMan = doc.FamilyManager
types = FamilyMan.Types
typenames = []

TransactionManager.Instance.EnsureInTransaction(doc)
for type in types:
	FamilyMan.CurrentType = type
	typename = FamilyMan.CurrentType.Name
	if search in typename:
		newname = typename.replace(search, replace)
		typenames.append(newname)
		FamilyMan.RenameCurrentType(newname)
	else:
		typenames.append(typename)
	
	
TransactionManager.Instance.TransactionTaskDone()
	
	
OUT = typenames
# ----------------------------------------
TypeName = Output(rename_family_type)  # "TypeName : string"
