# Dynamo custom node FlexCurve.ByElements.dyf (Dynamo 1.2.1.3083)
# category: MEPover.Revit.Elements
# Creates a flex duct or flex pipe between 2 elements. Input IN[2] expects a FlexDuctType or FlexPipeType

Element = Input()
Element_2 = Input(Element)
FlexMEPType = Input()
python_script = Python(IN[0]=Element, IN[1]=Element_2, IN[2]=FlexMEPType)
# ---------- python_script.python (115 lines) ----------
import clr

clr.AddReference("RevitServices")
import RevitServices
from RevitServices.Persistence import DocumentManager
from RevitServices.Transactions import TransactionManager
doc = DocumentManager.Instance.CurrentDBDocument

clr.AddReference("RevitAPI")
from Autodesk.Revit.DB import *

clr.AddReference("RevitNodes")
import Revit
clr.ImportExtensions(Revit.Elements)
clr.ImportExtensions(Revit.GeometryConversion)

clr.AddReference('System')		
from System.Collections.Generic import List

if isinstance(IN[0], list):
	pipe1 = UnwrapElement(IN[0])
else:
	pipe1 = [UnwrapElement(IN[0])]
if isinstance(IN[1], list):
	pipe2 = UnwrapElement(IN[1])
else:
	pipe2 = [UnwrapElement(IN[1])]
flextype = UnwrapElement(IN[2])


def closest_connectors(pipe1, pipe2):
	try:
		conn1 = pipe1.ConnectorManager.UnusedConnectors
	except:
		conn1 = pipe1.MEPModel.ConnectorManager.UnusedConnectors
	try:
		conn2 = pipe2.ConnectorManager.UnusedConnectors
	except:
		conn2 = pipe2.MEPModel.ConnectorManager.UnusedConnectors
	
	dist = 100000000
	connset = None
	for c in conn1:
		for d in conn2:
			conndist = c.Origin.DistanceTo(d.Origin)
			if conndist < dist:
				dist = conndist
				connset = [c,d]
	return connset
	
def createFlexPipe(conn1,conn2,starttan,endtan,levelid,systype):
	points = List[XYZ]([conn1.CoordinateSystem.Origin,conn2.CoordinateSystem.Origin])
	flex = Plumbing.FlexPipe.Create(doc,systype,flextype.Id,levelid,starttan,endtan,points)
	param = flex.get_Parameter(BuiltInParameter.RBS_PIPE_DIAMETER_PARAM)
	param.Set(conn1.Radius*2)
	return flex
	
def createFlexDuct(conn1,conn2,starttan,endtan,levelid,systype):
	points = List[XYZ]([conn1.CoordinateSystem.Origin,conn2.CoordinateSystem.Origin])
	flex = Mechanical.FlexDuct.Create(doc,systype,flextype.Id,levelid,starttan,endtan,points)
	param = flex.get_Parameter(BuiltInParameter.RBS_CURVE_DIAMETER_PARAM)
	param.Set(conn1.Radius*2)
	return flex

	
fittings = []

TransactionManager.Instance.EnsureInTransaction(doc)
for p1,p2 in zip(pipe1,pipe2):
	if p1.GetType() == Plumbing.Pipe or p1.GetType() == Mechanical.Duct:
		ptemp = p1
		p1 = p2
		p2 = ptemp
	
	connectors = closest_connectors(p1,p2)
	starttang = connectors[0].CoordinateSystem.BasisZ
	endtang = connectors[1].CoordinateSystem.BasisZ.Negate()
	levelid = p1.LevelId
	
	line = Line.CreateUnbound(connectors[0].Origin,connectors[0].CoordinateSystem.BasisZ)
	point = line.Evaluate(10/304.8,False)

	points = List[XYZ]([point,connectors[1].Origin])
	
	radius = connectors[0].Radius
	
	if p2.GetType() == Mechanical.Duct:
		systypeId = p2.get_Parameter(BuiltInParameter.RBS_DUCT_SYSTEM_TYPE_PARAM).AsElementId()
		flex = createFlexDuct(connectors[0],connectors[1],starttang,endtang,levelid,systypeId)
	else:
		systypeId = p2.get_Parameter(BuiltInParameter.RBS_PIPING_SYSTEM_TYPE_PARAM).AsElementId()
		flex = createFlexPipe(connectors[0],connectors[1],starttang,endtang,levelid,systypeId)

	doc.Regenerate()

	
	conns = closest_connectors(flex,p1)
	if conns[0].Radius == conns[1].Radius:
		conns[0].ConnectTo(conns[1])
	else:
		doc.Create.NewUnionFitting(conns[0],conns[1])
		
	doc.Regenerate()
	conns = closest_connectors(flex,p2)
	if conns[0].Radius == conns[1].Radius:
		conns[0].ConnectTo(conns[1])
	else:
		doc.Create.NewUnionFitting(conns[0],conns[1])
	
	fittings.append(flex.ToDSType(False))
TransactionManager.Instance.TransactionTaskDone()

			

OUT = fittings
# ----------------------------------------
FlexMEP = Output(python_script)
