# Dynamo custom node PanelScheduleView.ElectricalCircuits.dyf (Dynamo 1.3.2.2480)
# category: MEPover.Revit.PanelSchedule
# Returns the circuits that are listed in the panelschedule, this includes spare circuits.

PanelScheduleView = Input()
python_script = Python(IN[0]=PanelScheduleView)
# ---------- python_script.python (59 lines) ----------
import clr

clr.AddReference("RevitServices")
import RevitServices
from RevitServices.Persistence import DocumentManager
from RevitServices.Transactions import TransactionManager
doc = DocumentManager.Instance.CurrentDBDocument

clr.AddReference("RevitAPI")
import Autodesk
from Autodesk.Revit.DB import *

clr.AddReference("RevitNodes")
import Revit
clr.ImportExtensions(Revit.Elements)
clr.ImportExtensions(Revit.GeometryConversion)

#Many thanks to Konrad K Sobon for his awesome ProcessList function!
def Unwrap(item):
	return UnwrapElement(item)

def ProcessList(_func, _list):
    return map( lambda x: ProcessList(_func, x) if type(x)==list else _func(x), _list )

if isinstance(IN[0], list):
	panelschedule = ProcessList(Unwrap, IN[0])
else:
	panelschedule = [Unwrap(IN[0])]
	
	
def GetNumber(panelschedule):
	i = 0
	circuits = []
	foundcircuit = False
	while True:
		if panelschedule.GetTableData().GetNumberOfCircuitRows() < i:
			break
		circuit = panelschedule.GetCircuitByCell(i,0)
		if circuit == None and foundcircuit == True:
			break
		if circuit == None and foundcircuit == False:
			i += 1
			continue
		if circuit.GetType() == Electrical.ElectricalSystem and foundcircuit == False:
			foundcircuit = True
			circuits.append(circuit.ToDSType(True))
			i += 1
			continue
		if circuit.GetType() != Electrical.ElectricalSystem:
			break
		circuits.append(circuit.ToDSType(True))
		i += 1
		if i > 1000:
			break
	return circuits



OUT = ProcessList(GetNumber, panelschedule)
# ----------------------------------------
Circuits = Output(python_script)
