# Dynamo custom node View.SetCategoryVisibility.dyf (Dynamo 1.2.1.3083)
# category: MEPover.Revit.View
# Will set the category visibility for the view. Does not work if a view template dictates the category visibility

Category = Input()
View = Input()
Bool = Input()
python_script = Python(IN[0]=Category, IN[1]=View, IN[2]=Bool)
# ---------- python_script.python (44 lines) ----------
import clr

clr.AddReference("RevitServices")
import RevitServices
from RevitServices.Persistence import DocumentManager
from RevitServices.Transactions import TransactionManager
doc = DocumentManager.Instance.CurrentDBDocument

clr.AddReference("RevitAPI")
import Autodesk
from Autodesk.Revit.DB import *

clr.AddReference("RevitNodes")
import Revit
clr.ImportExtensions(Revit.Elements)
clr.ImportExtensions(Revit.GeometryConversion)
#The inputs to this node will be stored as a list in the IN variables.
if isinstance(IN[0],list):
	category = UnwrapElement(IN[0])
else:
	category = [UnwrapElement(IN[0])]
if isinstance(IN[1], list):	
	views = UnwrapElement(IN[1])
else:
	views = [UnwrapElement(IN[1])]
if isinstance(IN[2],list):
	bools = IN[2]
else:
	bools = [IN[2]]

report = []
TransactionManager.Instance.EnsureInTransaction(doc)
for view,bool in zip(views,bools):
	for cat in category:
		try:
			view.SetVisibility(cat,bool)
			error = "Succes"
		except:
			error = "Could not set visibility"
	report.append(error)
TransactionManager.Instance.TransactionTaskDone()

#Assign your output to the OUT variable.
OUT = report
# ----------------------------------------
