# Dynamo custom node RIE.BboxFromBboxString.dyf (Dynamo 1.3.2.2480)
# category: RIE.Geometry
# Can convert BoundingBox list element that has been converted to string back to a BoundingBox

BboxStr = Input()
python_script = Python(IN[0]=BboxStr)
# ---------- python_script.python (89 lines) ----------
import clr
clr.AddReference('ProtoGeometry')
from Autodesk.DesignScript.Geometry import *
#The inputs to this node will be stored as a list in the IN variables.

clr.AddReference('RevitAPI')
from Autodesk.Revit.DB import *

clr.AddReference('DSCoreNodes') 
import DSCore
from DSCore import *
from Autodesk.DesignScript.Geometry import *

clr.AddReference('RevitAPIUI')
from  Autodesk.Revit.UI import UIView

clr.AddReference("RevitNodes")
import Revit
# Import ToProtoType, ToRevitType geometry conversion extension methods
clr.ImportExtensions(Revit.GeometryConversion)
clr.ImportExtensions(Revit.Elements)

# Import DocumentManager and TransactionManager
clr.AddReference("RevitServices")
import RevitServices
from RevitServices.Persistence import DocumentManager
from RevitServices.Transactions import TransactionManager

doc = DocumentManager.Instance.CurrentDBDocument
uidoc=DocumentManager.Instance.CurrentUIApplication.ActiveUIDocument

OUT = []
String = []
NonString = []

for strng in range(0,len(IN[0])):
	if isinstance(IN[0][strng], basestring):
		if IN[0][strng].find("BoundingBox") <> -1:
			String.append(IN[0][strng])
		else:
			NonString.append(strng)
	else:
		NonString.append(strng)
	strng += 1
	
MinPoint = []
MaxPoint = []

for strng in range(0,len(String)):
	if isinstance(String[strng], basestring):
		MinPoint.append(String[strng].find("MinPoint = "))
		MaxPoint.append(String[strng].find("MaxPoint = "))


MinPoint2 = []
MaxPoint2 = []
NotPoint = []

for strng in range(0,len(MinPoint)):
	min = MinPoint[strng]
	max = MaxPoint[strng]
	MinPoint2.append(String[strng][min:max])
	MaxPoint2.append(String[strng][max:])

		
for _ in range(0,len(MinPoint2)):
	MinPoint2[_] = MinPoint2[_].split()
for _ in range(0,len(MaxPoint2)):
	MaxPoint2[_] = MaxPoint2[_].split()

MinPointList = []
MaxPointList = []
Bbox = []

for _ in range(0,len(String)):
	MinPointList.append(Point.ByCoordinates(float(MinPoint2[_][4][:-2].strip()),float(MinPoint2[_][7][:-2].strip()),float(MinPoint2[_][10][:-2].strip())))
	MaxPointList.append(Point.ByCoordinates(float(MaxPoint2[_][4][:-2].strip()),float(MaxPoint2[_][7][:-2].strip()),float(MaxPoint2[_][10][:-2].strip())))
	
BoundingB = []

for _ in range(0, len(MinPointList)):
	ptMin = MinPointList[_].ToXyz()
	ptMax = MaxPointList[_].ToXyz()
	Bbox = BoundingBoxXYZ()
	Bbox.Min = ptMin
	Bbox.Max = ptMax
	BoundingB.append(Bbox.ToProtoType())

OUT = BoundingB, NonString
# ----------------------------------------
code_block = CodeBlock(a=python_script) { a[0]; a[1]; }
BoundingBox = Output(code_block.out0)
NotBboxIndex = Output(code_block.out1)
