# Dynamo custom node RIE.BoundingBox.Expand.dyf (Dynamo 1.3.2.2480)
# category: RIE.Geometry
# Expands the input boundingbox by given input amount

BBox = Input()
minPoint = BoundingBox.MinPoint(BBox)
maxPoint = BoundingBox.MaxPoint(BBox)
join = List.Join(minPoint, maxPoint)
XAxis = Vector.XAxis()
reverse = Vector.Reverse(XAxis)
YAxis = Vector.YAxis()
reverse_2 = Vector.Reverse(YAxis)
ZAxis = Vector.ZAxis()
reverse_3 = Vector.Reverse(ZAxis)
join_2 = List.Join(XAxis, reverse, YAxis, reverse_2, ZAxis, reverse_3)
Amount = Input()
byStartPointDirectionLength = Line.ByStartPointDirectionLength(startPoint=join, direction=join_2, length=Amount, lacing=CrossProduct)
flatten = Flatten(byStartPointDirectionLength)
byGeometry = BoundingBox.ByGeometry(flatten)
BBox_2 = Output(byGeometry)  # "BBox"
