# Dynamo custom node RIE.ClosestPointByTwoListsOfPoints.dyf (Dynamo 1.3.2.2480)
# category: RIE.Geometry
# Finds each "points1" closest "points2"

points1 = Input()
points2 = Input()
python_script = Python(IN[0]=points1, IN[1]=points2)
# ---------- python_script.python (54 lines) ----------
import clr
import math
from operator import itemgetter

clr.AddReference('ProtoGeometry')
from Autodesk.DesignScript.Geometry import *

#Points inputs
def tolist(input):
	if isinstance(input, list):
		return input
	else:
		return [input]
From = tolist(IN[0])
To = tolist(IN[1])

#Define OUT as an array
OUT = []

#Define lists for each output
Result = []
MinDist = []
Indexes = []

#Define function to deconstruct points into X Y and Z values.
def pt_deconstr(pt):
	return [pt.X,pt.Y,pt.Z]
	
#Define function to mathematically calculate vector distance in 3D space between two points.	
def dist_constr(ptFrom, ptTo):
	return math.sqrt(math.pow(ptFrom[0]-ptTo[0],2)+math.pow(ptFrom[1]-ptTo[1],2)+math.pow(ptFrom[2]-ptTo[2],2))

#Loop through points. For each point in input 1, check distance to all points in input 2, and append information about the nearest point to the outputs (Point, Distance and index in input 2 list).
if type(From) == list and type(To) == list:
	for i in From:
		Dist = []
		ptFrom = pt_deconstr(i)
		for n in To:
			ptTo = pt_deconstr(n)
			Dist.append(dist_constr(ptFrom, ptTo))
		
		#Find index of nearest point in input 2 list.		
		closest = min(enumerate(Dist), key=itemgetter(1))[0]
		
		#Append values to output lists.
		Result.append(To[closest])
		MinDist.append(min(Dist))
		Indexes.append(closest)
		
	#Outputs
	OUT = [Result, MinDist, Indexes]
else:
	#Outputs if any empty list on input
	OUT = ["Insufficient","inputs","detected"]
# ----------------------------------------
code_block = CodeBlock(a=python_script) { a[0]; a[1]; a[2]; }
Dist = Output(code_block.out1)
Indexes = Output(code_block.out2)
points2refs = Output(code_block.out0)
