# Dynamo custom node RIE.CopyElementsFromViewToView.dyf (Dynamo 1.3.2.2480)
# category: RIE.Elements
# Copies elements from view to view.

FromViews = Input()
Elements = Input()
ToViews = Input()
python_script = Python(IN[0]=FromViews, IN[1]=Elements, IN[2]=ToViews)
# ---------- python_script.python (41 lines) ----------
import clr

# Import RevitAPI
clr.AddReference("RevitAPI")
from Autodesk.Revit.DB import *

clr.AddReference("System")
from System.Collections.Generic import List

# Import DocumentManager and TransactionManager
clr.AddReference("RevitServices")
import RevitServices
from RevitServices.Persistence import DocumentManager
from RevitServices.Transactions import TransactionManager

# ----- // #


doc = DocumentManager.Instance.CurrentDBDocument

def tolist(obj):
	if isinstance(obj, list):
		return UnwrapElement(obj)
	else:
		return [UnwrapElement(obj)]
		
view1 = UnwrapElement(IN[0])
elementslist = tolist(IN[1])
view2 = UnwrapElement(IN[2])

# Start Transaction
TransactionManager.Instance.EnsureInTransaction(doc)

elementsId = List[ElementId]([el.Id for el in elementslist])

c = ElementTransformUtils.CopyElements(view1, elementsId, view2, None, None)

# End Transaction
TransactionManager.Instance.TransactionTaskDone()

OUT = c
# ----------------------------------------
OUT = Output(python_script)
