# Dynamo custom node RIE.CopyViewRangeFromViewToView.dyf (Dynamo 1.3.2.2480)
# category: RIE.Views
# Copy view range from views to views.

ViewsFrom = Input()
ViewsTo = Input()
python_script = Python(IN[0]=ViewsFrom, IN[1]=ViewsTo)
# ---------- python_script.python (28 lines) ----------
import clr
clr.AddReference('RevitAPI')
from Autodesk.Revit.DB import*
clr.AddReference('RevitServices')
from RevitServices.Persistence import DocumentManager
from RevitServices.Transactions import TransactionManager

doc = DocumentManager.Instance.CurrentDBDocument

def tolist(obj):
	if isinstance(obj, list):
		return UnwrapElement(obj)
	else:
		return [UnwrapElement(obj)]

viewsF = tolist(IN[0])
viewsT = tolist(IN[1])

TransactionManager.Instance.EnsureInTransaction(doc)

for viewF, viewT in zip(viewsF, viewsT):

	viewrange = viewF.GetViewRange()
	viewT.SetViewRange(viewrange)

TransactionManager.Instance.TransactionTaskDone()

OUT = IN[1]
# ----------------------------------------
ViewsTo_2 = Output(python_script)  # "ViewsTo"
