# Dynamo custom node RIE.DeconstructPoint.dyf (Dynamo 1.3.2.2480)
# category: RIE.Geometry
# Deconstructs points into their X, Y and Z values. Idea stolen from Lunchbox's equivalent node.

Point = Input()
python_script = Python(IN[0]=Point)
# ---------- python_script.python (24 lines) ----------
import clr
clr.AddReference('ProtoGeometry')
from Autodesk.DesignScript.Geometry import *
#The inputs to this node will be stored as a list in the IN variables.

X = list()
Y = list()
Z = list()

def tolist(input):
	if isinstance(input, list):
		return input
	else:
		return [input]
		
def splitPt(pt):
	return [pt.X,pt.Y,pt.Z]

for pt in tolist(IN[0]):
	X.append(splitPt(pt)[0])
	Y.append(splitPt(pt)[1])
	Z.append(splitPt(pt)[2])
		
OUT = X, Y, Z
# ----------------------------------------
code_block = CodeBlock(a=python_script) { a[0]; a[1]; a[2]; }
X = Output(code_block.out0)
Y = Output(code_block.out1)
Z = Output(code_block.out2)
