# Dynamo custom node RIE.DrawLinesToNearbyPoints.dyf (Dynamo 1.3.2.2480)
# category: RIE.Geometry
# Input Two lists of points and from each point in list 1 there will be drawn a line to each point in list 2 which is closer than the input value in list 3

PointsFrom = Input()
PointsTo = Input()
MaxDistance = Input()
python_script = Python(IN[0]=PointsFrom, IN[1]=PointsTo, IN[2]=MaxDistance)
# ---------- python_script.python (51 lines) ----------
import clr
import math
from operator import itemgetter

clr.AddReference('ProtoGeometry')
from Autodesk.DesignScript.Geometry import *

#Points inputs
From = IN[0]
To = IN[1]

#Define OUT as an array
OUT = []

#Define lists for each output
Result = []
MinDist = []
Indexes = []
closepts = []
ClosePt = []
Dists = []

#Define function to deconstruct points into X Y and Z values.
def pt_deconstr(pt):
	return [pt.X,pt.Y,pt.Z]
	
#Define function to mathematically calculate vector distance in 3D space between two points.	
def dist_constr(ptFrom, ptTo):
	return math.sqrt(math.pow(ptFrom[0]-ptTo[0],2)+math.pow(ptFrom[1]-ptTo[1],2)+math.pow(ptFrom[2]-ptTo[2],2))

#Loop through points. For each point in input 1, check distance to all points in input 2, and append information about the nearest point to the outputs (Point, Distance and index in input 2 list).
if type(From) == list and type(To) == list:
	for i in From:
		Dist = []
		ptFrom = pt_deconstr(i)
		for n in To:
			ptTo = pt_deconstr(n)
			if dist_constr(ptFrom, ptTo) >= 1 and dist_constr(ptFrom, ptTo) < IN[2]:
				Dist.append(dist_constr(ptFrom, ptTo))
				closepts.append(n)
		ClosePt.append(closepts)
		closepts = []
		Dists.append(Dist)
		Dist = []
	#Outputs
	for i in range(0, len(IN[0])):
		for j in ClosePt[i]:
			OUT.append(Line.ByStartPointEndPoint(IN[0][i],j))
else:
	#Outputs if any empty list on input
	OUT = ["Insufficient","inputs","detected"]
# ----------------------------------------
Lines = Output(python_script)
