# Dynamo custom node RIE.DrawWires.dyf (Dynamo 1.3.2.2480)
# category: RIE.Power
# Draws wires for the Electrical System in the input view.

Circuit = Input()
Chamfer = Input(Chamfer:bool=false)
python_script = Python(IN[0]=Circuit, IN[1]=Chamfer)
# ---------- python_script.python (59 lines) ----------
import clr
clr.AddReference('ProtoGeometry')
from Autodesk.DesignScript.Geometry import *

clr.AddReference('RevitServices')
import RevitServices
from RevitServices.Persistence import DocumentManager
from RevitServices.Transactions import TransactionManager
from System.Collections.Generic import *

clr.AddReference('RevitNodes')
import Revit
clr.ImportExtensions(Revit.Elements)

clr.AddReference('RevitAPI')
import Autodesk
from Autodesk.Revit.DB import *
from Autodesk.Revit.DB.Electrical import *

clr.AddReference('DSCoreNodes')
import DSCore
from DSCore.List import *

import sys
pyt_path = r'C:\Program Files (x86)\IronPython 2.7\Lib'
sys.path.append(pyt_path)

#The inputs to this node will be stored as a list in the IN variables.
addto = UnwrapElement(IN[0])

doc = DocumentManager.Instance.CurrentDBDocument
uiapp = DocumentManager.Instance.CurrentUIApplication
app = uiapp.Application
uidoc = DocumentManager.Instance.CurrentUIApplication.ActiveUIDocument

view = uidoc.ActiveView

OUT = []
a = []

TransactionManager.Instance.EnsureInTransaction(doc)
if IN[1] == False:
	try:
		for _ in addto:
			a.append(_.NewWires(view, WiringType.Arc))
	except:
		a.append(addto.NewWires(view, WiringType.Arc))
if IN[1] == True:
	try:
		for _ in addto:
			a.append(_.NewWires(view, WiringType.Chamfer))
	except:
		a.append(addto.NewWires(view, WiringType.Chamfer))
	
TransactionManager.Instance.TransactionTaskDone()

for __ in a:
	for ___ in __:
		OUT.append(___.ToDSType(False))
# ----------------------------------------
Wires = Output(python_script)
