# Dynamo custom node RIE.DropNthItemInSublists.dyf (Dynamo 1.3.2.2480)
# category: RIE.List
# Input list of indexes to be dropped from each sublist.

Lists = Input()
Indexes = Input()
python_script = Python(IN[0]=Lists, IN[1]=Indexes)
# ---------- python_script.python (17 lines) ----------
import clr
clr.AddReference('ProtoGeometry')
from Autodesk.DesignScript.Geometry import *

List = IN[0]
Nth = IN[1]
OUT = []
collector = []
nth = 0

for i in List:
	for _ in i:
		if i.index(_) <> Nth[nth]:
			collector.append(_)
	OUT.append(collector)
	collector = []
	nth += 1
# ----------------------------------------
Lists_2 = Output(python_script)  # "Lists"
