# Dynamo custom node RIE.ElementsOfCategoryByView.dyf (Dynamo 1.3.2.2480)
# category: RIE.Views
# Retrieves all elements of an input category in input views.

Views = Input()
Category = Input()
elements_of_category_in_views = Python(IN[0]=Views, IN[1]=Category)
# ---------- elements_of_category_in_views.python (45 lines) ----------
#Made by Marc Tavenier @marctavenier
import clr, System
clr.AddReference("RevitNodes")
import Revit
clr.AddReference('RevitAPI')
from Autodesk.Revit.DB import *

clr.AddReference('RevitServices')
import RevitServices
from RevitServices.Persistence import DocumentManager

doc = DocumentManager.Instance.CurrentDBDocument

def tolist(obj):
	if isinstance(obj, list):
		return UnwrapElement(obj)
	else:
		return [UnwrapElement(obj)]

catname = str(IN[1])
bic = System.Enum.GetValues(BuiltInCategory) 
cats, bics = [], []
for i in bic:
    try:
        cat = Revit.Elements.Category.ById(ElementId(i).IntegerValue)
        cats.append(cat)
        bics.append(i)
    except:
        pass
 
for i, b in zip(cats, bics):
    if catname == str(i): 
        ost = b 

views = tolist(IN[0])
elems = []

for view in views:
	filter = FilteredElementCollector(doc, view.Id).OfCategory(ost)
	elems.append(filter.ToElements())

if len(elems) == 1:
	OUT = elems[0]
else:
	OUT = elems
# ----------------------------------------
Elements = Output(elements_of_category_in_views)
