# Dynamo custom node RIE.GetCategoriesContainingString.dyf (Dynamo 1.3.2.2480)
# category: RIE.Elements
# Gets all categories in project that contains input string

String = Input()
python_script = Python(IN[0]=String)
# ---------- python_script.python (34 lines) ----------
import clr
import System

clr.AddReference('RevitAPI')
clr.AddReference('RevitAPIUI')

from Autodesk.Revit.DB import *

import Autodesk
clr.AddReference("RevitNodes")

import Revit
clr.ImportExtensions(Revit.Elements)
clr.ImportExtensions(Revit.GeometryConversion)

clr.AddReference("RevitServices")
import RevitServices
from RevitServices.Persistence import DocumentManager

doc = DocumentManager.Instance.CurrentDBDocument
bics = System.Enum.GetValues(BuiltInCategory)

OUT = []
cats = []
categories = doc.Settings.Categories

for bic in bics:
	if IN[0] in str(bic):
		cats.append(bic)
		
for cat in cats:
	tempcat = categories.get_Item(cat)
	if tempcat <> None:
		OUT.append(cat)
# ----------------------------------------
string_from_object = FromObject(python_script)
byName = Category.ByName(string_from_object)
Categories = Output(byName)
