# Dynamo custom node RIE.GetElementConnector.dyf (Dynamo 1.3.2.2480)
# category: RIE.Power

Elements = Input()
python_script = Python(IN[0]=Elements)
# ---------- python_script.python (61 lines) ----------
import clr
import math

clr.AddReference("RevitServices")
import RevitServices
from RevitServices.Persistence import DocumentManager
from RevitServices.Transactions import TransactionManager
doc = DocumentManager.Instance.CurrentDBDocument

clr.AddReference("RevitAPI")
import Autodesk
from Autodesk.Revit.DB import *

clr.AddReference("RevitNodes")
import Revit
clr.ImportExtensions(Revit.Elements)
clr.ImportExtensions(Revit.GeometryConversion)
#The inputs to this node will be stored as a list in the IN variables.
if isinstance(IN[0], list):
	fittings = UnwrapElement(IN[0])
	toggle = 0
else:
	toggle = 1
	fittings = [UnwrapElement(IN[0])]

OUT = []
p = []
rep = []
ref = []

for fitting in fittings:
	
	points = []
	report = []
	refs = []
	connelem = []
	info = []
	
	try:
		connectors = fitting.MEPModel.ConnectorManager.Connectors
	except:
		connectors = fitting.ConnectorManager.Connectors
	for conn in connectors:
		info.append([conn.Owner, conn, conn.Origin.ToPoint()])
		connelem.append(conn.Owner)
		points.append(conn.Origin.ToPoint())
		result = ""
		try:
			result += "Direction: " + conn.Direction.ToString()
		except:
			result += "Direction: N/A"
		result += ", AllRefs Size: " + conn.AllRefs.Size.ToString()
		result += ", Domain: " + conn.Domain.ToString()
		result += ", Type: " + conn.ConnectorType.ToString()
		report.append(result)
		for c in conn.AllRefs:
			refs.append(c.Owner)
	OUT.append(info)
	p.append(points)
	rep.append(report)
	ref.append(refs)
# ----------------------------------------
OUT = Output(python_script)
