# Dynamo custom node RIE.GetPanelAndEquipmentFromCircuit.dyf (Dynamo 1.3.2.2480)
# category: RIE.Power
# Gets panel circuit is connected to, and Elements connected to the circuit.

Circuits = Input()
python_script = Python(IN[0]=Circuits)
# ---------- python_script.python (18 lines) ----------
import clr
clr.AddReference('ProtoGeometry')
from Autodesk.DesignScript.Geometry import *
#The inputs to this node will be stored as a list in the IN variables.
systems = UnwrapElement(IN[0])
panels = []
elements = []

for x in systems:
	panels.append(x.BaseEquipment)
	sublist = []
	elementset = x.Elements
	for x in elementset:
		sublist.append(x)
	elements.append(sublist)

#Assign your output to the OUT variable.
OUT = panels, elements
# ----------------------------------------
code_block = CodeBlock(a=python_script) { a[0]; a[1]; }
Panels = Output(code_block.out0)
Elements = Output(code_block.out1)
