# Dynamo custom node RIE.InsertItemAtIndex.dyf (Dynamo 1.3.2.2480)
# category: RIE.List
# Inserts Items into list at given index

List = Input()
Item = Input()
Index = Input()
python_script = Python(IN[0]=List, IN[1]=Item, IN[2]=Index)
# ---------- python_script.python (22 lines) ----------
OUT = []
add = 0

if isinstance(IN[1], list):
    ItemList = IN[1]
else:
    ItemList = [IN[1]]

if isinstance(IN[2], list):
    IndexList = IN[2]
else:
    IndexList = [IN[2]]

if len(ItemList) == len(IndexList):
	for _ in range(0,len(IN[0])+len(IndexList)):
		if _ in IndexList:
			OUT.append(ItemList[IndexList.index(_)])
		else:
			OUT.append(IN[0][add])
			add += 1
else:
	OUT = "Item list and Index list must be of equal length"
# ----------------------------------------
List_2 = Output(python_script)  # "List"
