# Dynamo custom node RIE.Point.SpaceAndRoom.dyf (Dynamo 1.3.2.2480)
# category: RIE.Geometry
# Gets Spaces and Rooms containing the point from the input points list.

Points = Input()
python_script = Python(IN[0]=Points)
# ---------- python_script.python (56 lines) ----------
import clr
clr.AddReference('ProtoGeometry')
from Autodesk.DesignScript.Geometry import *

clr.AddReference('RevitServices')
import RevitServices
from RevitServices.Persistence import DocumentManager
from RevitServices.Transactions import TransactionManager
from System.Collections.Generic import *

clr.AddReference('RevitNodes')
import Revit
clr.ImportExtensions(Revit.Elements)
clr.ImportExtensions(Revit.GeometryConversion)

clr.AddReference('RevitAPI')
import Autodesk
from Autodesk.Revit.DB import *
from Autodesk.Revit.DB.Electrical import *

clr.AddReference('DSCoreNodes')
import DSCore
from DSCore.List import *

import sys
pyt_path = r'C:\Program Files (x86)\IronPython 2.7\Lib'
sys.path.append(pyt_path)

doc = DocumentManager.Instance.CurrentDBDocument
uiapp = DocumentManager.Instance.CurrentUIApplication
app = uiapp.Application
uidoc = DocumentManager.Instance.CurrentUIApplication.ActiveUIDocument

OUT = []
spaces = []
rooms = []

def tolist(input):
	if isinstance(input, list):
		return input
	else:
		return [input]

for _ in tolist(IN[0]):
	pt = UnwrapElement(_)
	if doc.GetSpaceAtPoint(pt.ToXyz()) == None:
		spaces.append("No Space")
	else:
		spaces.append(doc.GetSpaceAtPoint(pt.ToXyz()))
	if doc.GetRoomAtPoint(pt.ToXyz()) == None:
		rooms.append("No Room")
	else:
		rooms.append(doc.GetRoomAtPoint(pt.ToXyz()))

OUT = spaces, rooms
	
# ----------------------------------------
code_block = CodeBlock(a=python_script) { a[0]; }
Spaces = Output(code_block)
code_block_2 = CodeBlock(a=python_script) { a[1]; }
Rooms = Output(code_block_2)
