# Dynamo custom node RIE.ResetGraphicOverrideElementsInViews.dyf (Dynamo 1.3.2.2480)
# category: RIE.Views
# Resets Graphic overrides for all input elements in all input views.

elements = Input()
views = Input()
python_script = Python(IN[0]=elements, IN[1]=views)
# ---------- python_script.python (33 lines) ----------
import clr
clr.AddReference('RevitAPI')
from Autodesk.Revit.DB import *

clr.AddReference("RevitNodes")
import Revit
clr.ImportExtensions(Revit.Elements)

clr.AddReference("RevitServices")
import RevitServices
from RevitServices.Persistence import DocumentManager
from RevitServices.Transactions import TransactionManager

doc = DocumentManager.Instance.CurrentDBDocument

def tolist(obj):
	if isinstance(obj, list):
		return UnwrapElement(obj)
	else:
		return [UnwrapElement(obj)]

items = tolist(IN[0])
views = tolist(IN[1])


override = OverrideGraphicSettings()

TransactionManager.Instance.EnsureInTransaction(doc)
for view in views:
	for item in items:
		view.SetElementOverrides(item.Id, override)
TransactionManager.Instance.TransactionTaskDone()
OUT = items
# ----------------------------------------
elements_2 = Output(python_script)  # "elements"
