# Dynamo custom node RIE.TagsReconcileHosting.dyf (Dynamo 1.3.2.2480)
# category: RIE.Commands
# Runs the ReconcileHosting Postable Command in the Revit UI, and represents a report of orphaned tags that needs to be looked at.

boolean = BoolSelector(true)
python_script = Python(IN[0]=boolean)
# ---------- python_script.python (26 lines) ----------
import clr

clr.AddReference("RevitServices")
import RevitServices
from RevitServices.Persistence import DocumentManager
doc = DocumentManager.Instance.CurrentDBDocument
uidoc = DocumentManager.Instance.CurrentUIDocument
uiapp = DocumentManager.Instance.CurrentUIApplication

clr.AddReference("RevitNodes")
import Revit
clr.ImportExtensions(Revit.Elements)
clr.ImportExtensions(Revit.GeometryConversion)
clr.AddReference("RevitAPI")
from Autodesk.Revit.DB import *
clr.AddReference("RevitAPIUI")
from Autodesk.Revit.UI import *
clr.AddReference("System.Core")
from System.Collections.Generic import HashSet


uidoc.RefreshActiveView()
# Get RevitCommandId of PostableCommand...
rvtComId = RevitCommandId.LookupPostableCommandId(PostableCommand.ReconcileHosting)
# Run PostableCommand...
OUT = uiapp.PostCommand(rvtComId)
# ----------------------------------------
Output = Output(python_script)  # ""
