# Dynamo custom node RIE.zfill.dyf (Dynamo 1.3.2.2480)
# category: RIE.List
# zfills input string with input amount of characters.

String = Input()
Amount = Input()
python_script = Python(IN[0]=String, IN[1]=Amount)
# ---------- python_script.python (16 lines) ----------
import clr
clr.AddReference('ProtoGeometry')
from Autodesk.DesignScript.Geometry import *
#The inputs to this node will be stored as a list in the IN variables.

def tolist(input):
	if isinstance(input, list):
		return UnwrapElement(IN[0])
	else:
		return [UnwrapElement(IN[0])]

input = tolist(IN[0])
OUT = []

for _ in input:
	OUT.append(str(_).zfill(IN[1]))
# ----------------------------------------
String_2 = Output(python_script)  # "String"
