# Dynamo custom node CableTray.Space.dyf (Dynamo 1.3.2.2480)
# category: Rhythm.Revit.Elements.CableTray.Query
# This node will determine the space a cable tray's center point falls within.

categories = Categories("MEPSpaces")
all_elements_of_category = ElementsOfCategory(categories)
cableTray = Input()
code_block = CodeBlock(item=cableTray) { Flatten({item}); }
getLocation = Element.GetLocation(code_block)
code_block_2 = CodeBlock { 0.5; }
pointAtParameter = Curve.PointAtParameter(curve=getLocation, param=code_block_2)
python_script = Python(IN[0]=all_elements_of_category, IN[1]=pointAtParameter)
# ---------- python_script.python (23 lines) ----------
import clr
clr.AddReference('RevitAPI')
from Autodesk.Revit.DB import *

clr.AddReference("RevitNodes")
import Revit
clr.ImportExtensions(Revit.GeometryConversion)

rooms = UnwrapElement(IN[0])
points = [x.ToXyz() for x in IN[1]]
roomlist = list()
for point in points:
	booleans = list()
	for room in rooms:
		try:
			if room.IsPointInSpace(point):
				booleans.append(True)
			else:
				booleans.append(False)
		except:
			booleans.append(False)
	roomlist.append(booleans)
OUT = roomlist
# ----------------------------------------
flatten = Flatten(python_script)
filterByBoolMask = List.FilterByBoolMask(list=all_elements_of_category, mask=flatten)
clean = Custom[Output.Clean](input=filterByBoolMask.in)  # This will return a single value or list from one input.
space = Output(clean)
