# Dynamo custom node Dimension.Origin.dyf (Dynamo 1.3.2.2480)
# category: Rhythm.Revit.Elements.Dimension
# This will return the dimension origin as a point. Only works for single segment dimensions.

dimension = Input()
code_block = CodeBlock(item=dimension) { Flatten({item}); }
python_script = Python(IN[0]=code_block)
# ---------- python_script.python (25 lines) ----------
import clr
clr.AddReference('RevitAPI')
from Autodesk.Revit.DB import *

clr.AddReference("RevitNodes")
import Revit
clr.ImportExtensions(Revit.GeometryConversion)

clr.AddReference("RevitServices")
import RevitServices
from RevitServices.Persistence import DocumentManager
from RevitServices.Transactions import TransactionManager

doc = DocumentManager.Instance.CurrentDBDocument

items = UnwrapElement(IN[0])
elementlist = list()
TransactionManager.Instance.EnsureInTransaction(doc)
for item in items:
	try:
		elementlist.append(item.Origin.ToPoint())
	except:
		elementlist.append(list())
TransactionManager.Instance.TransactionTaskDone()
OUT = elementlist
# ----------------------------------------
origin = Output(python_script)
