# Dynamo custom node GetParameterValueByNameAsString.dyf (Dynamo 1.3.2.2480)
# category: Rhythm.Revit.Elements.Element.Actions
# Returns paramter value as string.

element = Input()
parameterName = Input()
getParameterValueByName = Element.GetParameterValueByName(parameterName=parameterName)  # unwired: element
map = List.Map(list=element, f_x=getParameterValueByName)
string_from_object = FromObject(map)
var = Output(string_from_object)  # "var[]..[]"
