# Dynamo custom node Solid.GraphicStyleName.dyf (Dynamo 1.3.1.1736)
# category: SteamNodes.Tool

Solids = Input()
python_script = Python(IN[0]=Solids)
# ---------- python_script.python (52 lines) ----------
#python nodes in dynamo 1.3
#proposed by Julien Benoit @jbenoit44 
#http://aecuandme.wordpress.com/
import clr
clr.AddReference('ProtoGeometry')
from Autodesk.DesignScript.Geometry import *

# Import ToDSType(bool) extension method
clr.AddReference("RevitNodes")
import Revit
clr.ImportExtensions(Revit.Elements)

# Import DocumentManager and TransactionManager
clr.AddReference("RevitServices")
import RevitServices
from RevitServices.Persistence import DocumentManager
from RevitServices.Transactions import TransactionManager

from System.Collections.Generic import *

# Import RevitAPI
clr.AddReference("RevitAPI")
import Autodesk

doc = DocumentManager.Instance.CurrentDBDocument
uiapp = DocumentManager.Instance.CurrentUIApplication
app = uiapp.Application



#unwrap all elements to use with API
solids=[]
for i in IN[0]:
	solids.append(UnwrapElement(i))
	
# "Start" the transaction
#TransactionManager.Instance.EnsureInTransaction(doc)
mat=[]
for s in solids:
	a=s.GraphicsStyleId
	try:
		b=doc.GetElement(a).GraphicsStyleCategory.Name
		mat.append(b)
	except:
		mat.append("None")

# "End" the transaction
#TransactionManager.Instance.TransactionTaskDone()


#Assign your output to the OUT variable
OUT = mat
# ----------------------------------------
var = Output(python_script)  # "var[]..[]"
