# Dynamo custom node Tool.ExportDWF.dyf (Dynamo 1.3.2.2480)
# category: SteamNodes.Tool
# Export Views to DWF file

Views_as_List = Input()
code_block = CodeBlock(item=Views_as_List) { Flatten({item}); }
Path_as_string = Input()
Filename = Input(Filename : string)
MergeViews = Input(MergeViews : bool = true)
DWFx = Input(DWFx : bool = true)
python_script = Python(IN[0]=code_block, IN[1]=Path_as_string, IN[2]=Filename, IN[3]=MergeViews, IN[4]=DWFx)
# ---------- python_script.python (57 lines) ----------
#python nodes in dynamo 1.0
#proposed by Julien Benoit @jbenoit44 
#http://aecuandme.wordpress.com/
import clr
clr.AddReference('ProtoGeometry')
from Autodesk.DesignScript.Geometry import *
# Import ToDSType(bool) extension method
clr.AddReference("RevitNodes")
import Revit
clr.ImportExtensions(Revit.Elements)
# Import geometry conversion extension methods
clr.ImportExtensions(Revit.GeometryConversion)
# Import DocumentManager and TransactionManager
clr.AddReference("RevitServices")
import RevitServices
from RevitServices.Persistence import DocumentManager
from RevitServices.Transactions import TransactionManager
from System.Collections.Generic import *
# Import RevitAPI
clr.AddReference("RevitAPI")
import Autodesk
from Autodesk.Revit.DB import *

doc = DocumentManager.Instance.CurrentDBDocument
uiapp = DocumentManager.Instance.CurrentUIApplication
app = uiapp.Application
uidoc=DocumentManager.Instance.CurrentUIApplication.ActiveUIDocument

views = []
for i in IN[0]:
	views.append(UnwrapElement(i))
	
folder=UnwrapElement(IN[1])
name=UnwrapElement(IN[2])

# Start Transaction
TransactionManager.Instance.EnsureInTransaction(doc)

a=ViewSet()
for v in views:
	b= a.Insert(v)
	
x=DWFExportOptions()
x.MergedViews = IN[3]
y=DWFXExportOptions()
y.MergedViews = IN[3]
if IN[4]==True:
	c=doc.Export(folder,name,a,y)
else:
	c=doc.Export(folder,name,a,x)



# End Transaction
TransactionManager.Instance.TransactionTaskDone()

OUT=c
# ----------------------------------------
Succeed = Output(python_script)
