# Dynamo custom node Door Set Handing.dyf (Dynamo 1.3.1.1736)
# category: archilab.Revit.Doors
# Determines door set handing (whether its a left or right handed door). Input takes doors, and output will split them into two lists (right and left).

Door_s = Input()  # "Door(s)"
empty = List.Empty()
create = List.Create(Door_s, empty)
flatten = Flatten(create)
Phase = Input()
python_script = Python(IN[0]=flatten, IN[1]=Phase)
# ---------- python_script.python (67 lines) ----------
#Copyright(c) 2015, Konrad Sobon
# @arch_laboratory, http://archi-lab.net

import clr
clr.AddReference('ProtoGeometry')
from Autodesk.DesignScript.Geometry import *

# Import ToDSType(bool) extension method
clr.AddReference("RevitNodes")
import Revit
clr.ImportExtensions(Revit.Elements)

# Import DocumentManager and TransactionManager
clr.AddReference("RevitServices")
import RevitServices
from RevitServices.Persistence import DocumentManager
from RevitServices.Transactions import TransactionManager

from System.Collections.Generic import *

# Import RevitAPI
clr.AddReference("RevitAPI")
import Autodesk
from Autodesk.Revit.DB import *

doc = DocumentManager.Instance.CurrentDBDocument
uiapp = DocumentManager.Instance.CurrentUIApplication
app = uiapp.Application

#The inputs to this node will be stored as a list in the IN variable.
dataEnteringNode = IN

#unwrap inputs
elements = []
for i in IN[0]:
	elements.append(UnwrapElement(i))
phase = UnwrapElement(IN[1])

#check if door has a left or right handed swing
right, left, lhr, rhr = [], [], [], []
for i in elements:
	to_room = i.ToRoom[phase]
	if to_room is not None:
		if not i.FacingFlipped:
			if i.HandFlipped:
				right.append(i)
			else:
				left.append(i)
		else:
			if i.HandFlipped:
				left.append(i)
			else:
				right.append(i)
	else:
		if i.FacingFlipped:
			if i.HandFlipped:
				rhr.append(i)
			else:
				lhr.append(i)
		else:
			if i.HandFlipped:
				lhr.append(i)
			else:
				rhr.append(i)

#Assign your output to the OUT variable
OUT = right, left, rhr, lhr
# ----------------------------------------
number = DoubleInput(0)
getItemAtIndex = List.GetItemAtIndex(list=python_script, index=number)
Right_Handed = Output(getItemAtIndex)
number_2 = DoubleInput(1)
getItemAtIndex_2 = List.GetItemAtIndex(list=python_script, index=number_2)
Left_Handed = Output(getItemAtIndex_2)
number_3 = DoubleInput(2)
getItemAtIndex_3 = List.GetItemAtIndex(list=python_script, index=number_3)
Right_Handed_Reversed = Output(getItemAtIndex_3)
number_4 = DoubleInput(3)
getItemAtIndex_4 = List.GetItemAtIndex(list=python_script, index=number_4)
Left_Handed_Reversed = Output(getItemAtIndex_4)
