# Dynamo custom node Element Ids.dyf (Dynamo 1.3.1.1736)
# category: archilab.Revit.Elements
# This node will query an element id that can be used with Revit nodes. Dynamo Element Id node returns integer value.

empty = List.Empty()
Element_s = Input()  # "Element(s)"
create = List.Create(empty, Element_s)
flatten = Flatten(create)
python_script = Python(IN[0]=flatten)
# ---------- python_script.python (21 lines) ----------
import clr
clr.AddReference('ProtoGeometry')
from Autodesk.DesignScript.Geometry import *
# Import RevitAPI
clr.AddReference('RevitAPI')
import Autodesk
#The inputs to this node will be stored as a list in the IN variable.
dataEnteringNode = IN

elements = []
for i in IN[0]:
    elements.append(UnwrapElement(i))

elementIds, idString, guid = [], [], []
for i in elements:
    elementIds.append(i.Id)
    idString.append(i.Id.ToString())
    guid.append(i.UniqueId)
    
#Assign your output to the OUT variable
OUT = elementIds, idString, guid
# ----------------------------------------
code_block = CodeBlock(OUT=python_script) { OUT[0]; OUT[1]; OUT[2]; }
Rvt_ElementId_s = Output(code_block.out0)  # "Rvt ElementId(s)"
Id_String_s = Output(code_block.out1)  # "Id String(s)"
GUID_s = Output(code_block.out2)  # "GUID(s)"
id = Element.Id(flatten)
Integer_s = Output(id)  # "Integer(s)"
