# Dynamo custom node Set BuiltIn Parameter.dyf (Dynamo 1.3.1.1736)
# category: archilab.Revit.Parameter
# This node will take an input of a built in parameter name and set that parameter to given value for given elements.

ParameterName = Input()
Elements = Input()
ParameterValues = Input()
python_script = Python(IN[0]=ParameterName, IN[1]=Elements, IN[2]=ParameterValues)
# ---------- python_script.python (69 lines) ----------
#Copyright(c) 2017, Konrad K Sobon
# @arch_laboratory, http://archi-lab.net

import clr
import sys
pyt_path = r'C:\Program Files (x86)\IronPython 2.7\Lib'
sys.path.append(pyt_path)

# Import Element wrapper extension methods
clr.AddReference("RevitNodes")
import Revit
clr.ImportExtensions(Revit.Elements)

# Import DocumentManager and TransactionManager
clr.AddReference("RevitServices")
import RevitServices
from RevitServices.Persistence import DocumentManager
from RevitServices.Transactions import TransactionManager
doc = DocumentManager.Instance.CurrentDBDocument

# Import RevitAPI
clr.AddReference("RevitAPI")
import Autodesk
from Autodesk.Revit.DB import *
import System

paramName = IN[0]
paramValues = IN[2]

if not isinstance(IN[1], list):
	elements = [IN[1]]
else:
	elements = IN[1]

def GetBuiltInParam(paramName):
	builtInParams = System.Enum.GetValues(BuiltInParameter)
	test = []
	for i in builtInParams:
		if i.ToString() == paramName:
			test.append(i)
			break
		else:
			continue
	return test[0]

try:
	errorReport = None
	TransactionManager.Instance.EnsureInTransaction(doc)
	
	bipName = GetBuiltInParam(paramName)
	for i, j in zip(elements, paramValues):
		param = UnwrapElement(i).get_Parameter(bipName)
		if param.StorageType == StorageType.ElementId:
			id = ElementId(j)
			param.Set(id)
		else:
			param.Set(j)
	
	TransactionManager.Instance.TransactionTaskDone()
except:
	# if error accurs anywhere in the process catch it
	import traceback
	errorReport = traceback.format_exc()

#Assign your output to the OUT variable
if errorReport == None:
	OUT = IN[1]
else:
	OUT = errorReport
# ----------------------------------------
OUT = Output(python_script)
