# Dynamo custom node Slice String.dyf (Dynamo 1.3.1.1736)
# category: archilab.Core.Strings
# Slices X number of leading or trailing characters from string (boolean true will slice from left while boolean set to false from right)

empty = List.Empty()
String_s = Input()  # "String(s)"
create = List.Create(empty, String_s)
flatten = Flatten(create)
of_Characters = Input()  # "# of Characters"
create_2 = List.Create(empty, of_Characters)
flatten_2 = Flatten(create_2)
Left_Right = Input()  # "Left/Right"
python_script = Python(IN[0]=flatten, IN[1]=flatten_2, IN[2]=Left_Right)
# ---------- python_script.python (30 lines) ----------
import clr
clr.AddReference('ProtoGeometry')
from Autodesk.DesignScript.Geometry import *
#The inputs to this node will be stored as a list in the IN variable.
dataEnteringNode = IN

strings = IN[0]
numbers = IN[1]
result = []
if len(numbers) != 1:
	for i, j in zip(strings, numbers):
		x = int(j)
		if IN[2] == 1:
			result.append(i[x:])
		else:
			y = int(len(i) - x)
			result.append(i[:y])
else:
	for i in strings:
		if isinstance(numbers, basestring):
			x = int(numbers[0])
		else:
			x = numbers[0]
		if IN[2] == 1:
			result.append(i[x:])
		else:
			y = int(len(i)-x)
			result.append(i[:y])
#Assign your output to the OUT variable
OUT = result
# ----------------------------------------
String_s_2 = Output(python_script)  # "String(s)"
