# Dynamo graph SPARE AND SPACE.dyn (Dynamo 1.3.2.2480)

python_script = Python()
# ---------- python_script.python (53 lines) ----------
#Copyright(c) 2015, Konrad Sobon
# @arch_laboratory, http://archi-lab.net

import clr
clr.AddReference('ProtoGeometry')
from Autodesk.DesignScript.Geometry import *

# Import DocumentManager and TransactionManager
clr.AddReference("RevitServices")
import RevitServices
from RevitServices.Persistence import DocumentManager
from RevitServices.Transactions import TransactionManager

# Import RevitAPI
clr.AddReference("RevitAPI")
import Autodesk
from Autodesk.Revit.DB import *

doc = DocumentManager.Instance.CurrentDBDocument
uiapp = DocumentManager.Instance.CurrentUIApplication
app = uiapp.Application

from System.Collections.Generic import *

# Import ToDSType(bool) extension method
clr.AddReference("RevitNodes")
import Revit
clr.ImportExtensions(Revit.Elements)

#The inputs to this node will be stored as a list in the IN variable.
dataEnteringNode = IN

#collect all views in the model
collector = FilteredElementCollector(doc)
views = collector.OfClass(View).ToElements()

#sort views into separate lists based on view type
areaPlans, ceilingPlans, columnSchedules = [], [], []
costReport, details, draftingViews = [], [], []
drawingSheets, elevations, engineetingPlans = [], [], []
floorPlans, internal, legends, loadReports = [], [], [], []
panelSchedules, pressureLossReports, renderings = [], [], []
reports, schedules, sections, threeD = [], [], [], []
undefined, walkthrough = [], []
for i in views:
	if not i.IsTemplate:
		if i.ViewType == ViewType.PanelSchedule:
			panelSchedules.append(i.ToDSType(True))
		else:
			continue

#Assign your output to the OUT variable
OUT = panelSchedules
# ----------------------------------------
python_script_2 = Python(IN[0]=python_script)
# ---------- python_script_2.python (30 lines) ----------
import clr
clr.AddReference('RevitAPI')
from Autodesk.Revit.DB import *
clr.AddReference('RevitServices')
import RevitServices
from RevitServices.Persistence import DocumentManager
from RevitServices.Transactions import TransactionManager

# Import ToDSType(bool) extension method
clr.AddReference("RevitNodes")
import Revit
clr.ImportExtensions(Revit.Elements)

doc = DocumentManager.Instance.CurrentDBDocument
uiapp = DocumentManager.Instance.CurrentUIApplication
app = uiapp.Application
#The inputs to this node will be stored as a list in the IN variables.

OUT = []

def tolist(obj):
	if isinstance(obj, list):
		return UnwrapElement(obj)
	else:
		return UnwrapElement([obj])

panels = tolist(IN[0])

for panel in panels:
	OUT.append(doc.GetElement(panel.GetPanel()).ToDSType(True))
# ----------------------------------------

# group: Destination Panel
select_model_element = DSModelElementSelection()

id = Element.Id(select_model_element)

# group: Origin Panel
select_model_element_2 = DSModelElementSelection()

# group: Get Panel Schedule View for Panel
id_2 = Element.Id(python_script_2)
groupByKey = List.GroupByKey(list=python_script, keys=id_2)
code_block = CodeBlock(Element=groupByKey.groups, tag=groupByKey.unique_keys)
# ---------- code_block.designscript (4 lines) ----------
//declare a new dictionary to store this in
PanelScheduleDictionary = {};
//dictionary[whatToLookUpBy] = tagElement
PanelScheduleDictionary[Element] = tag;
# ----------------------------------------
id_3 = Element.Id(select_model_element_2)
code_block_2 = CodeBlock(PanelScheduleDictionary=code_block.PanelScheduleDictionary, Element=id_3) { PanelScheduleDictionary[Element]; }

code_block_3 = CodeBlock(PanelScheduleDictionary=code_block.PanelScheduleDictionary, Element=id) { PanelScheduleDictionary[Element]; }

# group: Get all cells in Panel
code_block_4 = CodeBlock { 1; }
code_block_5 = CodeBlock { "Max #1 Pole Breakers"; }
getParameterValueByName = Element.GetParameterValueByName(element=select_model_element_2, parameterName=code_block_5)
range = Range(start=code_block_4, end=getParameterValueByName, lacing=Longest)
python_script_3 = Python(IN[0]=code_block_2, IN[1]=range)
# ---------- python_script_3.python (31 lines) ----------
import clr
clr.AddReference('ProtoGeometry')
from Autodesk.DesignScript.Geometry import *

clr.AddReference('RevitServices')
import RevitServices
from RevitServices.Persistence import DocumentManager
from RevitServices.Transactions import TransactionManager
from System.Collections.Generic import *

clr.AddReference('RevitAPI')
from Autodesk.Revit.DB import Electrical
from Autodesk.Revit.DB import ElementId

#The inputs to this node will be stored as a list in the IN variables.
PanelSched = UnwrapElement(IN[0])
Circuits = UnwrapElement(IN[1])

Cell = []
doc = DocumentManager.Instance.CurrentDBDocument
uiapp = DocumentManager.Instance.CurrentUIApplication
app = uiapp.Application
uidoc = DocumentManager.Instance.CurrentUIApplication.ActiveUIDocument

TransactionManager.Instance.EnsureInTransaction(doc)

for i in Circuits:
	Cellnum = Electrical.PanelScheduleView.GetCellsBySlotNumber(PanelSched[0],i)
	Cell.append(Cellnum)
#Assign your output to the OUT variable.
OUT = Cell
# ----------------------------------------
code_block_6 = CodeBlock { 0; }
getItemAtIndex = List.GetItemAtIndex(list=python_script_3@L3, index=code_block_6)
code_block_7 = CodeBlock { 2; }
getItemAtIndex_2 = List.GetItemAtIndex(list=getItemAtIndex@L2, index=code_block_7)
code_block_8 = CodeBlock { 1; }
getItemAtIndex_3 = List.GetItemAtIndex(list=python_script_3@L3, index=code_block_8)
getItemAtIndex_4 = List.GetItemAtIndex(list=getItemAtIndex_3@L2, index=code_block_7)

# group: Is Spare
python_script_4 = Python(IN[0]=code_block_2, IN[1]=getItemAtIndex_2, IN[2]=getItemAtIndex_4)
# ---------- python_script_4.python (35 lines) ----------
import clr
clr.AddReference('ProtoGeometry')
from Autodesk.DesignScript.Geometry import *

clr.AddReference('RevitServices')
import RevitServices
from RevitServices.Persistence import DocumentManager
from RevitServices.Transactions import TransactionManager
from System.Collections.Generic import *

clr.AddReference('RevitAPI')
from Autodesk.Revit.DB import Electrical
from Autodesk.Revit.DB import ElementId

#The inputs to this node will be stored as a list in the IN variables.
PanelSched = UnwrapElement(IN[0])
CellRow = UnwrapElement(IN[1])
CellCol = UnwrapElement(IN[2])
IsSpare = []


doc = DocumentManager.Instance.CurrentDBDocument
uiapp = DocumentManager.Instance.CurrentUIApplication
app = uiapp.Application
uidoc = DocumentManager.Instance.CurrentUIApplication.ActiveUIDocument

TransactionManager.Instance.EnsureInTransaction(doc)

for i, j in zip(CellRow, CellCol):
	Spare = Electrical.PanelScheduleView.IsSpare(PanelSched[0],i,j)

	IsSpare.append(Spare)

#Assign your output to the OUT variable.
OUT = IsSpare
# ----------------------------------------

filterByBoolMask = List.FilterByBoolMask(list=getItemAtIndex_2, mask=python_script_4)
filterByBoolMask_2 = List.FilterByBoolMask(list=getItemAtIndex_4, mask=python_script_4)

# group: Create Spare
python_script_5 = Python(IN[0]=code_block_3, IN[1]=filterByBoolMask.in, IN[2]=filterByBoolMask_2.in)
# ---------- python_script_5.python (34 lines) ----------
import clr
clr.AddReference('ProtoGeometry')
from Autodesk.DesignScript.Geometry import *

clr.AddReference('RevitServices')
import RevitServices
from RevitServices.Persistence import DocumentManager
from RevitServices.Transactions import TransactionManager
from System.Collections.Generic import *

clr.AddReference('RevitAPI')
from Autodesk.Revit.DB import Electrical
from Autodesk.Revit.DB import ElementId

#The inputs to this node will be stored as a list in the IN variables.
PanelSched = UnwrapElement(IN[0])
CellRow = UnwrapElement(IN[1])
CellCol = UnwrapElement(IN[2])



doc = DocumentManager.Instance.CurrentDBDocument
uiapp = DocumentManager.Instance.CurrentUIApplication
app = uiapp.Application
uidoc = DocumentManager.Instance.CurrentUIApplication.ActiveUIDocument

TransactionManager.Instance.EnsureInTransaction(doc)

for i, j in zip(CellRow, CellCol):
	Spare = Electrical.PanelScheduleView.AddSpare(PanelSched[0],i,j)


#Assign your output to the OUT variable.
OUT = PanelSched
# ----------------------------------------

# group: Is Space
python_script_6 = Python(IN[0]=code_block_2, IN[1]=getItemAtIndex_2, IN[2]=getItemAtIndex_4)
# ---------- python_script_6.python (35 lines) ----------
import clr
clr.AddReference('ProtoGeometry')
from Autodesk.DesignScript.Geometry import *

clr.AddReference('RevitServices')
import RevitServices
from RevitServices.Persistence import DocumentManager
from RevitServices.Transactions import TransactionManager
from System.Collections.Generic import *

clr.AddReference('RevitAPI')
from Autodesk.Revit.DB import Electrical
from Autodesk.Revit.DB import ElementId

#The inputs to this node will be stored as a list in the IN variables.
PanelSched = UnwrapElement(IN[0])
CellRow = UnwrapElement(IN[1])
CellCol = UnwrapElement(IN[2])

IsSpace = []

doc = DocumentManager.Instance.CurrentDBDocument
uiapp = DocumentManager.Instance.CurrentUIApplication
app = uiapp.Application
uidoc = DocumentManager.Instance.CurrentUIApplication.ActiveUIDocument

TransactionManager.Instance.EnsureInTransaction(doc)

for i, j in zip(CellRow, CellCol):

	Space = Electrical.PanelScheduleView.IsSpace(PanelSched[0],i,j)

	IsSpace.append(Space)
#Assign your output to the OUT variable.
OUT =  IsSpace
# ----------------------------------------

filterByBoolMask_3 = List.FilterByBoolMask(list=getItemAtIndex_2, mask=python_script_6)
filterByBoolMask_4 = List.FilterByBoolMask(list=getItemAtIndex_4, mask=python_script_6)

# group: Create Space
python_script_7 = Python(IN[0]=code_block_3, IN[1]=filterByBoolMask_3.in, IN[2]=filterByBoolMask_4.in)
# ---------- python_script_7.python (34 lines) ----------
import clr
clr.AddReference('ProtoGeometry')
from Autodesk.DesignScript.Geometry import *

clr.AddReference('RevitServices')
import RevitServices
from RevitServices.Persistence import DocumentManager
from RevitServices.Transactions import TransactionManager
from System.Collections.Generic import *

clr.AddReference('RevitAPI')
from Autodesk.Revit.DB import Electrical
from Autodesk.Revit.DB import ElementId

#The inputs to this node will be stored as a list in the IN variables.
PanelSched = UnwrapElement(IN[0])
CellRow = UnwrapElement(IN[1])
CellCol = UnwrapElement(IN[2])



doc = DocumentManager.Instance.CurrentDBDocument
uiapp = DocumentManager.Instance.CurrentUIApplication
app = uiapp.Application
uidoc = DocumentManager.Instance.CurrentUIApplication.ActiveUIDocument

TransactionManager.Instance.EnsureInTransaction(doc)

for i, j in zip(CellRow, CellCol):
	Spare = Electrical.PanelScheduleView.AddSpare(PanelSched[0],i,j)


#Assign your output to the OUT variable.
OUT = 0
# ----------------------------------------

electricalCircuits = Custom[PanelScheduleView.ElectricalCircuits](PanelScheduleView=code_block_2)  # Returns the circuits that are listed in the panelschedule, this includes spare circuits.
code_block_9 = CodeBlock { 0; }
getItemAtIndex_5 = List.GetItemAtIndex(list=electricalCircuits@L2, index=code_block_9)
parameters = Element.Parameters(getItemAtIndex_5)
string_from_object = FromObject(parameters)
sortByKey = List.SortByKey(list=parameters@L2, keys=string_from_object@L2)
id_4 = Parameter.Id(sortByKey.sorted_list)
code_block_10 = CodeBlock { 8; }
getItemAtIndex_6 = List.GetItemAtIndex(list=id_4@L2, index=code_block_10)

# group: Get SPARE LOAD (VA)
python_script_8 = Python(IN[0]=code_block_2, IN[1]=filterByBoolMask.in, IN[2]=filterByBoolMask_2.in, IN[3]=getItemAtIndex_6)
# ---------- python_script_8.python (35 lines) ----------
import clr
clr.AddReference('ProtoGeometry')
from Autodesk.DesignScript.Geometry import *

clr.AddReference('RevitServices')
import RevitServices
from RevitServices.Persistence import DocumentManager
from RevitServices.Transactions import TransactionManager
from System.Collections.Generic import *

clr.AddReference('RevitAPI')
from Autodesk.Revit.DB import Electrical
from Autodesk.Revit.DB import ElementId

#The inputs to this node will be stored as a list in the IN variables.
PanelSched = UnwrapElement(IN[0])
col = UnwrapElement(IN[1])
row = UnwrapElement(IN[2])
parameter = UnwrapElement(IN[3])

SpareVA = []
elemId = ElementId(parameter[0])

doc = DocumentManager.Instance.CurrentDBDocument
uiapp = DocumentManager.Instance.CurrentUIApplication
app = uiapp.Application
uidoc = DocumentManager.Instance.CurrentUIApplication.ActiveUIDocument

TransactionManager.Instance.EnsureInTransaction(doc)

for i, j in zip(col,row):
	Spare = Electrical.PanelScheduleView.GetSpareLoadValue(PanelSched[0],i,j,elemId)
	SpareVA.append(Spare)
#Assign your output to the OUT variable.
OUT = SpareVA
# ----------------------------------------

code_block_11 = CodeBlock { 0.0929030400061256; }
mul = python_script_8 * code_block_11

# group: Set Spare Load (VA)
python_script_9 = Python(IN[0]=code_block_3, IN[1]=filterByBoolMask.in, IN[2]=filterByBoolMask_2.in, IN[3]=getItemAtIndex_6, IN[4]=mul)
# ---------- python_script_9.python (37 lines) ----------
import clr
clr.AddReference('ProtoGeometry')
from Autodesk.DesignScript.Geometry import *

clr.AddReference('RevitServices')
import RevitServices
from RevitServices.Persistence import DocumentManager
from RevitServices.Transactions import TransactionManager
from System.Collections.Generic import *

clr.AddReference('RevitAPI')
from Autodesk.Revit.DB import Electrical
from Autodesk.Revit.DB import ElementId

#The inputs to this node will be stored as a list in the IN variables.
PanelSched = UnwrapElement(IN[0])
col = UnwrapElement(IN[1])
row = UnwrapElement(IN[2])
parameter = UnwrapElement(IN[3])
Load = UnwrapElement(IN[4])

SpareVA = []
elemId = ElementId(parameter[0])
Spare = []

doc = DocumentManager.Instance.CurrentDBDocument
uiapp = DocumentManager.Instance.CurrentUIApplication
app = uiapp.Application
uidoc = DocumentManager.Instance.CurrentUIApplication.ActiveUIDocument

TransactionManager.Instance.EnsureInTransaction(doc)

for i, j, k in zip(col,row, Load):
	Spare = Electrical.PanelScheduleView.SetSpareLoadValue(PanelSched[0],i,j,elemId,k)
	SpareVA.append(Spare)
#Assign your output to the OUT variable.
OUT = SpareVA
# ----------------------------------------

id_5 = Parameter.Id(sortByKey.sorted_list)
code_block_12 = CodeBlock { 28; }
getItemAtIndex_7 = List.GetItemAtIndex(list=id_5@L2, index=code_block_12)

# group: Get Spare Name
python_script_10 = Python(IN[0]=code_block_3, IN[1]=filterByBoolMask.in, IN[2]=filterByBoolMask_2.in, IN[3]=getItemAtIndex_7)
# ---------- python_script_10.python (38 lines) ----------
import clr
clr.AddReference('ProtoGeometry')
from Autodesk.DesignScript.Geometry import *

clr.AddReference('RevitServices')
import RevitServices
from RevitServices.Persistence import DocumentManager
from RevitServices.Transactions import TransactionManager
from System.Collections.Generic import *

clr.AddReference('RevitAPI')
from Autodesk.Revit.DB import Electrical
from Autodesk.Revit.DB import ElementId

#The inputs to this node will be stored as a list in the IN variables.
PanelSched = UnwrapElement(IN[0])
col = UnwrapElement(IN[1])
row = UnwrapElement(IN[2])
parameter = UnwrapElement(IN[3])

SpareVA = []
elemId = ElementId(parameter[0])

SpareName = []
Spare = []

doc = DocumentManager.Instance.CurrentDBDocument
uiapp = DocumentManager.Instance.CurrentUIApplication
app = uiapp.Application
uidoc = DocumentManager.Instance.CurrentUIApplication.ActiveUIDocument

TransactionManager.Instance.EnsureInTransaction(doc)

for i, j in zip(col,row):
	Spare = Electrical.PanelScheduleView.GetParamValue(PanelSched[0],0,i,j)
	SpareVA.append(Spare)
#Assign your output to the OUT variable.
OUT = SpareName
# ----------------------------------------

sortByKey_2 = List.SortByKey()  # unwired: list, keys
categories = Categories("ElectricalCircuit")
