# Dynamo graph AddElement(s)ToExistingCircuit.dyn (Dynamo 2.1.0.7500)

addToCircuit = Custom[ElectricalSystem.AddToCircuit]()  # Adds elements to circuit if possible; unwired: Circuit, Elements

# group: GET ALL CIRCUITED ELEMENTS
categories = Categories("OST_ElectricalCircuit")  # graph input
all_elements_of_category = ElementsOfCategory(Category=categories)
python_script = Python(IN[0]=all_elements_of_category)
# ---------- python_script.python (18 lines) ----------
import clr
clr.AddReference('ProtoGeometry')
from Autodesk.DesignScript.Geometry import *
#The inputs to this node will be stored as a list in the IN variables.
systems = UnwrapElement(IN[0])
panels = []
elements = []

for x in systems:
	panels.append(x.BaseEquipment)
	sublist = []
	elementset = x.Elements
	for x in elementset:
		sublist.append(x)
	elements.append(sublist)

#Assign your output to the OUT variable.
OUT = elements
# ----------------------------------------

# group: Element on Existing Circuit
select_model_element = DSModelElementSelection()  # 1 picked in the model; graph input

contains = List.Contains(list=python_script@L2, item=select_model_element)
filterByBoolMask = List.FilterByBoolMask(list=all_elements_of_category, mask=contains)
flatten = List.Flatten(list=filterByBoolMask.in)

# group: Elements to be circuited with existing
select_model_elements = DSModelElementsSelection()  # 2 picked in the model; graph input

create = List.Create(item0=select_model_elements, item1=select_model_element)
python_script_2 = Python(IN[0]=flatten, IN[1]=create)
# ---------- python_script_2.python (49 lines) ----------
import clr

clr.AddReference("RevitServices")
import RevitServices
from RevitServices.Persistence import DocumentManager
from RevitServices.Transactions import TransactionManager
doc = DocumentManager.Instance.CurrentDBDocument

clr.AddReference("RevitAPI")
import Autodesk
from Autodesk.Revit.DB import *

clr.AddReference("RevitNodes")
import Revit
clr.ImportExtensions(Revit.Elements)
clr.ImportExtensions(Revit.GeometryConversion)

succes = []
failed = []

def AddToCircuit(sys,elements):
	TransactionManager.Instance.EnsureInTransaction(doc)
	if hasattr(elements, "__iter__"):
		for element in elements:
			elemset = ElementSet()
			elemset.Insert(element)
			try:
				sys.AddToCircuit(elemset)
				succes.append(element.ToDSType(True))
			except:
				failed.append(element.ToDSType(True))
	else:
		elemset = ElementSet()
		elemset.Insert(elements)
		try:
			sys.AddToCircuit(elemset)
			succes.append(elements.ToDSType(True))
		except:
			failed.append(elements.ToDSType(True))
	TransactionManager.Instance.TransactionTaskDone()
	

if isinstance(IN[0], list):
	for i,sys in enumerate(UnwrapElement(IN[0])):
		AddToCircuit(sys,UnwrapElement(IN[1])[i])
else:
	AddToCircuit(UnwrapElement(IN[0]),UnwrapElement(IN[1]))

OUT = succes, failed
# ----------------------------------------

# group: Element To Be Circuited
select_model_element_2 = DSModelElementSelection()  # 1 picked in the model; graph input

numberOfAssignedCircuits = Custom[PanelScheduleView.NumberOfAssignedCircuits]()  # This will return the number of assigned circuits on a panelschedule. Spares and spaces also count as an assigned circuit.; unwired: PanelScheduleView
