# Dynamo graph Change parameters of Conduits.dyn (Dynamo 1.3.2.2480)

categories = Categories("ConduitFitting")
all_elements_of_category = ElementsOfCategory(categories)
categories_2 = Categories("Conduit")
all_elements_of_category_2 = ElementsOfCategory(categories_2)
join = List.Join(all_elements_of_category, all_elements_of_category_2)

# group: PARAMTER NAME
string = StringInput("CONDUIT TO")

getParameterValueByName = Element.GetParameterValueByName(element=join, parameterName=string)

# group: ORIGINAL PARAMETER VALUE
string_2 = StringInput("SP")

eq = getParameterValueByName == string_2
filterByBoolMask = List.FilterByBoolMask(list=join, mask=eq)

# group: NEW PARAMETER VALUE
string_3 = StringInput("S")

setParameterByName = Element.SetParameterByName(element=filterByBoolMask.in, parameterName=string, value=string_3)
