# Dynamo graph Conduit.dyn (Dynamo 1.3.2.2480)

# group: GetExcel
file_path = Filename("..\Conduit Project\Conduit Run Schedule.xlsx")
fromPath = FileObject(file_path)  # "File.FromPath"
string = StringInput("Conduit Run Schedule")
boolean = BoolSelector(true)
readFromFile = Excel.ReadFromFile(file=fromPath, sheetName=string, readAsStrings=boolean)

# group: PrepareExcel
firstItem = List.FirstItem(readFromFile)
restOfItems = List.RestOfItems(readFromFile)
firstItem_2 = List.FirstItem(restOfItems)
restOfItems_2 = List.RestOfItems(restOfItems)
firstItem_3 = List.FirstItem(restOfItems_2)
restOfItems_3 = List.RestOfItems(restOfItems_2)
transpose = List.Transpose(restOfItems_3)

string_2 = StringInput("Conduit Run ID")
setParameterByName = Element.SetParameterByName(parameterName=string_2)  # unwired: element, value

# group: OtherAttemptedNodes
indexOf = IndexOf()  # unwired: arg0, arg1
laceLongest = List.LaceLongest(indexOf)  # unwired: arg1, arg2
map = List.Map()  # unwired: list, f_x
string_from_array = FromArray()  # unwired: arg0
code_block = CodeBlock { ElementSelector.ByUniqueId(id, true); }  # unwired: arg0, arg1
byKeysValues = Custom[Springs.Dictionary.ByKeysValues]()  # Dictionaries are an incredibly powerful tool for making associative sets between two equal length lists. The first list must be of unique strings (or numbers) and will be the key and the second list will be the matching values (it can be made up of geometry, elements, even other lists) The search keys list will provide the corresponding value to the input key.; unwired: keys, values, searchKeys, defaultValue
joinByKey = Custom[List.JoinByKey]()  # Joins two lists by common keys.; unwired: keys1, seq1, keys2, seq2
lunchbox_list_matcher = Custom[LunchBox List Matcher]()  # Compares a List A against a List B and matches length of List A. If ListA > ListB, ListB will be extended. If ListA < ListB, ListB will be truncated.; unwired: ListA, ListB

# group: GetRevit
categories = Categories("ConduitRun")
categories_2 = Categories("Conduit")
categories_3 = Categories("ConduitFitting")
create = List.Create(categories, categories_2, categories_3)
all_elements_of_category = ElementsOfCategory(create)
string_3 = StringInput("Conduit Run ID")
string_4 = StringInput("From")
string_5 = StringInput("To")
create_2 = List.Create(string_3, string_4, string_5)
getParameterValueByName = Element.GetParameterValueByName(element=all_elements_of_category, parameterName=create_2)
string_6 = StringInput("Conduit Run ID")
getParameterValueByName_2 = Element.GetParameterValueByName(element=all_elements_of_category, parameterName=string_6)

# group: ListAllItems_RevitAndExcel
number = DoubleInput(1)
number_2 = DoubleInput(2)
number_3 = DoubleInput(3)
create_3 = List.Create(number, number_2, number_3)
getItemAtIndex = List.GetItemAtIndex(list=transpose, index=create_3)
create_4 = List.Create(getParameterValueByName, getItemAtIndex)

# group: ListForComparison
number_4 = DoubleInput(0)
getItemAtIndex_2 = List.GetItemAtIndex(list=transpose, index=number_4)
setIntersection_FindAllRunID_1and2 = SetIntersection(getParameterValueByName_2, getItemAtIndex_2)

# group: AttemptToCompare
list_pickbykey = Custom[[&] List.PickByKey](list=create_4, keys=setIntersection_FindAllRunID_1and2)  # Take items from a list whose keys match a given set of choose values. Items and their corresponding keys are output in the order in which they are requested by the set of choose values. As needed, items may appear multiple times in the output list or not at all. Choose values that do not correspond to a key value produce a null selection, and all values not matched to a key are given as a third output.; unwired: pickKeys
watch = Watch(list_pickbykey.itemsPicked)
watch_2 = Watch(list_pickbykey.keysPicked)
watch_3 = Watch(list_pickbykey.keysNotMatched)

string_7 = StringInput("To")
setParameterByName_2 = Element.SetParameterByName(parameterName=string_7)  # unwired: element, value
string_8 = StringInput("From")
setParameterByName_3 = Element.SetParameterByName(parameterName=string_8)  # unwired: element, value
