# Dynamo graph Conduit2.dyn (Dynamo 1.3.2.2480)

# group: GetRevit
categories = Categories("ConduitRun")
categories_2 = Categories("Conduit")
categories_3 = Categories("ConduitFitting")
create = List.Create(categories, categories_2, categories_3)
all_elements_of_category = ElementsOfCategory(create)
flatten = Flatten(all_elements_of_category)
id = Element.Id(flatten)
string_from_object = FromObject(id)

# group: GetExcel
file_path = Filename(".\Conduit Run Schedule.xlsx")
fromPath = FileObject(file_path)  # "File.FromPath"
string = StringInput("Conduit Run Schedule")
boolean = BoolSelector(true)
readFromFile = Excel.ReadFromFile(file=fromPath, sheetName=string, readAsStrings=boolean)
code_block = CodeBlock { 0; }
removeItemAtIndex = List.RemoveItemAtIndex(list=readFromFile, indices=code_block)
transpose = List.Transpose(removeItemAtIndex)
code_block_2 = CodeBlock(t=transpose)
# ---------- code_block_2.designscript (4 lines) ----------
//exceldata to pass
{t[1],t[2],t[3],t[4]};
//key
t[0];
# ----------------------------------------

# note: DanEDU
list_filterbykey_danedu = Custom[List.FilterByKey|DanEDU](list1=flatten, key1=string_from_object, list2=code_block_2.out0, key2=code_block_2.out1)  # Filter two list items based on their key values. Lists of keys has to be equel length!
string_2 = StringInput("Conduit Run ID")
code_block_3 = CodeBlock(Out=list_filterbykey_danedu.list2)
# ---------- code_block_3.designscript (6 lines) ----------
//Conduit Run ID
Out[0];
//From
Out[1];
//To
Out[2];
# ----------------------------------------
setParameterByName = Element.SetParameterByName(element=list_filterbykey_danedu.list1, parameterName=string_2, value=code_block_3.out0)
string_3 = StringInput("CONDUIT TO")
setParameterByName_2 = Element.SetParameterByName(element=list_filterbykey_danedu.list1, parameterName=string_3, value=code_block_3.out2)
string_4 = StringInput("CONDUIT FROM")
setParameterByName_3 = Element.SetParameterByName(element=list_filterbykey_danedu.list1, parameterName=string_4, value=code_block_3.out1)
