# Dynamo graph Copy Conduit Parameters into Run from Selected Conduit (Index Vesion).dyn (Dynamo 1.3.2.2480)

# group: Select a conduit from the run
select_model_element = DSModelElementSelection()  # 1 picked in the model

elements_in_connected_network = Custom[Elements in connected network](Element=select_model_element)  # Returns all elements that are physically connected to the input element
string = StringInput("CONDUIT TO")
string_2 = StringInput("CONDUIT TO")
getParameterValueByName = Element.GetParameterValueByName(element=elements_in_connected_network, parameterName=string_2)
string_3 = StringInput("CONDUIT FROM")
getParameterValueByName_2 = Element.GetParameterValueByName(element=elements_in_connected_network, parameterName=string_3)
string_4 = StringInput("CIRCUIT NUMBER")
getParameterValueByName_3 = Element.GetParameterValueByName(element=elements_in_connected_network, parameterName=string_4)
create = List.Create(getParameterValueByName, getParameterValueByName_2, getParameterValueByName_3)

# group: Select list index number of the parameters you would like to copy into the rest of the run
number = DoubleInput(1)
transpose = List.Transpose(create)

removeItemAtIndex = List.RemoveItemAtIndex(list=elements_in_connected_network, indices=number)
getItemAtIndex = List.GetItemAtIndex(list=transpose, index=number)
number_2 = DoubleInput(0)
getItemAtIndex_2 = List.GetItemAtIndex(list=getItemAtIndex, index=number_2)
setParameterByName = Element.SetParameterByName(element=removeItemAtIndex, parameterName=string, value=getItemAtIndex_2)
string_5 = StringInput("CIRCUIT NUMBER")
number_3 = DoubleInput(2)
getItemAtIndex_3 = List.GetItemAtIndex(list=getItemAtIndex, index=number_3)
setParameterByName_2 = Element.SetParameterByName(element=removeItemAtIndex, parameterName=string_5, value=getItemAtIndex_3)
string_6 = StringInput("CONDUIT FROM")
number_4 = DoubleInput(1)
getItemAtIndex_4 = List.GetItemAtIndex(list=getItemAtIndex, index=number_4)
setParameterByName_3 = Element.SetParameterByName(element=removeItemAtIndex, parameterName=string_6, value=getItemAtIndex_4)
