# Dynamo graph groupConduits.dyn (Dynamo 1.3.2.2480)

# group: Get all Conduits and their location lines
categories = Categories("Conduit")
all_elements_of_category = ElementsOfCategory(categories)
# note: Gets location lines
python_script = Python(IN[0]=all_elements_of_category)
# ---------- python_script.python (13 lines) ----------
import clr

clr.AddReference('RevitAPI')
from Autodesk.Revit.DB import *

clr.AddReference('RevitNodes')
import Revit
clr.ImportExtensions(Revit.GeometryConversion)
clr.ImportExtensions(Revit.Elements)

elements = UnwrapElement(IN[0])

OUT=[e.Location.Curve.ToProtoType(True) for e in elements]
# ----------------------------------------

# group: Get all Conduit Fittings and their curves
categories_2 = Categories("ConduitFitting")
all_elements_of_category_2 = ElementsOfCategory(categories_2)
curves = Element.Curves(all_elements_of_category_2)
flatten = Flatten(curves)

# group: Join curves from conduits and fittings and group them with node from Archi-Lab
join = List.Join(python_script, flatten)
group_curves = Custom[Group Curves](Curves=join)  # This node will take any input of flat list of curves and group them into sublists containing "joinable" curves that is continous curves. They might form closed curves or open curves. Use PolyCurve.ByJoinedCurves to convert output groups of curves into single PolyCurves

# group: Grouping conduits
equals = Equals(python_script, group_curves, lacing=CrossProduct)
allFalse = AllFalse()  # unwired: arg0
map = List.Map(f_x=allFalse)  # unwired: list
map_2 = List.Map(list=equals, f_x=map)
code_block = CodeBlock { false; }
indexOf = IndexOf(map_2, code_block, lacing=Longest)
groupByKey = List.GroupByKey(list=all_elements_of_category, keys=indexOf)

# group: Grouping fittings
firstItem = List.FirstItem(curves, lacing=Longest)
equals_2 = Equals(firstItem, group_curves, lacing=CrossProduct)
allFalse_2 = AllFalse()  # unwired: arg0
map_3 = List.Map(f_x=allFalse_2)  # unwired: list
map_4 = List.Map(list=equals_2, f_x=map_3)
code_block_2 = CodeBlock { false; }
indexOf_2 = IndexOf(map_4, code_block_2, lacing=Longest)
groupByKey_2 = List.GroupByKey(list=all_elements_of_category_2, keys=indexOf_2)

# group: Combining conduits and fittings to one list with a sublist for each group
join_2 = List.Join()  # unwired: arg0, arg1
combine = List.Combine(join_2, groupByKey.groups, groupByKey_2.groups)

file_path = Filename("No file selected.")
string = StringInput("Conduit")
writeToFile = Excel.WriteToFile(filePath=file_path, sheetName=string)  # unwired: startRow, startCol, data
string_2 = StringInput("CONDUIT TO")
