# Dynamo graph Delete Types.dyn (Dynamo 2.0.2.6826)

family_types = FamilyTypes()  # nothing selected
python_script = Python(IN[0]=family_types)
# ---------- python_script.python (50 lines) ----------
import clr
clr.AddReference('ProtoGeometry')
from Autodesk.DesignScript.Geometry import *

# Import DocumentManager and TransactionManager
clr.AddReference("RevitServices")
import RevitServices
from RevitServices.Persistence import DocumentManager
from RevitServices.Transactions import TransactionManager

# Import RevitAPI
clr.AddReference("RevitAPI")
import Autodesk
from Autodesk.Revit.DB import *

doc = DocumentManager.Instance.CurrentDBDocument
uiapp = DocumentManager.Instance.CurrentUIApplication
app = uiapp.Application

from System.Collections.Generic import *

#The inputs to this node will be stored as a list in the IN variable.
dataEnteringNode = IN

#unwrap all elements to use with API
elements = []

def tolist(obj):
	if isinstance(obj, list):
		return UnwrapElement(obj)
	else:
		return [UnwrapElement(obj)]
elements = tolist(IN[0])


idsToDelete = List[Autodesk.Revit.DB.ElementId]()
for i in elements:
	idsToDelete.Add(i.Id)

# "Start" the transaction
TransactionManager.Instance.EnsureInTransaction(doc)

doc.Delete(idsToDelete)

# "End" the transaction
TransactionManager.Instance.TransactionTaskDone()

message = "You have successfully deleted n " + str(idsToDelete.Count) + " elements from Revit model."

OUT = 'n'.join('{:^35}'.format(s) for s in message.split('n'))
# ----------------------------------------
family_types_2 = FamilyTypes(index=2)
list_create = List.Create(item1=family_types_2)  # unwired: item0
circuitsFromPanel = Custom[RIE.CircuitsFromPanel]()  # Retrieves all Circuits from input panel element; unwired: Panel
