# Dynamo graph getDoorTagsFromDoor.dyn (Dynamo 1.3.2.2480)

# group: Collect all door tags
categories = Categories("DoorTags")
all_elements_of_category = ElementsOfCategory(categories)

# group: Obtain all the elements the tags are tagging and their element id
taggedElement = Tag.TaggedElement(all_elements_of_category)
id = Element.Id(taggedElement)

# group: Group the tags by the element ids (this is for when something is tagged multiple times or in multiple views)
groupByKey = List.GroupByKey(list=all_elements_of_category, keys=id)

# group: Dictionaries provide a way to look stuff up by a given key
code_block = CodeBlock(taggedElement=groupByKey.groups, tag=groupByKey.unique_keys)
# ---------- code_block.designscript (4 lines) ----------
//declare a new dictionary to store this in
tagDictionary = {};
//dictionary[whatToLookUpBy] = tagElement
tagDictionary[taggedElement] = tag;
# ----------------------------------------

# group: Sample element selected manually to get the tags for
select_model_element = DSModelElementSelection()
id_2 = Element.Id(select_model_element)

# group: Retrieve the related tags for the given element from the dictionary
code_block_2 = CodeBlock(tagDictionary=code_block.tagDictionary, taggedElement=id_2) { tagDictionary[taggedElement]; }
