# Dynamo custom node Circuit Multiple.dyf (Dynamo 2.0.3.8810)
# category: Dan Cleary
# Circuit Multiple Panels Worth of Elements

Input = Input(: var[]..[])
python_script = Python(IN[0]=Input)  # unwired: IN[1]
# ---------- python_script.python (70 lines) ----------
import clr
clr.AddReference('ProtoGeometry')
from Autodesk.DesignScript.Geometry import *

clr.AddReference('RevitServices')
import RevitServices
from RevitServices.Persistence import DocumentManager
from RevitServices.Transactions import TransactionManager
from System.Collections.Generic import *

clr.AddReference('RevitNodes')
import Revit
clr.ImportExtensions(Revit.Elements)

clr.AddReference('RevitAPI')
import Autodesk
from Autodesk.Revit.DB import *
from Autodesk.Revit.DB.Electrical import *
from Autodesk.Revit.DB import MEPSystem

clr.AddReference('DSCoreNodes')
import DSCore
from DSCore.List import *

import sys
pyt_path = r'C:\Program Files (x86)\IronPython 2.7\Lib'
sys.path.append(pyt_path)

# Import List ( ICollection(ElementId) = List[ElementId]() )
clr.AddReference("System")
from System.Collections.Generic import List 

#The inputs to this node will be stored as a list in the IN variables.
input = UnwrapElement(IN[0])


ElectComponents = []
NewCircuit = []
	
for panel in input:	
	collection = []
	for sublist in panel:
		sub = List[ElementId]()
		ElectComponents.append(sub)
		collection.append(sublist)
		for item in sublist:
			sub.Add(item.Id)




doc = DocumentManager.Instance.CurrentDBDocument
uiapp = DocumentManager.Instance.CurrentUIApplication
app = uiapp.Application
uidoc = DocumentManager.Instance.CurrentUIApplication.ActiveUIDocument

ListNewCircuit = []

TransactionManager.Instance.EnsureInTransaction(doc)

for e in ElectComponents:
	NewCircuit = ElectricalSystem.Create(doc, e, ElectricalSystemType.PowerCircuit)
	ListNewCircuit.append(NewCircuit)

	

TransactionManager.Instance.TransactionTaskDone()


OUT = ListNewCircuit
# ----------------------------------------
Output = Output(python_script)  # ""
