# Dynamo graph Duplicate and Level of Panels with Circuits.dyn (Dynamo 2.0.3.8810)

select_model_element = DSModelElementSelection()  # 1 picked in the model; graph input
code_block = CodeBlock { Origin Panel; }
categories = Categories(index=183)
all_elements_of_category = ElementsOfCategory(Category=categories)
code_block_2 = CodeBlock { "Panel Name"; }
getParameterValueByName = Element.GetParameterValueByName(element=all_elements_of_category, parameterName=code_block_2)
code_block_3 = CodeBlock { ""; }
eq = getParameterValueByName == code_block_3
filterByBoolMask = List.FilterByBoolMask(list=all_elements_of_category, mask=eq)
python_script = Python(IN[0]=filterByBoolMask.out)
# ---------- python_script.python (39 lines) ----------
import clr
clr.AddReference('RevitAPI')
from Autodesk.Revit.DB import *

clr.AddReference("RevitNodes")
import Revit
clr.ImportExtensions(Revit.Elements)

def GetLevel(item):
	val = None
	if hasattr(item, "LevelId"): 
		val = item.Document.GetElement(item.LevelId)
		if val: return val
	if hasattr(item, "Level"):
		val = item.Level
		if val: return val
	if hasattr(item, "GenLevel"):
		val = item.GenLevel
		if val: return val
	if (item.GetType().ToString() in ("Autodesk.Revit.DB.Architecture.StairsRun", "Autodesk.Revit.DB.Architecture.StairsLanding")):
		item = item.GetStairs()
	if (item.GetType().ToString() == "Autodesk.Revit.DB.Architecture.Stairs"):
		try: return item.Document.GetElement(item.get_Parameter(BuiltInParameter.STAIRS_BASE_LEVEL_PARAM).AsElementId())
		except: pass
	if (item.GetType().ToString() == "Autodesk.Revit.DB.ExtrusionRoof"):
		try: return item.Document.GetElement(item.get_Parameter(BuiltInParameter.ROOF_CONSTRAINT_LEVEL_PARAM).AsElementId())
		except: pass
	if not val:
		try: return item.Document.GetElement(item.get_Parameter(BuiltInParameter.INSTANCE_REFERENCE_LEVEL_PARAM).AsElementId())
		except: 
			try: return item.Document.GetElement(item.get_Parameter(BuiltInParameter.INSTANCE_SCHEDULE_ONLY_LEVEL_PARAM).AsElementId())
			except: 
				try: return item.Document.GetElement(item.get_Parameter(BuiltInParameter.SCHEDULE_LEVEL_PARAM).AsElementId())
				except: return None

items = UnwrapElement(IN[0])

if isinstance(IN[0], list): OUT = [GetLevel(x) for x in items]
else: OUT = GetLevel(items)
# ----------------------------------------
string_from_object = FromObject(obj=python_script)

# group: Select Level
levels = Levels(index=0)

string_from_object_2 = FromObject(obj=levels)
eq_2 = string_from_object == string_from_object_2
filterByBoolMask_2 = List.FilterByBoolMask(list=filterByBoolMask.out, mask=eq_2)
watch = Watch(filterByBoolMask_2.in)
python_script_2 = Python(IN[0]=watch)
# ---------- python_script_2.python (32 lines) ----------
import clr

# Import Revit API + APIUI
clr.AddReference('RevitAPI')
from Autodesk.Revit.DB import *
from Autodesk.Revit.DB.Electrical import *

OUT = []

def tolist(obj):
	if isinstance(obj, list):
		return UnwrapElement(obj)
	else:
		return [UnwrapElement(obj)]

panels = tolist(IN[0])
circuitsInPanel = []
circuits = []

for x in panels:
	circuits = []
	for y in x.MEPModel.ElectricalSystems:
		circuits.append(y)
	circuitsInPanel.append(circuits)
	
OUT = circuitsInPanel

#Assign your output to the OUT variable.
if len(OUT) == 1:
	OUT = OUT[0]
else:
	OUT = OUT 
# ----------------------------------------

# group: Sort Circuits
string = StringInput("Circuit Number")  # graph input
getParameterValueByName_2 = Element.GetParameterValueByName(element=python_script_2, parameterName=string)
code_block_4 = CodeBlock { ","; }
split = String.Split(str=getParameterValueByName_2, separater0=code_block_4)
firstItem = List.FirstItem(list=split@@L2)
toNumber = String.ToNumber(str=firstItem@@L2)
sortByKey = List.SortByKey(list=python_script_2, keys=toNumber, lacing=Shortest)

python_script_3 = Python(IN[0]=sortByKey.sorted_list)
# ---------- python_script_3.python (18 lines) ----------
import clr
clr.AddReference('ProtoGeometry')
from Autodesk.DesignScript.Geometry import *
#The inputs to this node will be stored as a list in the IN variables.
systems = UnwrapElement(IN[0])
panels = []
elements = []

for x in systems:
	panels.append(x.BaseEquipment)
	sublist = []
	elementset = x.Elements
	for x in elementset:
		sublist.append(x)
	elements.append(sublist)

#Assign your output to the OUT variable.
OUT = elements
# ----------------------------------------
code_block_5 = CodeBlock { Origin Element Location; }
code_block_6 = CodeBlock { Destination Element Location; }
python_script_4 = Python(IN[0]=sortByKey.sorted_list)
# ---------- python_script_4.python (92 lines) ----------
import sys
#pyt_path = r"C:\Program Files (x86)\IronPython 2.7\DLLs"
#sys.path.append(pyt_path)
import clr

#clr.AddReference('IronPython.SQLite.dll')
pyt_path = r"C:\Program Files (x86)\IronPython 2.7\Lib"
sys.path.append(pyt_path)
#import sqlite3

# Import ToDSType(bool) extension method
clr.AddReference('RevitNodes')
import Revit
clr.ImportExtensions(Revit.GeometryConversion)
clr.ImportExtensions(Revit.Elements)

# Import DocumentManager and TransactionManager
clr.AddReference('RevitServices')
import RevitServices
from RevitServices.Persistence import DocumentManager
from RevitServices.Transactions import TransactionManager

doc = DocumentManager.Instance.CurrentDBDocument
uidoc = DocumentManager.Instance.CurrentUIApplication.ActiveUIDocument
app = DocumentManager.Instance.CurrentUIApplication.Application

# Import List ( ICollection(ElementId) = List[ElementId]() )
clr.AddReference('System')
from System.Collections.Generic import List

# Import Revit API + APIUI
clr.AddReference('RevitAPI')
from Autodesk.Revit.DB import *
from Autodesk.Revit.DB.Electrical import *

clr.AddReference('RevitAPIUI')
from Autodesk.Revit.UI import *

OUT = []

def tolist(obj):
	if isinstance(obj, list):
		return UnwrapElement(obj)
	else:
		return [UnwrapElement(obj)]

# Start Transaction
# TransactionManager.Instance.EnsureInTransaction(doc)

# End Transaction
# TransactionManager.Instance.TransactionTaskDone()

systems = tolist(IN[0])
elements = []
	

if hasattr(systems[0],'__iter__'):
	newlist = []
	elements = []
	for x in systems:
		collection = []
		for y in x:
			newlist = []
			try:
				for z in y.Elements:
					newlist.append(z)
			except:
				if y.IsEmpty:
					newlist.append(y.Category.Name)
				else:
					newlist.append("Failed")
			collection.append(newlist)
		elements.append(collection)
	
else:
	for x in systems:
		sublist = []
		try:
			elementset = x.Elements
			for x in elementset:
				sublist.append(x)
		except:
			if x.IsEmpty:
				sublist.append(x.Category.Name)
			else:
				sublist.append("Failed")
		elements.append(sublist)

#Assign your output to the OUT variable.
OUT = elements
if len(OUT) == 1:
	OUT = OUT[0]
# ----------------------------------------
select_model_element_2 = DSModelElementSelection()  # 1 picked in the model; graph input
getLocation = Element.GetLocation(element=select_model_element_2)
select_model_element_3 = DSModelElementSelection()  # 1 picked in the model; graph input
getLocation_2 = Element.GetLocation(element=select_model_element_3)
byTwoPoints = Vector.ByTwoPoints(start=getLocation, end=getLocation_2)

# group: COPY ELEMENTS TO FROM START POINT TO END POINT
code_block_7 = CodeBlock { "true"; }
copyByVector = Custom[Element.CopyByVector](element=python_script_4@@L2, vector=byTwoPoints, rehostToClosestLevel=code_block_7)  # Copies an element or a list of elements by a given vector.

clean = List.Clean(list=copyByVector)

# group: SET PHASE
select_phase = RevitPhases(index=1)  # graph input

python_script_5 = Python(IN[0]=clean)
# ---------- python_script_5.python (70 lines) ----------
import clr
clr.AddReference('ProtoGeometry')
from Autodesk.DesignScript.Geometry import *

clr.AddReference('RevitServices')
import RevitServices
from RevitServices.Persistence import DocumentManager
from RevitServices.Transactions import TransactionManager
from System.Collections.Generic import *

clr.AddReference('RevitNodes')
import Revit
clr.ImportExtensions(Revit.Elements)

clr.AddReference('RevitAPI')
import Autodesk
from Autodesk.Revit.DB import *
from Autodesk.Revit.DB.Electrical import *
from Autodesk.Revit.DB import MEPSystem

clr.AddReference('DSCoreNodes')
import DSCore
from DSCore.List import *

import sys
pyt_path = r'C:\Program Files (x86)\IronPython 2.7\Lib'
sys.path.append(pyt_path)

# Import List ( ICollection(ElementId) = List[ElementId]() )
clr.AddReference("System")
from System.Collections.Generic import List 

#The inputs to this node will be stored as a list in the IN variables.
input = UnwrapElement(IN[0])


ElectComponents = []
NewCircuit = []
	
for panel in input:	
	collection = []
	for sublist in panel:
		sub = List[ElementId]()
		ElectComponents.append(sub)
		collection.append(sublist)
		for item in sublist:
			sub.Add(item.Id)




doc = DocumentManager.Instance.CurrentDBDocument
uiapp = DocumentManager.Instance.CurrentUIApplication
app = uiapp.Application
uidoc = DocumentManager.Instance.CurrentUIApplication.ActiveUIDocument

ListNewCircuit = []

TransactionManager.Instance.EnsureInTransaction(doc)

for e in ElectComponents:
	NewCircuit = ElectricalSystem.Create(doc, e, ElectricalSystemType.PowerCircuit)
	ListNewCircuit.append(NewCircuit)

	

TransactionManager.Instance.TransactionTaskDone()


OUT = ListNewCircuit
# ----------------------------------------
count = List.Count(list=python_script_2@L2)
chop = Custom[List.Chop+](seq=python_script_5, lengths=count)  # Turns a list into a list of lists with sublists of varying lengths. Unlike the OOTB node, it can generate empty sublists as well.

# group: GET CIRCUIT PARAMETERS TO BE COPIED
string_2 = StringInput("Rating")  # graph input
getParameterValueByName_3 = Element.GetParameterValueByName(element=sortByKey.sorted_list, parameterName=string_2)
string_3 = StringInput("Load Name")  # graph input
getParameterValueByName_4 = Element.GetParameterValueByName(element=sortByKey.sorted_list, parameterName=string_3)

# group: FIND AND REPLACE CIRCUIT NAME
string_4 = StringInput("124")  # graph input
string_5 = StringInput("3000")  # graph input
replace = String.Replace(str=getParameterValueByName_4, searchFor=string_4, replaceWith=string_5)

# group: SET RATING AND LOAD NAME FOR CIRCUITS
string_6 = StringInput("Rating")  # graph input
setParameterByName = Element.SetParameterByName(element=chop, parameterName=string_6, value=getParameterValueByName_3)
string_7 = StringInput("Load Name")  # graph input
setParameterByName_2 = Element.SetParameterByName(element=chop, parameterName=string_7, value=replace)

# group: GET WORKSET OF ELEMENTS
string_8 = StringInput("Workset")  # graph input
getParameterValueByName_5 = Element.GetParameterValueByName(element=python_script_4, parameterName=string_8)

# group: SET PHASE AND WORKSET
string_9 = StringInput("Phase Created")  # graph input
setParameterByName_3 = Element.SetParameterByName(element=clean, parameterName=string_9, value=select_phase)
string_10 = StringInput("Workset")  # graph input
setParameterByName_4 = Element.SetParameterByName(element=clean, parameterName=string_10, value=getParameterValueByName_5)

code_block_8 = CodeBlock { "Location"; }

# group: optional
string_11 = StringInput("PHASE BY SUITE")  # graph input
setParameterByName_5 = Element.SetParameterByName(element=clean, parameterName=string_11, value=string_5)
string_12 = StringInput("Location")
getParameterValueByName_6 = Element.GetParameterValueByName(element=python_script_4, parameterName=code_block_8)
replace_2 = String.Replace(str=getParameterValueByName_6, searchFor=string_4, replaceWith=string_5)
setParameterByName_6 = Element.SetParameterByName(element=clean, parameterName=string_12, value=replace_2)

# group: COPY PANEL TO FROM START POINT TO END POINT
code_block_9 = CodeBlock { "true"; }
copyByVector_2 = Custom[Element.CopyByVector](element=watch, vector=byTwoPoints, rehostToClosestLevel=code_block_9)

# group: Select panel. IN[1] = Electrical System IN[0] = Panel element
python_script_6 = Python(IN[0]=chop, IN[1]=copyByVector_2)
# ---------- python_script_6.python (61 lines) ----------
from itertools import izip_longest


import clr
clr.AddReference('ProtoGeometry')
from Autodesk.DesignScript.Geometry import *

clr.AddReference('RevitServices')
import RevitServices
from RevitServices.Persistence import DocumentManager
from RevitServices.Transactions import TransactionManager
from System.Collections.Generic import *

clr.AddReference('RevitNodes')
import Revit
clr.ImportExtensions(Revit.Elements)

clr.AddReference('RevitAPI')
import Autodesk
from Autodesk.Revit.DB import *
from Autodesk.Revit.DB.Electrical import *
from Autodesk.Revit.DB import MEPSystem

clr.AddReference('DSCoreNodes')
import DSCore
from DSCore.List import *

import sys
pyt_path = r'C:\Program Files (x86)\IronPython 2.7\Lib'
sys.path.append(pyt_path)

# Import List ( ICollection(ElementId) = List[ElementId]() )
clr.AddReference("System")
from System.Collections.Generic import List 

def tolist(obj):
	if isinstance(obj, list):
		return UnwrapElement(obj)
	else:
		return [UnwrapElement(obj)]

circuit = UnwrapElement(IN[0])
panel = UnwrapElement(IN[1])

doc = DocumentManager.Instance.CurrentDBDocument
uiapp = DocumentManager.Instance.CurrentUIApplication
app = uiapp.Application
uidoc = DocumentManager.Instance.CurrentUIApplication.ActiveUIDocument

TransactionManager.Instance.EnsureInTransaction(doc)

for _ in izip_longest(circuit):
	_.SelectPanel(panel)
#for _ in circuit:
#	_.SelectPanel(panel)

TransactionManager.Instance.TransactionTaskDone()

#Assign your output to the OUT variable.
OUT = []
OUT = circuit, panel
# ----------------------------------------

# group: Create new circuit on Panel and assign elementset to new circuit
python_script_7 = Python(IN[0]=clean)
# ---------- python_script_7.python (65 lines) ----------
import clr
clr.AddReference('ProtoGeometry')
from Autodesk.DesignScript.Geometry import *

clr.AddReference('RevitServices')
import RevitServices
from RevitServices.Persistence import DocumentManager
from RevitServices.Transactions import TransactionManager
from System.Collections.Generic import *

clr.AddReference('RevitNodes')
import Revit
clr.ImportExtensions(Revit.Elements)

clr.AddReference('RevitAPI')
import Autodesk
from Autodesk.Revit.DB import *
from Autodesk.Revit.DB.Electrical import *
from Autodesk.Revit.DB import MEPSystem

clr.AddReference('DSCoreNodes')
import DSCore
from DSCore.List import *

import sys
pyt_path = r'C:\Program Files (x86)\IronPython 2.7\Lib'
sys.path.append(pyt_path)

# Import List ( ICollection(ElementId) = List[ElementId]() )
clr.AddReference("System")
from System.Collections.Generic import List 

#The inputs to this node will be stored as a list in the IN variables.
input = UnwrapElement(IN[0])


ElectComponents = []
NewCircuit = []

for sublist in input:
	sub = List[ElementId]()
	ElectComponents.append(sub)
	for item in sublist:
		sub.Add(item.Id)


doc = DocumentManager.Instance.CurrentDBDocument
uiapp = DocumentManager.Instance.CurrentUIApplication
app = uiapp.Application
uidoc = DocumentManager.Instance.CurrentUIApplication.ActiveUIDocument

ListNewCircuit = []

TransactionManager.Instance.EnsureInTransaction(doc)

for e in ElectComponents:
	NewCircuit = ElectricalSystem.Create(doc, e, ElectricalSystemType.PowerCircuit)
	ListNewCircuit.append(NewCircuit)

	

TransactionManager.Instance.TransactionTaskDone()


OUT = ListNewCircuit
# ----------------------------------------

code_block_10 = CodeBlock { 2; }
flatten = List.Flatten(list=python_script_7, amt=code_block_10)
code_block_11 = CodeBlock { "Panel Name"; }
getParameterValueByName_7 = Element.GetParameterValueByName(element=copyByVector_2, parameterName=code_block_11)

# group: FIND AND REPLACE CIRCUIT NAME
string_13 = StringInput("1")  # graph input
string_14 = StringInput("2")  # graph input
replace_3 = String.Replace(str=getParameterValueByName_7, searchFor=string_13, replaceWith=string_14)

setParameterByName_7 = Element.SetParameterByName(element=copyByVector_2, parameterName=code_block_11, value=replace_3)
code_block_12 = CodeBlock { 0; }
getItemAtIndex = List.GetItemAtIndex(list=setParameterByName_7, index=code_block_12)
selectPanel = Custom[RIE.SelectPanel](Circuit=chop, Panel=copyByVector_2, lacing=Longest)  # Assigns Electrical System (cirucit) to a panel and assigns the circuit an automatic running index number
