# Dynamo graph Duplicate and Panel with Circuits.dyn (Dynamo 2.0.3.8810)

code_block = CodeBlock { Origin Panel; }
code_block_2 = CodeBlock { Origin Element Location; }
code_block_3 = CodeBlock { Destination Element Location; }
select_model_element = DSModelElementSelection()  # 1 picked in the model; graph input
python_script = Python(IN[0]=select_model_element)
# ---------- python_script.python (32 lines) ----------
import clr

# Import Revit API + APIUI
clr.AddReference('RevitAPI')
from Autodesk.Revit.DB import *
from Autodesk.Revit.DB.Electrical import *

OUT = []

def tolist(obj):
	if isinstance(obj, list):
		return UnwrapElement(obj)
	else:
		return [UnwrapElement(obj)]

panels = tolist(IN[0])
circuitsInPanel = []
circuits = []

for x in panels:
	circuits = []
	for y in x.MEPModel.ElectricalSystems:
		circuits.append(y)
	circuitsInPanel.append(circuits)
	
OUT = circuitsInPanel

#Assign your output to the OUT variable.
if len(OUT) == 1:
	OUT = OUT[0]
else:
	OUT = OUT 
# ----------------------------------------

# group: Sort Circuits
string = StringInput("Circuit Number")  # graph input
getParameterValueByName = Element.GetParameterValueByName(element=python_script, parameterName=string)
code_block_4 = CodeBlock { ","; }
split = String.Split(str=getParameterValueByName, separater0=code_block_4)
firstItem = List.FirstItem(list=split@L2)
toNumber = String.ToNumber(str=firstItem@L1)
sortByKey = List.SortByKey(list=python_script, keys=toNumber)

python_script_2 = Python(IN[0]=sortByKey.sorted_list)
# ---------- python_script_2.python (18 lines) ----------
import clr
clr.AddReference('ProtoGeometry')
from Autodesk.DesignScript.Geometry import *
#The inputs to this node will be stored as a list in the IN variables.
systems = UnwrapElement(IN[0])
panels = []
elements = []

for x in systems:
	panels.append(x.BaseEquipment)
	sublist = []
	elementset = x.Elements
	for x in elementset:
		sublist.append(x)
	elements.append(sublist)

#Assign your output to the OUT variable.
OUT = elements
# ----------------------------------------
select_model_element_2 = DSModelElementSelection()  # 1 picked in the model; graph input
getLocation = Element.GetLocation(element=select_model_element_2)
select_model_element_3 = DSModelElementSelection()  # 1 picked in the model; graph input
getLocation_2 = Element.GetLocation(element=select_model_element_3)
byTwoPoints = Vector.ByTwoPoints(start=getLocation, end=getLocation_2)

# group: COPY ELEMENTS TO FROM START POINT TO END POINT
code_block_5 = CodeBlock { "true"; }
copyByVector = Custom[Element.CopyByVector](element=python_script_2@@L2, vector=byTwoPoints, rehostToClosestLevel=code_block_5)  # Copies an element or a list of elements by a given vector.

clean = List.Clean(list=copyByVector)

# group: SET PHASE
select_phase = RevitPhases(index=1)  # graph input

# group: Create new circuit on Panel and assign elementset to new circuit
python_script_3 = Python(IN[0]=clean)  # unwired: IN[1]
# ---------- python_script_3.python (65 lines) ----------
import clr
clr.AddReference('ProtoGeometry')
from Autodesk.DesignScript.Geometry import *

clr.AddReference('RevitServices')
import RevitServices
from RevitServices.Persistence import DocumentManager
from RevitServices.Transactions import TransactionManager
from System.Collections.Generic import *

clr.AddReference('RevitNodes')
import Revit
clr.ImportExtensions(Revit.Elements)

clr.AddReference('RevitAPI')
import Autodesk
from Autodesk.Revit.DB import *
from Autodesk.Revit.DB.Electrical import *
from Autodesk.Revit.DB import MEPSystem

clr.AddReference('DSCoreNodes')
import DSCore
from DSCore.List import *

import sys
pyt_path = r'C:\Program Files (x86)\IronPython 2.7\Lib'
sys.path.append(pyt_path)

# Import List ( ICollection(ElementId) = List[ElementId]() )
clr.AddReference("System")
from System.Collections.Generic import List 

#The inputs to this node will be stored as a list in the IN variables.
input = UnwrapElement(IN[0])


ElectComponents = []
NewCircuit = []

for sublist in input:
	sub = List[ElementId]()
	ElectComponents.append(sub)
	for item in sublist:
		sub.Add(item.Id)


doc = DocumentManager.Instance.CurrentDBDocument
uiapp = DocumentManager.Instance.CurrentUIApplication
app = uiapp.Application
uidoc = DocumentManager.Instance.CurrentUIApplication.ActiveUIDocument

ListNewCircuit = []

TransactionManager.Instance.EnsureInTransaction(doc)

for e in ElectComponents:
	NewCircuit = ElectricalSystem.Create(doc, e, ElectricalSystemType.PowerCircuit)
	ListNewCircuit.append(NewCircuit)

	

TransactionManager.Instance.TransactionTaskDone()


OUT = ListNewCircuit
# ----------------------------------------

# group: GET CIRCUIT PARAMETERS TO BE COPIED
string_2 = StringInput("Rating")  # graph input
getParameterValueByName_2 = Element.GetParameterValueByName(element=sortByKey.sorted_list, parameterName=string_2)
string_3 = StringInput("Load Name")  # graph input
getParameterValueByName_3 = Element.GetParameterValueByName(element=sortByKey.sorted_list, parameterName=string_3)

# group: FIND AND REPLACE CIRCUIT NAME
string_4 = StringInput("124")  # graph input
string_5 = StringInput("3000")  # graph input
replace = String.Replace(str=getParameterValueByName_3, searchFor=string_4, replaceWith=string_5)

# group: SET RATING AND LOAD NAME FOR CIRCUITS
string_6 = StringInput("Rating")  # graph input
setParameterByName = Element.SetParameterByName(element=python_script_3, parameterName=string_6, value=getParameterValueByName_2)
string_7 = StringInput("Load Name")  # graph input
setParameterByName_2 = Element.SetParameterByName(element=python_script_3, parameterName=string_7, value=replace)

# group: GET WORKSET OF ELEMENTS
string_8 = StringInput("Workset")  # graph input
getParameterValueByName_4 = Element.GetParameterValueByName(element=python_script_2, parameterName=string_8)

# group: SET PHASE AND WORKSET
string_9 = StringInput("Phase Created")  # graph input
setParameterByName_3 = Element.SetParameterByName(element=clean, parameterName=string_9, value=select_phase)
string_10 = StringInput("Workset")  # graph input
setParameterByName_4 = Element.SetParameterByName(element=clean, parameterName=string_10, value=getParameterValueByName_4)

# group: optional
string_11 = StringInput("PHASE BY SUITE")  # graph input
setParameterByName_5 = Element.SetParameterByName(element=clean, parameterName=string_11, value=string_5)
string_12 = StringInput("Location")  # graph input
string_13 = StringInput("Location")  # graph input
getParameterValueByName_5 = Element.GetParameterValueByName(element=python_script_2, parameterName=string_13)
replace_2 = String.Replace(str=getParameterValueByName_5, searchFor=string_4, replaceWith=string_5)
setParameterByName_6 = Element.SetParameterByName(element=clean, parameterName=string_12, value=replace_2)

code_block_6 = CodeBlock { 2; }
flatten = List.Flatten(list=python_script_3, amt=code_block_6)

# group: COPY PANEL TO FROM START POINT TO END POINT
code_block_7 = CodeBlock { "true"; }
copyByVector_2 = Custom[Element.CopyByVector](element=select_model_element, vector=byTwoPoints, rehostToClosestLevel=code_block_7)

code_block_8 = CodeBlock { "Panel Name"; }
getParameterValueByName_6 = Element.GetParameterValueByName(element=copyByVector_2, parameterName=code_block_8)
setParameterByName_7 = Element.SetParameterByName(element=copyByVector_2, parameterName=code_block_8, value=getParameterValueByName_6)
code_block_9 = CodeBlock { 0; }
getItemAtIndex = List.GetItemAtIndex(list=setParameterByName_7, index=code_block_9)

# group: Select panel. IN[1] = Electrical System IN[0] = Panel element
python_script_4 = Python(IN[0]=flatten, IN[1]=getItemAtIndex)
# ---------- python_script_4.python (56 lines) ----------
import clr
clr.AddReference('ProtoGeometry')
from Autodesk.DesignScript.Geometry import *

clr.AddReference('RevitServices')
import RevitServices
from RevitServices.Persistence import DocumentManager
from RevitServices.Transactions import TransactionManager
from System.Collections.Generic import *

clr.AddReference('RevitNodes')
import Revit
clr.ImportExtensions(Revit.Elements)

clr.AddReference('RevitAPI')
import Autodesk
from Autodesk.Revit.DB import *
from Autodesk.Revit.DB.Electrical import *
from Autodesk.Revit.DB import MEPSystem

clr.AddReference('DSCoreNodes')
import DSCore
from DSCore.List import *

import sys
pyt_path = r'C:\Program Files (x86)\IronPython 2.7\Lib'
sys.path.append(pyt_path)

# Import List ( ICollection(ElementId) = List[ElementId]() )
clr.AddReference("System")
from System.Collections.Generic import List 

def tolist(obj):
	if isinstance(obj, list):
		return UnwrapElement(obj)
	else:
		return [UnwrapElement(obj)]

circuit = UnwrapElement(IN[0])
panel = UnwrapElement(IN[1])

doc = DocumentManager.Instance.CurrentDBDocument
uiapp = DocumentManager.Instance.CurrentUIApplication
app = uiapp.Application
uidoc = DocumentManager.Instance.CurrentUIApplication.ActiveUIDocument

TransactionManager.Instance.EnsureInTransaction(doc)

for _ in circuit:
	_.SelectPanel(panel)

TransactionManager.Instance.TransactionTaskDone()

#Assign your output to the OUT variable.
OUT = []
OUT = circuit, panel
# ----------------------------------------

# group: FIND AND REPLACE CIRCUIT NAME
string_14 = StringInput("1")  # graph input
string_15 = StringInput("2")  # graph input
replace_3 = String.Replace(str=getParameterValueByName_6, searchFor=string_14, replaceWith=string_15)
