# Dynamo graph Play Despacito.dyn (Dynamo 2.1.0.7500)

# group: DYNaMO PLAYS DEPACITO
python_script = Python()  # unwired: IN[0]
# ---------- python_script.python (13 lines) ----------
import clr
clr.AddReference('ProtoGeometry')
from Autodesk.DesignScript.Geometry import *

import sys
pyt_path = r'C:\Program Files (x86)\IronPython 2.7\Lib'
sys.path.append(pyt_path)
import System

import os

#Assign your output to the OUT variable.
OUT = os.startfile(r"N:\aaProject Delivery\07-CAD Manual\07.4-Libraries\Dynamo\Electrical\DynamoPlayDespacito\Despacito [8 Bit Tribute to Luis Fonsi & Daddy Yankee feat. Justin Bieber] - 8 Bit Universe.mp3")
# ----------------------------------------
