# Dynamo graph Select Lights with Parameter.dyn (Dynamo 1.3.2.2480)

# group: Collect all Lighting Fixtures
categories = Categories("LightingFixtures")
all_elements_of_category = ElementsOfCategory(categories)

select_phase = RevitPhases("fb offices")
byPhaseCreated = Revit.ElementFilter.ByPhaseCreated(all_elements_of_category, select_phase)

# group: PARAMTER FILTER
code_block = CodeBlock { "Emergency Lighting"; }
getParameterValueByName = Element.GetParameterValueByName(element=byPhaseCreated, parameterName=code_block)
code_block_2 = CodeBlock { 1; }
eq = getParameterValueByName == code_block_2
filterByBoolMask = List.FilterByBoolMask(list=byPhaseCreated, mask=eq)

# group: Filter by letter in Name
name = Element.Name(filterByBoolMask.in)
code_block_3 = CodeBlock { "LR1"; }
contains = String.Contains(str=name, searchFor=code_block_3)
filterByBoolMask_2 = List.FilterByBoolMask(list=filterByBoolMask.in, mask=contains)
eq_2 = name == code_block_3

watch = Watch(filterByBoolMask_2.in)
setRevitSelection = Custom[RIE.SetRevitSelection](Elements=watch)  # Input elements to select in Revit model
id = Element.Id()  # unwired: arg0

# group: Group the lights by the element ids (this is for when something is tagged multiple times or in multiple views)
groupByKey = List.GroupByKey(list=watch, keys=id)

# group: Dictionaries provide a way to look stuff up by a given key
code_block_4 = CodeBlock(taggedElement=groupByKey.groups, tag=groupByKey.unique_keys)
# ---------- code_block_4.designscript (4 lines) ----------
//declare a new dictionary to store this in
tagDictionary = {};
//dictionary[whatToLookUpBy] = tagElement
tagDictionary[taggedElement] = tag;
# ----------------------------------------

select_model_elements = DSModelElementsSelection()  # 57 picked in the model

# group: Sample element selected manually
id_2 = Element.Id(select_model_elements)

# group: Retrieve the Lighting Fixtures for the given element from the dictionary
code_block_5 = CodeBlock(tagDictionary=code_block_4.tagDictionary, taggedElement=id_2) { tagDictionary[taggedElement]; }

clean = List.Clean(list=code_block_5@L1)
flatten = Flatten(clean)
python_script = Python(IN[0]=flatten)
# ---------- python_script.python (44 lines) ----------
# Copyright(c) 2017, Dimitar Venkov
# @5devene, dimitar.ven@gmail.com
# www.badmonkeys.net

import clr
import System

clr.AddReference("RevitNodes")
import Revit
clr.ImportExtensions(Revit.Elements)
clr.ImportExtensions(Revit.GeometryConversion)

clr.AddReference('RevitServices')
from RevitServices.Persistence import DocumentManager
from RevitServices.Transactions import TransactionManager
doc = DocumentManager.Instance.CurrentDBDocument

clr.AddReference('System')
from System.Collections.Generic import List

clr.AddReference("RevitAPI")
from Autodesk.Revit.DB import *

def tolist(obj1):
	if hasattr(obj1,"__iter__"): return obj1
	else: return [obj1]

doc = DocumentManager.Instance.CurrentDBDocument
uiapp = DocumentManager.Instance.CurrentUIApplication
app = uiapp.Application
uidoc=DocumentManager.Instance.CurrentUIApplication.ActiveUIDocument

eleId=[]

for i in UnwrapElement(IN[0]):
	eleId.append(i.Id)
	
elemIds = List[ElementId](eleId)

try:
	uidoc.Selection.SetElementIds(elemIds)
	OUT = IN[0]
except:
	OUT = "Failed to set selection"
# ----------------------------------------

# group: Collect all Lighting Fixtures
categories_2 = Categories("LightingFixtures")
all_elements_of_category_2 = ElementsOfCategory(categories_2)

select_phase_2 = RevitPhases("Existing")
