# Dynamo graph 1.3.1 LinkedMechToElec2.0.dyn (Dynamo 1.3.2.2480)

file_path = Filename("C:\Users\dcleary\Desktop\Copy of Equipment CheckNew.xlsm")

# group: GET MECHANICAL CONNECTIONS
family_types = FamilyTypes("ID MECH CONNECTION:MECHANICAL CONNECTION")
all_elements_of_family_type = ElementsOfFamilyType(family_types)
string = StringInput("EQUIPMENT NAME_IDG")
getParameterValueByName = Element.GetParameterValueByName(element=all_elements_of_family_type, parameterName=string)
groupByKey = List.GroupByKey(list=all_elements_of_family_type, keys=getParameterValueByName)
number = DoubleInput(1)
flatten = List.Flatten(list=groupByKey.groups, amt=number)
getParameterValueByName_2 = Element.GetParameterValueByName(element=flatten, parameterName=string)
duplicateItemIndicies = archilab.Lists.Lists.DuplicateItemIndicies(getParameterValueByName_2)
removeItemAtIndex = List.RemoveItemAtIndex(list=getParameterValueByName_2, indices=duplicateItemIndicies.out1)
removeItemAtIndex_2 = List.RemoveItemAtIndex(list=flatten, indices=duplicateItemIndicies.out1)
countOccurences = Custom[List.CountOccurences](seq=getParameterValueByName_2)  # Counts the number of occurences of each unique element in a given list
removeItemAtIndex_3 = List.RemoveItemAtIndex(list=getParameterValueByName_2, indices=duplicateItemIndicies.out0)
eq = countOccurences.uniqueElements == removeItemAtIndex_3
code_block = CodeBlock {  }

# group: GET MECHANICAL EQUIPMENT
get_documents = Custom[Get Documents]()  # Queries all linked Revit files and retrieves their Name, LinkInstance and Document properties.
categories = Categories("MechanicalEquipment")
linkedInstanceElements = Custom[Springs.Collector.LinkedInstanceElements](linkInstance=get_documents.Link_Instance, category=categories)  # Extract elements by category from the selected linked instances. The transform CS can be used to get the exact location of the elements in the host file. If an error occurs or the linked document is unloaded, an error will be returned in the elements output and the appropriate transform will be a null. You can use those nulls to filter out the errors.
number_2 = DoubleInput(1)
flatten_2 = List.Flatten(list=linkedInstanceElements.elements, amt=number_2)
string_2 = StringInput("Number")
getParameterValueByName_3 = Element.GetParameterValueByName(element=flatten_2, parameterName=string_2)
setIntersection = SetIntersection(getParameterValueByName_3, removeItemAtIndex)
containsItem = List.ContainsItem(list=setIntersection, item=getParameterValueByName_3)
filterByBoolMask = List.FilterByBoolMask(list=getParameterValueByName_3, mask=containsItem)
filterByBoolMask_2 = List.FilterByBoolMask(list=flatten_2, mask=containsItem)
join = List.Join(filterByBoolMask_2.in, filterByBoolMask_2.out)

watch = Watch(join)
watch_2 = Watch(removeItemAtIndex_2)

# group: GET MECHANICAL VOLTS ALSO SET VOLTAGE TO CORRESPONDING UNPOWERED ELECTRICAL CONNECTION
type = archilab.Revit.Elements.WarningElement.Type(watch)
string_3 = StringInput("Volts")
getParameterValueByName_4 = Element.GetParameterValueByName(element=type, parameterName=string_3)
getParameterValueByName_5 = Element.GetParameterValueByName(element=watch, parameterName=string_3)
code_block_2 = CodeBlock(a=getParameterValueByName_4, b=getParameterValueByName_5) { a+b; }
toNumber = String.ToNumber(code_block_2)
number_3 = DoubleInput(0)
replaceNull = Custom[List.ReplaceNull](seq=toNumber, replacement=number_3)  # Replaces all null values within a given list with a substitute
number_4 = DoubleInput(0.0929)
code_block_3 = CodeBlock(x=replaceNull, y=number_4) { x*y; }
round = Math.Round(code_block_3)
string_4 = StringInput("Volts")
setParameterByName = Element.SetParameterByName(element=watch_2, parameterName=string_4, value=replaceNull)

# group: GET MECHANICAL PHASE ALSO SET PHASE TO CORRESPONDING UNPOWERED ELECTRICAL CONNECTION
string_5 = StringInput("Phase")
getParameterValueByName_6 = Element.GetParameterValueByName(element=type, parameterName=string_5)
getParameterValueByName_7 = Element.GetParameterValueByName(element=watch, parameterName=string_5)
code_block_4 = CodeBlock(a=getParameterValueByName_6, b=getParameterValueByName_7) { a+b; }
toNumber_2 = String.ToNumber(code_block_4)
number_5 = DoubleInput(0)
replaceNull_2 = Custom[List.ReplaceNull](seq=toNumber_2, replacement=number_5)
string_6 = StringInput("Number of Poles")
setParameterByName_2 = Element.SetParameterByName(element=watch_2, parameterName=string_6, value=replaceNull_2)

# group: WRITE MECHANICAL PARAMETERS TO EXCEL
string_7 = StringInput("Mech Data")
code_block_5 = CodeBlock { 0; true; }
code_block_6 = CodeBlock { "Mech Equip"; "Mech Poles"; "Mech Volts"; "Duplicates"; }
create = List.Create(code_block_6.out0, code_block_6.out1, code_block_6.out2, code_block_6.out3)
join_2 = List.Join(filterByBoolMask.in, filterByBoolMask.out)
create_2 = List.Create(join_2, replaceNull_2, round)
transpose = List.Transpose(create_2)
addItemToFront = List.AddItemToFront(item=create, list=transpose)
writeToFile = Excel.WriteToFile(filePath=file_path, sheetName=string_7, startRow=code_block_5.out0, startCol=code_block_5.out0, data=addItemToFront, overWrite=code_block_5.out1)

# group: GET ELECTRICAL PARAMETERS
string_8 = StringInput("Volts")
lunchbox_get_parameter_value = Custom[LunchBox Get Parameter Value](Element=watch_2, ParamName=string_8)  # Gets parameter values from a Revit element.
string_9 = StringInput("Number of Poles")
getParameterValueByName_8 = Element.GetParameterValueByName(element=watch_2, parameterName=string_9)
getParameterValueByName_9 = Element.GetParameterValueByName(element=watch_2, parameterName=string_8)
number_6 = DoubleInput(0.0929)
code_block_7 = CodeBlock(x=getParameterValueByName_9, y=number_6) { x*y; }
round_2 = Math.Round(code_block_7)
string_10 = StringInput("Panel")
lunchbox_get_parameter_value_2 = Custom[LunchBox Get Parameter Value](Element=watch_2, ParamName=string_10)
string_11 = StringInput("Circuit Number")
lunchbox_get_parameter_value_3 = Custom[LunchBox Get Parameter Value](Element=watch_2, ParamName=string_11)
code_block_8 = CodeBlock(a=lunchbox_get_parameter_value_2, b=lunchbox_get_parameter_value_3) { a+" - "+b; }

# group: WRITE ELECTRICAL PARAMETERS TO EXCEL
string_12 = StringInput("Elec Data")
code_block_9 = CodeBlock { 0; true; }
code_block_10 = CodeBlock { "Elec Equip"; "Elec Poles"; "Elec Volts"; "Circuit Panel"; "Duplicates"; }
create_3 = List.Create(code_block_10.out0, code_block_10.out1, code_block_10.out2, code_block_10.out3, code_block_10.out4)
create_4 = List.Create(removeItemAtIndex, getParameterValueByName_8, round_2, code_block_8, countOccurences.count)
transpose_2 = List.Transpose(create_4)
addItemToFront_2 = List.AddItemToFront(item=create_3, list=transpose_2)
writeToFile_2 = Excel.WriteToFile(filePath=file_path, sheetName=string_12, startRow=code_block_9.out0, startCol=code_block_9.out0, data=addItemToFront_2, overWrite=code_block_9.out1)
