# Dynamo graph 1.3.2 Mechanical Schedule IMPORT FROM EXCEL.dyn (Dynamo 1.3.2.2480)

code_block = CodeBlock { t9 = List.Join({"PHASE BY SUITE", "EQUIPMENT NAME_IDG", "Location", "Apparent Load", "Number of Poles", "Volts", "Circuit Number", "FEEDER SIZE"}); }
parameters = Element.Parameters()  # unwired: arg0
storageType = Parameter.StorageType(parameters)
file_path = Filename(".\224 MECH LINK.xlsx")
fromPath = FileObject(file_path)  # "File.FromPath"
code_block_2 = CodeBlock { "Sheet1"; }
readFromFile = Excel.ReadFromFile(file=fromPath, sheetName=code_block_2)
restOfItems = List.RestOfItems(readFromFile)
code_block_3 = CodeBlock { 44; }
getItemAtIndex = List.GetItemAtIndex(list=restOfItems@L2, index=code_block_3)
string_from_object = FromObject(getItemAtIndex)
code_block_4 = CodeBlock { 0; }
code_block_5 = CodeBlock { 7; }
substring = String.Substring(str=string_from_object, startIndex=code_block_4, length=code_block_5)
byElementId = archilab.Revit.Selection.Select.ByElementId(substring)
code_block_6 = CodeBlock { 1; }
chop = List.Chop(list=byElementId, lengths=code_block_6)
setParameterByName = Element.SetParameterByName(element=chop)  # unwired: parameterName, value
code_block_7 = CodeBlock { 44; }
takeItems = List.TakeItems(list=readFromFile@L2, amount=code_block_7)
code_block_8 = CodeBlock { 0; }
getItemAtIndex_2 = List.GetItemAtIndex(list=takeItems, index=code_block_8)
restOfItems_2 = List.RestOfItems(takeItems)
combine = List.Combine(setParameterByName, getItemAtIndex_2, restOfItems_2)
setParameterSetValueString = Custom[SetParameterSetValueString](Elements=chop)  # Sets the parameters by strings. Useful for setting numerical values that are affected by Revit's internal unit conversion. Does not work for parameters that are stored as elementId; unwired: ParameterName, Values
string_from_object_2 = FromObject(restOfItems_2)
combine_2 = List.Combine(setParameterSetValueString, getItemAtIndex_2, string_from_object_2)
code_block_9 = CodeBlock { 4; }
getItemAtIndex_3 = List.GetItemAtIndex(list=getItemAtIndex_2, index=code_block_9)
getItemAtIndex_4 = List.GetItemAtIndex(list=string_from_object_2, index=code_block_9)
setParameterByName_2 = Element.SetParameterByName(parameterName=getItemAtIndex_3, value=getItemAtIndex_4)  # unwired: element
code_block_10 = CodeBlock { 1; }
getItemAtIndex_5 = List.GetItemAtIndex(list=chop@L2, index=code_block_10@L1)
parameters_2 = Element.Parameters(getItemAtIndex_5)
string_from_object_3 = FromObject(parameters_2)
code_block_11 = CodeBlock { ":"; }
split = String.Split(string_from_object_3, code_block_11)
code_block_12 = CodeBlock { 0; }
getItemAtIndex_6 = List.GetItemAtIndex(list=split@L2, index=code_block_12)
trimWhitespace = String.TrimWhitespace(getItemAtIndex_6)
getParameterValueByName = Element.GetParameterValueByName(parameterName=trimWhitespace)  # unwired: element
map = List.Map(list=getItemAtIndex_5, f_x=getParameterValueByName)
