# Dynamo graph 1.3.2 Mechanical Schedule.dyn (Dynamo 1.3.2.2480)

setParameterByName = Element.SetParameterByName()  # unwired: element, parameterName, value
file_path = Filename(".\224 MECH LINK.xlsx")
code_block = CodeBlock { "Sheet1"; }
code_block_2 = CodeBlock { 0; }
family_types = FamilyTypes("ID MECH CONNECTION:MECHANICAL CONNECTION (120V)")
family_types_2 = FamilyTypes("ID MECH CONNECTION:MECHANICAL CONNECTION (208V)")
family_types_3 = FamilyTypes("ID MECH CONNECTION:MECHANICAL CONNECTION (480V)")
join = List.Join(family_types, family_types_2, family_types_3)
all_elements_of_family_type = ElementsOfFamilyType(join)
code_block_3 = CodeBlock { 1; }
getItemAtIndex = List.GetItemAtIndex(list=all_elements_of_family_type@L2, index=code_block_3@L1)
parameters = Element.Parameters(getItemAtIndex)
string_from_object = FromObject(parameters)
code_block_4 = CodeBlock { "ElementId"; }
storageType = Parameter.StorageType(parameters)
ne = code_block_4 != storageType
filterByBoolMask = List.FilterByBoolMask(list=string_from_object, mask=ne)
code_block_5 = CodeBlock { ":"; }
split = String.Split(filterByBoolMask.in@L2, code_block_5)
code_block_6 = CodeBlock { 0; }
getItemAtIndex_2 = List.GetItemAtIndex(list=split@L2, index=code_block_6)
trimWhitespace = String.TrimWhitespace(getItemAtIndex_2)
addItemToEnd = List.AddItemToEnd()  # unwired: item, list
select_phase = RevitPhases("Suite 224")
byPhaseCreated = Revit.ElementFilter.ByPhaseCreated(all_elements_of_family_type@L2, select_phase)
flatten = Flatten(byPhaseCreated)
id = Element.Id(flatten@L2)
getParameterValueByName = Element.GetParameterValueByName(parameterName=trimWhitespace)  # unwired: element
map = List.Map(list=flatten, f_x=getParameterValueByName)
combine = List.Combine(addItemToEnd, id, map)
addItemToFront = List.AddItemToFront(item=trimWhitespace, list=combine)
boolean = BoolSelector(true)
writeToFile = Excel.WriteToFile(filePath=file_path, sheetName=code_block, startRow=code_block_2, startCol=code_block_2, data=addItemToFront, overWrite=boolean)
code_block_7 = CodeBlock { t9 = List.Join({"PHASE BY SUITE", "EQUIPMENT NAME_IDG", "location", "Apparent Load", "Number of Poles", "Volts", "Circuit Number", "FEEDER SIZE"}); }
getParameterValueByName_2 = Element.GetParameterValueByName(parameterName=trimWhitespace)  # unwired: element
map_2 = List.Map(list=getItemAtIndex, f_x=getParameterValueByName_2)
code_block_8 = CodeBlock(t4=storageType) { t3 = "String" == t4@-1<1>; t5 = "Integer" == t4@-1<1>; t7 = "Double" == t4@-1<1>; t6 = t3 || t5 || t7; }
