# Dynamo graph 2.0 Mech Connection Parameters.dyn "Mech Connection Parameters" (Dynamo 2.0.1.5055)

categories = Categories(index=423)
all_elements_of_category = ElementsOfCategory(Category=categories)
code_block = CodeBlock { 176; }
getItemAtIndex = List.GetItemAtIndex(list=all_elements_of_category, index=code_block)
getData = Revit.Schedule.GetData(scheduleView=getItemAtIndex)
get_family_parameter = FamilyInstanceParameters()  # nothing selected; unwired: f
parameters = Element.Parameters(element=getItemAtIndex)
code_block_2 = CodeBlock { 1; }
getDataRows = Revit.Schedule.GetDataRows(rowIndex=code_block_2)  # unwired: scheduleView
getParameterUnitValue = Custom[Springs.Element.GetParameterUnitValue]()  # Converts from internal units to the currently set Revit display units. Useful only for parameters with numeric values. If no Value is found, will return a blank string.; unwired: element, paramName
family_types = FamilyTypes(index=206)
get_family_parameter_2 = FamilyInstanceParameters(f=family_types)  # nothing selected
file_path = Filename("C:\Users\dcleary\Desktop\MECHANICAL CONNECTIONS SCHEDULE.xlsx")
file_from_path = FileObject(path=file_path)
code_block_3 = CodeBlock { "Sheet1"; }
boolean = BoolSelector(false)
importExcel = Data.ImportExcel(file=file_from_path, sheetName=code_block_3, readAsStrings=boolean)
code_block_4 = CodeBlock { 44; }
getItemAtIndex_2 = List.GetItemAtIndex(list=importExcel@L2, index=code_block_4)
selectElementById = Custom[RIE.SelectElementById](ElementIds_Ints=getItemAtIndex_2)  # Forked from Clockwork
code_block_5 = CodeBlock { 0; }
getItemAtIndex_3 = List.GetItemAtIndex(list=importExcel, index=code_block_5)
setParameterByName = Element.SetParameterByName(element=selectElementById.Elements, parameterName=getItemAtIndex_3)  # unwired: value
code_block_6 = CodeBlock { 0; }
all_elements_of_family_type = ElementsOfFamilyType(Family_Type=family_types)
code_block_7 = CodeBlock { 0; }
getItemAtIndex_4 = List.GetItemAtIndex(list=all_elements_of_family_type, index=code_block_7)
parameters_2 = Element.Parameters(element=getItemAtIndex_4)
string_from_object = FromObject(obj=parameters_2)
code_block_8 = CodeBlock { 0; }
code_block_9 = CodeBlock { ":"; }
indexOf = String.IndexOf(str=string_from_object, searchFor=code_block_9)
substring = String.Substring(str=string_from_object, startIndex=code_block_8, length=indexOf)
trimTrailingWhitespace = String.TrimTrailingWhitespace(str=substring)
addItemToEnd = List.AddItemToEnd()  # unwired: item, list
family_types_2 = FamilyTypes(index=207)
all_elements_of_family_type_2 = ElementsOfFamilyType(Family_Type=family_types_2)
family_types_3 = FamilyTypes(index=208)
all_elements_of_family_type_3 = ElementsOfFamilyType(Family_Type=family_types_3)
join = List.Join(list0=all_elements_of_family_type, list1=all_elements_of_family_type_2, list2=all_elements_of_family_type_3)
id = Element.Id(element=join)
getParameterValueByName = Element.GetParameterValueByName(parameterName=trimTrailingWhitespace)  # unwired: element
map = List.Map(list=join, f_x=getParameterValueByName)
combine = List.Combine(comb=addItemToEnd, list1=id, list2=map)
addItemToFront = List.AddItemToFront(item=trimTrailingWhitespace, list=combine)
boolean_2 = BoolSelector(true)
exportExcel = Data.ExportExcel(filePath=file_path, sheetName=code_block_3, startRow=code_block_6, startCol=code_block_6, data=addItemToFront, overWrite=boolean_2)
code_block_10 = CodeBlock { 35; }
getItemAtIndex_5 = List.GetItemAtIndex(list=map@L2, index=code_block_10)
count = List.Count(list=trimTrailingWhitespace)
code_block_11 = CodeBlock { 44; }
getItemAtIndex_6 = List.GetItemAtIndex(list=combine@L2, index=code_block_11)
groupByKey = List.GroupByKey(list=join, keys=getItemAtIndex_6)
sortByKey = List.SortByKey(list=groupByKey.groups)  # unwired: keys
shuffle = List.Shuffle(list=groupByKey.unique_keys)
file_path_2 = Filename("C:\Users\dcleary\Desktop\MECHANICAL CONNECTIONS SCHEDULE.xlsx")
restOfItems = List.RestOfItems(list=importExcel)
code_block_12 = CodeBlock { 44; }
removeItemAtIndex = List.RemoveItemAtIndex(list=restOfItems@L2, indices=code_block_12)
