# Dynamo graph Family Parameters.dyn (Dynamo 1.3.2.2480)

python_script = Python()  # unwired: IN[0], IN[1]
# ---------- python_script.python (34 lines) ----------
import clr
clr.AddReference('RevitServices')
from RevitServices.Persistence import DocumentManager
from RevitServices.Transactions import TransactionManager
clr.AddReference('RevitAPI')
from Autodesk.Revit.DB import * 
doc = DocumentManager.Instance.CurrentDBDocument

def tolist(obj):
	if isinstance(obj, list):
		return obj
	else:
		return [obj]


elems = tolist(UnwrapElement(IN[0]))
bools = tolist(IN[1])

out = []

for elem, b in zip(elems, bools):
	TransactionManager.Instance.EnsureInTransaction(doc)
	try:
		fev = FamilyElementVisibility(FamilyElementVisibilityType.Model)
		fev.IsShownInFine = b
		elem.SetVisibility(fev)
	except:
		fev = FamilyElementVisibility(FamilyElementVisibilityType.ViewSpecific)
		fev.IsShownInFine = b
		elem.SetVisibility(fev)
	TransactionManager.Instance.TransactionTaskDone()
	out.append(True)

OUT = out
# ----------------------------------------
select_model_elements = DSModelElementsSelection()
boolean = BoolSelector(true)
family_types = FamilyTypes()
family = FamilyType.Family(family_types)
python_script_2 = Python(IN[0]=family)
# ---------- python_script_2.python (38 lines) ----------
import clr
clr.AddReference('RevitServices')
from RevitServices.Persistence import DocumentManager
from RevitServices.Transactions import TransactionManager
clr.AddReference('RevitAPI')
from Autodesk.Revit.DB import * 
doc = DocumentManager.Instance.CurrentDBDocument

def tolist(obj):
	if isinstance(obj, list):
		return obj
	else:
		return [obj]


famJam = UnwrapElement(IN[0])
paramJam = []


FamilyMan = doc.FamilyManager
types = FamilyMan.Types
typenames = []

TransactionManager.Instance.EnsureInTransaction(doc)
for param in FamilyMan.Parameters:
	paramIsShared = param.IsShared
	paramDef = param.Definition
	if param is paramIsShared:

		FamilyMan.ReplaceParameter(param, paramDef, BuiltInParameterGroup.PG_IFC, param.IsInstance)
	else:
		null
	
	
TransactionManager.Instance.TransactionTaskDone()
	
	
OUT = param
# ----------------------------------------
renameParameter = Custom[FamilyManager.RenameParameter]()  # Searches every family parameter for the given (sub)string and replaces that the (sub)string with the replace string; unwired: Search, Replace
