# Dynamo graph Family Visibilty.dyn (Dynamo 2.0.2.6826)

select_model_element = DSModelElementSelection()  # nothing selected; graph input
boolean = BoolSelector(false)  # graph input
python_script = Python(IN[0]=select_model_element, IN[1]=boolean)
# ---------- python_script.python (34 lines) ----------
import clr
clr.AddReference('RevitServices')
from RevitServices.Persistence import DocumentManager
from RevitServices.Transactions import TransactionManager
clr.AddReference('RevitAPI')
from Autodesk.Revit.DB import * 
doc = DocumentManager.Instance.CurrentDBDocument

def tolist(obj):
	if isinstance(obj, list):
		return obj
	else:
		return [obj]


elems = tolist(UnwrapElement(IN[0]))
bools = tolist(IN[1])

out = []

for elem, b in zip(elems, bools):
	TransactionManager.Instance.EnsureInTransaction(doc)
	try:
		fev = FamilyElementVisibility(FamilyElementVisibilityType.Model)
		fev.IsShownInFine = b
		elem.SetVisibility(fev)
	except:
		fev = FamilyElementVisibility(FamilyElementVisibilityType.ViewSpecific)
		fev.IsShownInFine = b
		elem.SetVisibility(fev)
	TransactionManager.Instance.TransactionTaskDone()
	out.append(True)

OUT = out
# ----------------------------------------
