# Dynamo graph ElementToElementCopyPasteParameters.dyn (Dynamo 1.3.2.2480)

# group: PASTE EQUIPMENT PARAMETERS
select_model_element = DSModelElementSelection()  # 1 picked in the model

code_block = CodeBlock { "Width"; }

# group: ORIGIN EQUIPMENT PARAMETERS
select_model_element_2 = DSModelElementSelection()  # 1 picked in the model

getParameterValueByName = Element.GetParameterValueByName(element=select_model_element_2, parameterName=code_block)
setParameterByName = Element.SetParameterByName(element=select_model_element, parameterName=code_block, value=getParameterValueByName)
code_block_2 = CodeBlock { "Height"; }
getParameterValueByName_2 = Element.GetParameterValueByName(element=select_model_element_2, parameterName=code_block_2)
setParameterByName_2 = Element.SetParameterByName(element=select_model_element, parameterName=code_block_2, value=getParameterValueByName_2)
code_block_3 = CodeBlock { "Depth"; }
getParameterValueByName_3 = Element.GetParameterValueByName(element=select_model_element_2, parameterName=code_block_3)
setParameterByName_3 = Element.SetParameterByName(element=select_model_element, parameterName=code_block_3, value=getParameterValueByName_3)
