# Dynamo graph FindAndReplace (Sheet Names).dyn (Dynamo 1.3.2.2480)

element_types = ElementTypes("ViewSheet")
all_elements_of_type = ElementsOfType(element_types)

# group: FILTER FOR THIS NAME
code_block = CodeBlock { "M106"; }

code_block_2 = CodeBlock { "PHASE BY SUITE"; }
getParameterValueByName = Element.GetParameterValueByName(element=all_elements_of_type, parameterName=code_block_2)
eq = code_block == getParameterValueByName
filterByBoolMask = List.FilterByBoolMask(list=all_elements_of_type, mask=eq)
code_block_3 = CodeBlock { "Sheet Number"; }
getParameterValueByName_2 = Element.GetParameterValueByName(element=filterByBoolMask.in, parameterName=code_block_3)
code_block_4 = CodeBlock { "‏‏E"; }
contains = String.Contains(str=getParameterValueByName_2, searchFor=code_block_4)
filterByBoolMask_2 = List.FilterByBoolMask(list=filterByBoolMask.in, mask=contains)
watch = Watch(filterByBoolMask_2.in)
code_block_5 = CodeBlock { "Sheet Number"; }
code_block_6 = CodeBlock { ""; }
replace = String.Replace(str=getParameterValueByName_2, searchFor=code_block_4, replaceWith=code_block_6)
filterByBoolMask_3 = List.FilterByBoolMask(list=replace, mask=contains)
watch_2 = Watch(filterByBoolMask_3.in)
setParameterByName = Element.SetParameterByName(element=watch, parameterName=code_block_5, value=watch_2)
