# Dynamo graph FindAndReplace (Sheet Types).dyn (Dynamo 1.3.2.2480)

element_types = ElementTypes("ViewSheet")
all_elements_of_type = ElementsOfType(element_types)
code_block = CodeBlock { "Sheet Number"; }
getParameterValueByName = Element.GetParameterValueByName(element=all_elements_of_type, parameterName=code_block)
code_block_2 = CodeBlock { "242 - ‏"; }
contains = String.Contains(str=getParameterValueByName, searchFor=code_block_2)
filterByBoolMask = List.FilterByBoolMask(list=all_elements_of_type, mask=contains)
watch = Watch(filterByBoolMask.in)
code_block_3 = CodeBlock { "Sheet Number"; }
code_block_4 = CodeBlock { "‏‭"; }
replace = String.Replace(str=getParameterValueByName, searchFor=code_block_2, replaceWith=code_block_4)
filterByBoolMask_2 = List.FilterByBoolMask(list=replace, mask=contains)
watch_2 = Watch(filterByBoolMask_2.in)
setParameterByName = Element.SetParameterByName(element=watch, parameterName=code_block_3, value=watch_2)
