# Dynamo graph FindAndReplace (View Names).dyn (Dynamo 1.3.2.2480)

element_types = ElementTypes("View")
all_elements_of_type = ElementsOfType(element_types)
code_block = CodeBlock { "View Name"; }
getParameterValueByName = Element.GetParameterValueByName(element=all_elements_of_type, parameterName=code_block)

# group: Find
code_block_2 = CodeBlock { "M100"; }

contains = String.Contains(str=getParameterValueByName, searchFor=code_block_2)
filterByBoolMask = List.FilterByBoolMask(list=all_elements_of_type, mask=contains)
watch = Watch(filterByBoolMask.in)
code_block_3 = CodeBlock { "View Name"; }

# group: Replace
code_block_4 = CodeBlock { "M106"; }

replace = String.Replace(str=getParameterValueByName, searchFor=code_block_2, replaceWith=code_block_4)
filterByBoolMask_2 = List.FilterByBoolMask(list=replace, mask=contains)
watch_2 = Watch(filterByBoolMask_2.in)
setParameterByName = Element.SetParameterByName(element=watch, parameterName=code_block_3, value=watch_2)
code_block_5 = CodeBlock { "PHASE BY SUITE"; }

# group: Set PHASE BY SUITE
code_block_6 = CodeBlock { "M106"; }

setParameterByName_2 = Element.SetParameterByName(element=watch, parameterName=code_block_5, value=code_block_6)
