# Dynamo graph FindAndReplaceParameters (SUBSTRING)  - SelectElements.dyn (Dynamo 1.3.2.2480)

# group: Select Category
categories = Categories("ElectricalEquipment")
all_elements_of_category = ElementsOfCategory(categories)

id = Element.Id(all_elements_of_category)

# group: Group the tags by the element ids (this is for when something is tagged multiple times or in multiple views)
groupByKey = List.GroupByKey(list=all_elements_of_category, keys=id)

# group: Dictionaries provide a way to look stuff up by a given key
code_block = CodeBlock(taggedElement=groupByKey.groups, tag=groupByKey.unique_keys)
# ---------- code_block.designscript (4 lines) ----------
//declare a new dictionary to store this in
tagDictionary = {};
//dictionary[whatToLookUpBy] = tagElement
tagDictionary[taggedElement] = tag;
# ----------------------------------------

select_model_elements = DSModelElementsSelection()  # 148 picked in the model

# group: Sample element selected manually to get the tags for
id_2 = Element.Id(select_model_elements)

# group: Retrieve the related tags for the given element from the dictionary
code_block_2 = CodeBlock(tagDictionary=code_block.tagDictionary, taggedElement=id_2) { tagDictionary[taggedElement]; }

clean = List.Clean(list=code_block_2@L1)
flatten = Flatten(clean)

# group: Select Phase of Elements
select_phase = RevitPhases("Existing")

byPhaseCreated = Revit.ElementFilter.ByPhaseCreated(flatten, select_phase)

# group: Type in Parameter Name
string = StringInput("Panel Name")

watch = Watch(string)
getParameterValueByName = Element.GetParameterValueByName(element=byPhaseCreated, parameterName=watch)
code_block_3 = CodeBlock { " "; }
contains = String.Contains(str=getParameterValueByName, searchFor=code_block_3)
filterByBoolMask = List.FilterByBoolMask(list=byPhaseCreated, mask=contains)
getParameterValueByName_2 = Element.GetParameterValueByName(element=filterByBoolMask.in, parameterName=watch)
code_block_4 = CodeBlock { 13; }
code_block_5 = CodeBlock { -3; }
remove = String.Remove(str=getParameterValueByName_2, startIndex=code_block_4, count=code_block_5)
setParameterByName = Element.SetParameterByName(element=filterByBoolMask.in, parameterName=watch, value=remove)
string_2 = StringInput("PHASE BY SUITE")
string_3 = StringInput("Location")
