# Dynamo graph FindAndReplaceParameters.dyn (Dynamo 2.0.2.6826)

# group: Select Category
categories = Categories(index=185)  # graph input
all_elements_of_category = ElementsOfCategory(Category=categories)

string = StringInput("Panel Name")  # graph input
getParameterValueByName = Element.GetParameterValueByName(element=all_elements_of_category, parameterName=string)
code_block = CodeBlock { "L224"; }
contains = String.Contains(str=getParameterValueByName, searchFor=code_block)
filterByBoolMask = List.FilterByBoolMask(list=all_elements_of_category, mask=contains)
flatten = List.Flatten(list=filterByBoolMask.in)
id = Element.Id(element=flatten)

# group: Group the tags by the element ids (this is for when something is tagged multiple times or in multiple views)
groupByKey = List.GroupByKey(list=flatten, keys=id)

# group: Dictionaries provide a way to look stuff up by a given key
code_block_2 = CodeBlock(tag=groupByKey.groups, taggedElement=groupByKey.unique_keys)
# ---------- code_block_2.designscript (4 lines) ----------
//declare a new dictionary to store this in
tagDictionary = [];
//dictionary[whatToLookUpBy] = tagElement
tagDictionary[taggedElement] = tag;
# ----------------------------------------

select_model_elements = DSModelElementsSelection()  # 32 picked in the model; graph input

# group: Sample element selected manually to get the tags for
id_2 = Element.Id(element=select_model_elements)

# group: Retrieve the related tags for the given element from the dictionary
code_block_3 = CodeBlock(tagDictionary=code_block_2.tagDictionary, taggedElement=id_2) { tagDictionary[taggedElement]; }

clean = List.Clean(list=code_block_3@L1)
flatten_2 = List.Flatten(list=clean)

# group: Select Phase of Elements
select_phase = RevitPhases(index=12)  # graph input

byPhaseCreated = Revit.ElementFilter.ByPhaseCreated(element=flatten_2, phase=select_phase)

# group: Type in Parameter Name
string_2 = StringInput("Panel Name")  # graph input

watch = Watch(string_2)
getParameterValueByName_2 = Element.GetParameterValueByName(element=byPhaseCreated, parameterName=watch)
string_3 = StringInput("L224")  # graph input

# group: Find and Replace Node. Type in the Strings
string_4 = StringInput("L200")  # graph input
replace = String.Replace(str=getParameterValueByName_2, searchFor=string_3, replaceWith=string_4)

setParameterByName = Element.SetParameterByName(element=byPhaseCreated, parameterName=watch, value=replace)
string_5 = StringInput("PHASE BY SUITE")  # graph input

# group: Select an element of the category you would like to Find Replace
select_model_element = DSModelElementSelection()  # 1 picked in the model; graph input

getCategory = Element.GetCategory(element=select_model_element)
all_elements_of_category_2 = ElementsOfCategory(Category=getCategory)
string_6 = StringInput("Location")  # graph input
