# Dynamo graph FindPanelByName v2.0.dyn (Dynamo 2.0.1.5055)

code_block = CodeBlock { "Panel Name"; }
getParameterValueByName = Element.GetParameterValueByName(parameterName=code_block)  # unwired: element
code_block_2 = CodeBlock { "RLAB1"; }
eq = getParameterValueByName == code_block_2
filterByBoolMask = List.FilterByBoolMask(mask=eq)  # unwired: list
