# Dynamo graph FindPanelByNmae.dyn (Dynamo 2.0.1.5055)

categories = Categories(index=183)
all_elements_of_category = ElementsOfCategory(Category=categories)
code_block = CodeBlock { "Panel Name"; }
getParameterValueByName = Element.GetParameterValueByName(element=all_elements_of_category, parameterName=code_block)
code_block_2 = CodeBlock { "RLAB1"; }
eq = getParameterValueByName == code_block_2
filterByBoolMask = List.FilterByBoolMask(list=all_elements_of_category, mask=eq)
watch = Watch(filterByBoolMask.in)
