# Dynamo graph Get Elements In Room.dyn (Dynamo 2.1.0.7500)

select_model_element = DSModelElementSelection()  # nothing selected
categories = Categories("OST_Rooms")
all_elements_of_category = ElementsOfCategory(Category=categories)
code_block = CodeBlock { 61; }
getItemAtIndex = List.GetItemAtIndex(list=all_elements_of_category, index=code_block)
boundingBox = Element.BoundingBox(element=getItemAtIndex)
code_block_2 = CodeBlock { OnlyInside : bool = false; }
code_block_3 = CodeBlock { LinkOptional : var = null; }
linkDocFromLink = Custom[RIE.LinkDocFromLink](LinkInstance=code_block_3)  # Retrieves link Document element from link element.
python_script = Python(IN[0]=boundingBox, IN[1]=code_block_2, IN[2]=linkDocFromLink)
# ---------- python_script.python (44 lines) ----------
# RETRIEVED FROM EINAR RAKNES ON THE DYNAMOBIM.ORG FORUMS.

import clr
clr.AddReference('RevitAPI')
clr.AddReference('RevitNodes')
clr.AddReference('RevitServices')
import Revit
import RevitServices
from Autodesk.Revit.DB import *
from RevitServices.Persistence import DocumentManager
clr.ImportExtensions(Revit.Elements)
clr.ImportExtensions(Revit.GeometryConversion)

doc = DocumentManager.Instance.CurrentDBDocument

if IN[2] != None:
	doc = UnwrapElement(IN[2])

def tolist(obj):
	if isinstance(obj,list):
		return UnwrapElement(obj)
	else:
		return [UnwrapElement(obj)]

#Preparing input from dynamo to revit
bbs = tolist(IN[0])
OUT = []

for bbx in bbs:
	elems = []
	bb = bbx.ToRevitType()
	outline = Outline(bb.Min, bb.Max)
	#filter = BoundingBoxIntersectsFilter(outline)
	if IN[1] == False:
		filter = BoundingBoxIntersectsFilter(outline)
	else:
		filter = BoundingBoxIsInsideFilter(outline)
	
	collector = FilteredElementCollector(doc).WherePasses(filter).WhereElementIsNotElementType().WhereElementIsViewIndependent()
	
	elems = [e.ToDSType(True) for e in collector]
	OUT.append(elems)
if len(OUT) == 1:
	OUT = OUT[0]
# ----------------------------------------
code_block_4 = CodeBlock(Elements=python_script) { Elements; }
code_block_5 = CodeBlock { "Number"; }
parameterByName = Parameter.ParameterByName(element=all_elements_of_category, name=code_block_5)
code_block_6 = CodeBlock { "Number : L124-5"; }
eq = parameterByName == code_block_6
filterByBoolMask = List.FilterByBoolMask(list=all_elements_of_category, mask=eq)
boundingBox_2 = Element.BoundingBox(element=all_elements_of_category)
