# Dynamo graph (1.3.2) Hide elements on all views.dyn (Dynamo 1.3.2.2480)

unhideElements = Custom[View.UnhideElements]()  # This node will unhide specified elemeints in given views.; unwired: Element, View
view_type = ViewTypesUi("Schedule")
getByType = archilab.Revit.Views.View.GetByType(view_type)
code_block = CodeBlock { "View Name"; }
getParameterValueByName = Element.GetParameterValueByName(element=getByType, parameterName=code_block)
code_block_2 = CodeBlock { "View List"; }
eq = getParameterValueByName == code_block_2
filterByBoolMask = List.FilterByBoolMask(list=getByType, mask=eq)
view_type_2 = ViewTypesUi("FloorPlan")
getByType_2 = archilab.Revit.Views.View.GetByType(view_type_2)
code_block_3 = CodeBlock { 1; }
getItemAtIndex = List.GetItemAtIndex(list=getByType_2, index=code_block_3)
family_types = FamilyTypes("ID MECH CONNECTION:MECHANICAL CONNECTION (120V)")
all_elements_of_family_type = ElementsOfFamilyType(family_types)
family_types_2 = FamilyTypes("ID MECH CONNECTION:MECHANICAL CONNECTION (120V)")
all_elements_of_family_type_2 = ElementsOfFamilyType(family_types_2)
family_types_3 = FamilyTypes("ID MECH CONNECTION:MECHANICAL CONNECTION (120V)")
all_elements_of_family_type_3 = ElementsOfFamilyType(family_types_3)
join = List.Join(all_elements_of_family_type, all_elements_of_family_type_2, all_elements_of_family_type_3)
flatten = Flatten(join)
boolean = BoolSelector(true)
hideElements = Custom[View.HideElements](Element=all_elements_of_family_type, RunIt=boolean)  # This node will hide elements in specified view.; unwired: View
map = List.Map(list=getByType_2, f_x=hideElements)
addFilter = View.AddFilter()  # unwired: arg0, arg1
