# Dynamo graph CEILING LOCATIONS.dyn (Dynamo 1.3.2.2480)

get_documents = Custom[Get Documents]()  # Queries all linked Revit files and retrieves their Name, LinkInstance and Document properties.
categories = Categories("Ceilings")
linkedInstanceElements = Custom[Springs.Collector.LinkedInstanceElements](linkInstance=get_documents.Link_Instance, category=categories)  # Extract elements by category from the selected linked instances. The transform CS can be used to get the exact location of the elements in the host file. If an error occurs or the linked document is unloaded, an error will be returned in the elements output and the appropriate transform will be a null. You can use those nulls to filter out the errors.
flatten = Flatten(linkedInstanceElements.elements)
watch = Watch(flatten)
code_block = CodeBlock { 1; }
getItemAtIndex = List.GetItemAtIndex(list=watch, index=code_block)
geometry = Element.Geometry(getItemAtIndex)
getLocation = Element.GetLocation(getItemAtIndex)
location = Custom[Element.Location+](element=watch)  # Returns the location of an element as an XYZ (or if it's line-based the start and end point of the line), along with some booleans to help filtering the results. Use this for some element types (e.g. walls or lines) that do not work with the built-in Get Family Instance Location node.
watch_2 = Watch(location.curveEndpoints)
watch_3 = Watch(location.curves)
