# Dynamo graph (1.3.2) Circuit Lights (DLR L142).dyn (Dynamo 1.3.2.2480)

# group: Create new circuit on Panel and assign elementset to new circuit
python_script = Python()  # unwired: IN[0]
# ---------- python_script.python (57 lines) ----------
import clr
clr.AddReference('ProtoGeometry')
from Autodesk.DesignScript.Geometry import *

clr.AddReference('RevitServices')
import RevitServices
from RevitServices.Persistence import DocumentManager
from RevitServices.Transactions import TransactionManager
from System.Collections.Generic import *

clr.AddReference('RevitNodes')
import Revit
clr.ImportExtensions(Revit.Elements)

clr.AddReference('RevitAPI')
import Autodesk
from Autodesk.Revit.DB import *
from Autodesk.Revit.DB.Electrical import *
from Autodesk.Revit.DB import MEPSystem

clr.AddReference('DSCoreNodes')
import DSCore
from DSCore.List import *

import sys
pyt_path = r'C:\Program Files (x86)\IronPython 2.7\Lib'
sys.path.append(pyt_path)

# Import List ( ICollection(ElementId) = List[ElementId]() )
clr.AddReference("System")
from System.Collections.Generic import List 

#The inputs to this node will be stored as a list in the IN variables.
input = UnwrapElement(IN[0])

electComponents = List[ElementId]()


for i in input:
	electComponents.Add(i.Id)


doc = DocumentManager.Instance.CurrentDBDocument
uiapp = DocumentManager.Instance.CurrentUIApplication
app = uiapp.Application
uidoc = DocumentManager.Instance.CurrentUIApplication.ActiveUIDocument

TransactionManager.Instance.EnsureInTransaction(doc)

newcircuit = ElectricalSystem.Create(doc, electComponents, ElectricalSystemType.PowerCircuit)


OUT = []
OUT.append(newcircuit)


TransactionManager.Instance.TransactionTaskDone()
# ----------------------------------------

# group: Select panel. IN[0] = Electrical System IN[1] = Panel element
python_script_2 = Python(IN[0]=python_script)  # unwired: IN[1]
# ---------- python_script_2.python (51 lines) ----------
import clr
clr.AddReference('ProtoGeometry')
from Autodesk.DesignScript.Geometry import *

clr.AddReference('RevitServices')
import RevitServices
from RevitServices.Persistence import DocumentManager
from RevitServices.Transactions import TransactionManager
from System.Collections.Generic import *

clr.AddReference('RevitNodes')
import Revit
clr.ImportExtensions(Revit.Elements)

clr.AddReference('RevitAPI')
import Autodesk
from Autodesk.Revit.DB import *
from Autodesk.Revit.DB.Electrical import *
from Autodesk.Revit.DB import MEPSystem

clr.AddReference('DSCoreNodes')
import DSCore
from DSCore.List import *

import sys
pyt_path = r'C:\Program Files (x86)\IronPython 2.7\Lib'
sys.path.append(pyt_path)

# Import List ( ICollection(ElementId) = List[ElementId]() )
clr.AddReference("System")
from System.Collections.Generic import List 


circuit = UnwrapElement(IN[0])
panel = UnwrapElement(IN[1])

doc = DocumentManager.Instance.CurrentDBDocument
uiapp = DocumentManager.Instance.CurrentUIApplication
app = uiapp.Application
uidoc = DocumentManager.Instance.CurrentUIApplication.ActiveUIDocument

TransactionManager.Instance.EnsureInTransaction(doc)

for _ in circuit:
	_.SelectPanel(panel)

TransactionManager.Instance.TransactionTaskDone()

#Assign your output to the OUT variable.
OUT = []
OUT = circuit, panel
# ----------------------------------------

select_model_elements = DSModelElementsSelection()  # 84 picked in the model
code_block = CodeBlock { "L"; }

# group: # OF LIGHTS IN A ROW
code_block_2 = CodeBlock { 4; }

# group: GROUP LIGHTS INTO ROWS BASED ON LOCATION AND ROW/COLOUMN VALUES
categories = Categories("LightingFixtures")
byCategory = Revit.ElementFilter.ByCategory(select_model_elements, categories)

byNameBeginsWith = Revit.ElementFilter.ByNameBeginsWith(byCategory, code_block)

# group (continued): GROUP LIGHTS INTO ROWS BASED ON LOCATION AND ROW/COLOUMN VALUES
getLocation = Element.GetLocation(byNameBeginsWith)
Y = Point.Y(getLocation)
sortByKey = List.SortByKey(list=byNameBeginsWith, keys=Y)
chop = List.Chop(list=sortByKey.sorted_list, lengths=code_block_2)
getLocation_2 = Element.GetLocation(chop)
X = Point.X(getLocation_2)
sortByKey_2 = List.SortByKey(list=chop@@L2, keys=X@L2)

watch = Watch(sortByKey_2.sorted_list)

# group: # OF CIRCUITS
code_block_3 = CodeBlock { 3; }

# group: LIGHTING PATTERN
diagonalLeft = List.DiagonalLeft(watch, code_block_2)
code_block_4 = CodeBlock(A=code_block_3) { 0..(A-1); }
takeEveryNthItem = List.TakeEveryNthItem(diagonalLeft, code_block_3, code_block_4)

watch_2 = Watch(takeEveryNthItem)

# group: CHOOSE YOUR CHARACT... PANEL
select_model_element = DSModelElementSelection()
select_model_element_2 = DSModelElementSelection()  # 1 picked in the model
select_model_element_3 = DSModelElementSelection()  # 1 picked in the model
select_model_element_4 = DSModelElementSelection()  # 1 picked in the model

join = List.Join(select_model_element_2, select_model_element_3, select_model_element_4)

# group: Panel #
code_block_5 = CodeBlock { 1; }

getItemAtIndex = List.GetItemAtIndex(list=join, index=code_block_5)
getItemAtIndex_2 = List.GetItemAtIndex(list=takeEveryNthItem, index=code_block_5)
getLocation_3 = Element.GetLocation(getItemAtIndex_2@@L2)
Y_2 = Point.Y(getLocation_3)

# group: Below This Element
select_model_element_5 = DSModelElementSelection()

getLocation_4 = Element.GetLocation(select_model_element_5)
Y_3 = Point.Y(getLocation_4)
lt = Y_2 < Y_3
filterByBoolMask = List.FilterByBoolMask(list=getItemAtIndex_2, mask=lt)

# group: Above This Element
select_model_element_6 = DSModelElementSelection()

getLocation_5 = Element.GetLocation(select_model_element_6)
Y_4 = Point.Y(getLocation_5)
getLocation_6 = Element.GetLocation(filterByBoolMask.in)
Y_5 = Point.Y(getLocation_6)
lt_2 = Y_4 < Y_5
filterByBoolMask_2 = List.FilterByBoolMask(list=filterByBoolMask.in, mask=lt_2)
flatten = Flatten(filterByBoolMask_2.in)
boolean = BoolSelector(true)
selectInView = Custom[Element.SelectInView](Element=getItemAtIndex_2, Refresh_Boolean=boolean)  # Select the input elements in active view. Disconnect / Connect to refresh.
