# Dynamo graph Select lights for switching (EAST WEST).dyn (Dynamo 1.3.2.2480)

# group: Collect all door tags
categories = Categories("LightingFixtures")
all_elements_of_category = ElementsOfCategory(categories)

name = Element.Name(all_elements_of_category)
code_block = CodeBlock { "L"; }
contains = String.Contains(str=name, searchFor=code_block)
filterByBoolMask = List.FilterByBoolMask(list=all_elements_of_category, mask=contains)
id = Element.Id(filterByBoolMask.in)

# group: Group the tags by the element ids (this is for when something is tagged multiple times or in multiple views)
groupByKey = List.GroupByKey(list=filterByBoolMask.in, keys=id)

# group: Dictionaries provide a way to look stuff up by a given key
code_block_2 = CodeBlock(taggedElement=groupByKey.groups, tag=groupByKey.unique_keys)
# ---------- code_block_2.designscript (4 lines) ----------
//declare a new dictionary to store this in
tagDictionary = {};
//dictionary[whatToLookUpBy] = tagElement
tagDictionary[taggedElement] = tag;
# ----------------------------------------

select_model_elements = DSModelElementsSelection()  # 119 picked in the model

# group: Sample element selected manually to get the tags for
id_2 = Element.Id(select_model_elements)

# group: Retrieve the related tags for the given element from the dictionary
code_block_3 = CodeBlock(tagDictionary=code_block_2.tagDictionary, taggedElement=id_2) { tagDictionary[taggedElement]; }

clean = List.Clean(list=code_block_3@L1)
flatten = Flatten(clean)

# group: # OF LIGHTS IN A ROW
code_block_4 = CodeBlock { 17; }

# group: GROUP LIGHTS INTO ROWS BASED ON LOCATION AND ROW/COLOUMN VALUES
getLocation = Element.GetLocation(flatten)

X = Point.X(getLocation)

# group (continued): GROUP LIGHTS INTO ROWS BASED ON LOCATION AND ROW/COLOUMN VALUES
sortByKey = List.SortByKey(list=flatten, keys=X)
chop = List.Chop(list=sortByKey.sorted_list, lengths=code_block_4)
getLocation_2 = Element.GetLocation(chop)

Y = Point.Y(getLocation_2)

# group (continued): GROUP LIGHTS INTO ROWS BASED ON LOCATION AND ROW/COLOUMN VALUES
sortByKey_2 = List.SortByKey(list=chop@@L2, keys=Y@L2)

watch = Watch(sortByKey_2.sorted_list)

# group: # OF CIRCUITS
code_block_5 = CodeBlock { 4; }

# group: LIGHTING PATTERN
diagonalLeft = List.DiagonalLeft(watch, code_block_4)
code_block_6 = CodeBlock(A=code_block_5) { 0..(A-1); }
takeEveryNthItem = List.TakeEveryNthItem(diagonalLeft, code_block_5, code_block_6)

watch_2 = Watch(takeEveryNthItem)

# group: Panel #
code_block_7 = CodeBlock { 3; }

getItemAtIndex = List.GetItemAtIndex(list=takeEveryNthItem, index=code_block_7)
flatten_2 = Flatten(getItemAtIndex)
setRevitSelection = Custom[RIE.SetRevitSelection](Elements=flatten_2)  # Input elements to select in Revit model

# group: FILTER OUT FULL ELEMERGENCY
code_block_8 = CodeBlock { "Full Emergency Lighting"; }
getParameterValueByName = Element.GetParameterValueByName(element=flatten, parameterName=code_block_8)
code_block_9 = CodeBlock { true; }
eq = getParameterValueByName == code_block_9
filterByBoolMask_2 = List.FilterByBoolMask(list=flatten, mask=eq)
