# Dynamo graph OrganizePanelSchedule (Work in Progress).dyn (Dynamo 1.3.2.2480)

categories = Categories("ElectricalCircuit")
all_elements_of_category = ElementsOfCategory(categories)
number = DoubleInput(1)
getItemAtIndex = List.GetItemAtIndex(list=all_elements_of_category, index=number)
string = StringInput("Circuit Number")
getParameterValueByName = Element.GetParameterValueByName(element=getItemAtIndex, parameterName=string)
string_2 = StringInput("Panel")
getParameterValueByName_2 = Element.GetParameterValueByName(element=getItemAtIndex, parameterName=string_2)
getPanelScheduleViews = Custom[RIE.GetPanelScheduleViews]()  # Gets Panel Schedules Views
number_2 = DoubleInput(1)
getItemAtIndex_2 = List.GetItemAtIndex(list=getPanelScheduleViews, index=number_2)
number_3 = DoubleInput(17)
number_4 = DoubleInput(25)
moveCircuit = Custom[RIE.MoveCircuit](PanelScheduleView=getItemAtIndex_2, FromRow=number_3, ToRow=number_4)  # Moves Circuitnumber To input circuit number row. New Circuit number row has to be unoccupied.
getPanelFromPanelScheduleView = Custom[RIE.GetPanelFromPanelScheduleView](PanelScheduleView=getItemAtIndex_2)  # Gets The panel corresponding to the input PanelScheduleView
selectPanel = Custom[RIE.SelectPanel]()  # Assigns Electrical System (cirucit) to a panel and assigns the circuit an automatic running index number; unwired: Circuit, Panel_s
