# Dynamo graph Ownerview.dyn (Dynamo 1.3.2.2480)

categories = Categories("RevisionClouds")
all_elements_of_category = ElementsOfCategory(categories)
ownerView = Custom[Element.OwnerView](element=all_elements_of_category)  # Gets the owner view of a given Revit element (if possible)
