# Dynamo graph 1.3.2 WEAVE.dyn (Dynamo 1.3.2.2480)

select_model_element = DSModelElementSelection()
select_model_element_2 = DSModelElementSelection()
select_model_element_3 = DSModelElementSelection()
select_model_element_4 = DSModelElementSelection()
select_model_element_5 = DSModelElementSelection()
select_model_element_6 = DSModelElementSelection()
join = List.Join(select_model_element, select_model_element_2, select_model_element_3, select_model_element_4, select_model_element_5, select_model_element_6)
file_path = Filename(".\Weave.xlsx")
code_block = CodeBlock { "Sheet1"; }
code_block_2 = CodeBlock { 0; }
code_block_3 = CodeBlock { "A"; "B"; "C"; "D"; }
join_2 = List.Join(code_block_3.out0, code_block_3.out1, code_block_3.out2, code_block_3.out3)
code_block_4 = CodeBlock { 3; }
combinations = List.Combinations(join_2, code_block_4)
python_script = Python(IN[1]=combinations)  # unwired: IN[0], IN[2], IN[3]
# ---------- python_script.python (19 lines) ----------
import clr
clr.AddReference('ProtoGeometry')
from Autodesk.DesignScript.Geometry import *
from itertools import product
#The inputs to this node will be stored as a list in the IN variables.

L1 = UnwrapElement(IN[0])
L2 = UnwrapElement(IN[1])
L3 = UnwrapElement(IN[2])
LN = UnwrapElement(IN[3])
Set = []
for p in product((L1,LN)):
	Set.append(p)
   
			

#Assign your output to the OUT variable.

OUT = Set
# ----------------------------------------
boolean = BoolSelector(true)
writeToFile = Excel.WriteToFile(filePath=file_path, sheetName=code_block, startRow=code_block_2, startCol=code_block_2, data=python_script, overWrite=boolean)

# group: GET MECHANICAL CONNECTIONS -
family_types = FamilyTypes()
string = StringInput("EQUIPMENT NAME_IDG")
number = DoubleInput(1)

all_elements_of_family_type = ElementsOfFamilyType(family_types)
family_types_2 = FamilyTypes()
all_elements_of_family_type_2 = ElementsOfFamilyType(family_types_2)
create = List.Create(all_elements_of_family_type, all_elements_of_family_type_2)

# group: FILTER BY PHASE
select_phase = RevitPhases()
byPhaseCreated = Revit.ElementFilter.ByPhaseCreated(create, select_phase)
number_2 = DoubleInput(1)
flatten = List.Flatten(list=byPhaseCreated, amt=number_2)

# group (continued): GET MECHANICAL CONNECTIONS -
getParameterValueByName = Element.GetParameterValueByName(element=flatten, parameterName=string)
groupByKey = List.GroupByKey(list=flatten, keys=getParameterValueByName)
flatten_2 = List.Flatten(list=groupByKey.groups, amt=number)
getParameterValueByName_2 = Element.GetParameterValueByName(element=flatten_2, parameterName=string)
duplicateItemIndicies = archilab.Lists.Lists.DuplicateItemIndicies(getParameterValueByName_2)
removeItemAtIndex = List.RemoveItemAtIndex(list=getParameterValueByName_2, indices=duplicateItemIndicies.out1)
removeItemAtIndex_2 = List.RemoveItemAtIndex(list=getParameterValueByName_2, indices=duplicateItemIndicies.out0)

code_block_5 = CodeBlock { "A"; "B"; "C"; "D"; }
join_3 = List.Join(code_block_5.out0, code_block_5.out1, code_block_5.out2, code_block_5.out3)
watch = Watch(join_3)
count = Count(watch)

# group: OG
python_script_2 = Python(IN[0]=count)
# ---------- python_script_2.python (25 lines) ----------
import clr
clr.AddReference('ProtoGeometry')
from Autodesk.DesignScript.Geometry import *
#The inputs to this node will be stored as a list in the IN variables.
n = UnwrapElement(IN[0])


def pairs(n):
    for diff in range(1, n):
        starts_seen = set()
        index = 0    
        for i in range(n):
            pair = [index]
            starts_seen.add(index)
            index = (index+diff) % n
            pair.append(index)
            yield pair
            index = (index+diff) % n
            if index in starts_seen:
                index = (index+1) % n
			

#Assign your output to the OUT variable.
PAIRS = list(pair for pair in pairs(n))
OUT = PAIRS
# ----------------------------------------

flatten_3 = Flatten(python_script_2)
python_script_3 = Python(IN[0]=flatten_3)  # same code as python_script_2
python_script_4 = Python(IN[0]=count)  # same code as python_script_2
flatten_4 = Flatten(python_script_4)
code_block_6 = CodeBlock { 3; }
chop = List.Chop(list=flatten_4, lengths=code_block_6)
getItemAtIndex = List.GetItemAtIndex(list=watch, index=chop@L2)
getItemAtIndex_2 = List.GetItemAtIndex(list=getItemAtIndex)  # unwired: index
code_block_7 = CodeBlock { 1; }
code_block_8 = CodeBlock { ""; }
join_4 = String.Join(code_block_8)  # unwired: arg1, arg2
code_block_9 = CodeBlock { 0; }
getItemAtIndex_3 = List.GetItemAtIndex(list=combinations, index=code_block_9)
code_block_10 = CodeBlock { "1"; "2"; "3"; }
join_5 = List.Join(code_block_10.out0, code_block_10.out1, code_block_10.out2)
cartesianProduct = List.CartesianProduct(join_4, getItemAtIndex_3, join_5)
transpose = List.Transpose(cartesianProduct)
