# Dynamo graph New WEAVE.dyn (Dynamo 1.3.2.2480)

file_path = Filename(".\Weave.xlsx")
code_block = CodeBlock { "Sheet1"; }
code_block_2 = CodeBlock { 0; }
code_block_3 = CodeBlock { "A"; "B"; "C"; "D"; }
join = List.Join(code_block_3.out0, code_block_3.out1, code_block_3.out2, code_block_3.out3)
code_block_4 = CodeBlock { 3; }
combinations = List.Combinations(join, code_block_4)
code_block_5 = CodeBlock()
# ---------- code_block_5.designscript (3 lines) ----------
{"1",
"2",
"3"};
# ----------------------------------------
add = combinations + code_block_5  # lacing=CrossProduct
transpose = List.Transpose(add@L2)
boolean = BoolSelector(true)
writeToFile = Excel.WriteToFile(filePath=file_path, sheetName=code_block, startRow=code_block_2, startCol=code_block_2, data=transpose, overWrite=boolean)
