# Dynamo graph 1.3.2 POWER COPIED ELEMENTS 7-08-19.dyn (Dynamo 2.0.2.6826)

code_block = CodeBlock { Origin Panel; }
select_model_element = DSModelElementSelection()  # 1 picked in the model; graph input
code_block_2 = CodeBlock { Origin Element Location; }
code_block_3 = CodeBlock { Destination Element Location; }

# group: GET ALL CIRCUITED ELEMENTS
categories = Categories(index=185)  # graph input
all_elements_of_category = ElementsOfCategory(Category=categories)
python_script = Python(IN[0]=all_elements_of_category)
# ---------- python_script.python (18 lines) ----------
import clr
clr.AddReference('ProtoGeometry')
from Autodesk.DesignScript.Geometry import *
#The inputs to this node will be stored as a list in the IN variables.
systems = UnwrapElement(IN[0])
panels = []
elements = []

for x in systems:
	panels.append(x.BaseEquipment)
	sublist = []
	elementset = x.Elements
	for x in elementset:
		sublist.append(x)
	elements.append(sublist)

#Assign your output to the OUT variable.
OUT = elements
# ----------------------------------------
watch = Watch(python_script)

# group: GET ELEMENTS ONLY CIRCUITED TO CHOSEN PANEL
string = StringInput("Panel : ")  # graph input
string_2 = StringInput("Panel Name")  # graph input
getParameterValueByName = Element.GetParameterValueByName(element=select_model_element, parameterName=string_2)
add = string + getParameterValueByName
string_3 = StringInput("Panel Name")  # graph input
getParameterValueByName_2 = Element.GetParameterValueByName(element=all_elements_of_category, parameterName=string_3)
eq = getParameterValueByName == getParameterValueByName_2
filterByBoolMask = List.FilterByBoolMask(list=all_elements_of_category, mask=eq)

# group: SORT CIRCUIT BY CIRCUIT NUMBER
string_4 = StringInput("Circuit Number")  # graph input
getParameterValueByName_3 = Element.GetParameterValueByName(element=filterByBoolMask.in, parameterName=string_4)

sort = List.Sort(list=getParameterValueByName_3)

# group (continued): SORT CIRCUIT BY CIRCUIT NUMBER
sortByKey = List.SortByKey(list=filterByBoolMask.in, keys=sort)
toNumber = String.ToNumber(str=sort@L1)

python_script_2 = Python(IN[0]=sortByKey.sorted_list)  # same code as python_script
select_model_element_2 = DSModelElementSelection()  # 1 picked in the model; graph input
select_model_element_3 = DSModelElementSelection()  # 1 picked in the model; graph input

# group: COPY ELEMENTS TO FROM START POINT TO END POINT
getLocation = Element.GetLocation(element=select_model_element_2)
getLocation_2 = Element.GetLocation(element=select_model_element_3)
byTwoPoints = Vector.ByTwoPoints(start=getLocation, end=getLocation_2)
code_block_4 = CodeBlock { "true"; }
copyByVector = Custom[Element.CopyByVector](element=python_script_2@@L2, vector=byTwoPoints, rehostToClosestLevel=code_block_4)  # Copies an element or a list of elements by a given vector.

clean = List.Clean(list=copyByVector)

# group: SET PHASE
select_phase = RevitPhases()  # nothing selected; graph input

code_block_5 = CodeBlock { Destination Panel; }

# group: Create new circuit on Panel and assign elementset to new circuit
python_script_3 = Python(IN[0]=clean)
# ---------- python_script_3.python (62 lines) ----------
import clr
clr.AddReference('ProtoGeometry')
from Autodesk.DesignScript.Geometry import *

clr.AddReference('RevitServices')
import RevitServices
from RevitServices.Persistence import DocumentManager
from RevitServices.Transactions import TransactionManager
from System.Collections.Generic import *

clr.AddReference('RevitNodes')
import Revit
clr.ImportExtensions(Revit.Elements)

clr.AddReference('RevitAPI')
import Autodesk
from Autodesk.Revit.DB import *
from Autodesk.Revit.DB.Electrical import *
from Autodesk.Revit.DB import MEPSystem

clr.AddReference('DSCoreNodes')
import DSCore
from DSCore.List import *

import sys
pyt_path = r'C:\Program Files (x86)\IronPython 2.7\Lib'
sys.path.append(pyt_path)

# Import List ( ICollection(ElementId) = List[ElementId]() )
clr.AddReference("System")
from System.Collections.Generic import List 

#The inputs to this node will be stored as a list in the IN variables.
input = UnwrapElement(IN[0])

ElectComponents = []
NewCircuit = []

for sublist in input:
	sub = List[ElementId]()
	ElectComponents.append(sub)
	for item in sublist:
		sub.Add(item.Id)


doc = DocumentManager.Instance.CurrentDBDocument
uiapp = DocumentManager.Instance.CurrentUIApplication
app = uiapp.Application
uidoc = DocumentManager.Instance.CurrentUIApplication.ActiveUIDocument

ListNewCircuit = []

TransactionManager.Instance.EnsureInTransaction(doc)

for e in ElectComponents:
	NewCircuit = ElectricalSystem.Create(doc, e, ElectricalSystemType.PowerCircuit)
	ListNewCircuit.append(NewCircuit)

TransactionManager.Instance.TransactionTaskDone()


OUT = ListNewCircuit
# ----------------------------------------

# group: GET CIRCUIT PARAMETERS TO BE COPIED
string_5 = StringInput("Rating")  # graph input
getParameterValueByName_4 = Element.GetParameterValueByName(element=sortByKey.sorted_list, parameterName=string_5)
string_6 = StringInput("Load Name")  # graph input
getParameterValueByName_5 = Element.GetParameterValueByName(element=sortByKey.sorted_list, parameterName=string_6)

# group: FIND AND REPLACE CIRCUIT NAME
string_7 = StringInput("124")  # graph input
string_8 = StringInput("3000")  # graph input
replace = String.Replace(str=getParameterValueByName_5, searchFor=string_7, replaceWith=string_8)

# group: SET RATING AND LOAD NAME FOR CIRCUITS
string_9 = StringInput("Rating")  # graph input
setParameterByName = Element.SetParameterByName(element=python_script_3, parameterName=string_9, value=getParameterValueByName_4)
string_10 = StringInput("Load Name")  # graph input
setParameterByName_2 = Element.SetParameterByName(element=python_script_3, parameterName=string_10, value=replace)

# group: GET WORKSET OF ELEMENTS
string_11 = StringInput("Workset")  # graph input
getParameterValueByName_6 = Element.GetParameterValueByName(element=python_script_2, parameterName=string_11)

# group: SET PHASE AND WORKSET
string_12 = StringInput("Phase Created")  # graph input
setParameterByName_3 = Element.SetParameterByName(element=clean, parameterName=string_12, value=select_phase)
string_13 = StringInput("Workset")  # graph input
setParameterByName_4 = Element.SetParameterByName(element=clean, parameterName=string_13, value=getParameterValueByName_6)

# group: optional
string_14 = StringInput("PHASE BY SUITE")  # graph input
setParameterByName_5 = Element.SetParameterByName(element=clean, parameterName=string_14, value=string_8)
string_15 = StringInput("Location")  # graph input
string_16 = StringInput("Location")  # graph input
getParameterValueByName_7 = Element.GetParameterValueByName(element=python_script_2, parameterName=string_16)
replace_2 = String.Replace(str=getParameterValueByName_7, searchFor=string_7, replaceWith=string_8)
setParameterByName_6 = Element.SetParameterByName(element=clean, parameterName=string_15, value=replace_2)

select_model_element_4 = DSModelElementSelection()  # 1 picked in the model; graph input

# group: Select panel. IN[1] = Electrical System IN[0] = Panel element
python_script_4 = Python(IN[0]=python_script_3, IN[1]=select_model_element_4)
# ---------- python_script_4.python (51 lines) ----------
import clr
clr.AddReference('ProtoGeometry')
from Autodesk.DesignScript.Geometry import *

clr.AddReference('RevitServices')
import RevitServices
from RevitServices.Persistence import DocumentManager
from RevitServices.Transactions import TransactionManager
from System.Collections.Generic import *

clr.AddReference('RevitNodes')
import Revit
clr.ImportExtensions(Revit.Elements)

clr.AddReference('RevitAPI')
import Autodesk
from Autodesk.Revit.DB import *
from Autodesk.Revit.DB.Electrical import *
from Autodesk.Revit.DB import MEPSystem

clr.AddReference('DSCoreNodes')
import DSCore
from DSCore.List import *

import sys
pyt_path = r'C:\Program Files (x86)\IronPython 2.7\Lib'
sys.path.append(pyt_path)

# Import List ( ICollection(ElementId) = List[ElementId]() )
clr.AddReference("System")
from System.Collections.Generic import List 


circuit = UnwrapElement(IN[0])
panel = UnwrapElement(IN[1])

doc = DocumentManager.Instance.CurrentDBDocument
uiapp = DocumentManager.Instance.CurrentUIApplication
app = uiapp.Application
uidoc = DocumentManager.Instance.CurrentUIApplication.ActiveUIDocument

TransactionManager.Instance.EnsureInTransaction(doc)

for _ in circuit:
	_.SelectPanel(panel)

TransactionManager.Instance.TransactionTaskDone()

#Assign your output to the OUT variable.
OUT = []
OUT = circuit, panel
# ----------------------------------------

python_script_5 = Python(IN[0]=sortByKey.sorted_list)
# ---------- python_script_5.python (16 lines) ----------
import clr
clr.AddReference('ProtoGeometry')
from Autodesk.DesignScript.Geometry import *
#The inputs to this node will be stored as a list in the IN variables.
systems = UnwrapElement(IN[0])
elements = []

for x in systems:
	sublist = []
	elementset = x.Elements
	for x in elementset:
		sublist.append(x)
	elements.append(sublist)

#Assign your output to the OUT variable.
OUT = elements
# ----------------------------------------
