# Dynamo graph Duplicate annotations.dyn (Dynamo 1.3.2.2480)

code_block = CodeBlock { End Element Location; }
code_block_2 = CodeBlock { Origin Element Location; }
views = Views("Level 1 Orignal")
views_2 = Views("Level 1 Duplicate Elements and tags")
select_model_elements = DSModelElementsSelection()  # 4 picked in the model
select_model_element = DSModelElementSelection()  # 1 picked in the model
select_model_element_2 = DSModelElementSelection()  # 1 picked in the model

# group: COPY ELEMENTS TO FROM START POINT TO END POINT
getLocation = Element.GetLocation(select_model_element)
getLocation_2 = Element.GetLocation(select_model_element_2)
byTwoPoints = Vector.ByTwoPoints(start=getLocation, end=getLocation_2)

asPoint = Vector.AsPoint(byTwoPoints)
byOrigin = CoordinateSystem.ByOrigin(asPoint)
python_script = Python(IN[0]=views, IN[1]=views_2, IN[2]=select_model_elements, IN[3]=byOrigin)
# ---------- python_script.python (41 lines) ----------
import clr

clr.AddReference('RevitServices')
from RevitServices.Persistence import DocumentManager
from RevitServices.Transactions import TransactionManager
doc = DocumentManager.Instance.CurrentDBDocument

clr.AddReference('RevitAPI')
from Autodesk.Revit.DB import *

from System.Collections.Generic import List

clr.AddReference('RevitNodes')
import Revit
clr.ImportExtensions(Revit.Elements)
clr.ImportExtensions(Revit.GeometryConversion)

def singleton(x):
	if hasattr(x,'__iter__'): return x[0]
	else : return x

def tolist(x):
	if hasattr(x,'__iter__'): return x
	else : return [x]


source = UnwrapElement(singleton(IN[0]) )
dest = UnwrapElement(singleton(IN[1]) )
elements = UnwrapElement(tolist(IN[2]) )
tf1 = singleton(IN[3])

if tf1 is not None:
	tf1 = tf1.ToTransform(True)

eId = List[ElementId](e.Id for e in elements if hasattr(e, "Id") )

TransactionManager.Instance.EnsureInTransaction(doc)
copy = ElementTransformUtils.CopyElements(source, eId, dest, tf1, None)
TransactionManager.Instance.TransactionTaskDone()

OUT = [doc.GetElement(i).ToDSType(False) for i in copy]
# ----------------------------------------
