# Dynamo graph GetIntersectionPoints RevitAPI.dyn (Dynamo 1.3.2.2480)

select_model_elements = DSModelElementsSelection()  # 2 picked in the model
curve = DetailCurve.Curve(select_model_elements)
python_script = Python(IN[0]=curve)
# ---------- python_script.python (28 lines) ----------
import clr
clr.AddReference('RevitAPI')
from Autodesk.Revit.DB import Line, XYZ
from Autodesk.Revit.DB import SetComparisonResult, IntersectionResultArray
clr.AddReference('ProtoGeometry')
from Autodesk.DesignScript.Geometry import *

if isinstance(IN[0], list):
    lines = UnwrapElement(IN[0])
else:
    lines = [UnwrapElement(IN[0])]

def get_intersection(line1, line2):
	results = clr.Reference[IntersectionResultArray]()		
    # See ironpython.net/documentation/dotnet for clr.Reference

	result = line1.Intersect(line2, results)
    # http://www.revitapidocs.com/2018/51961478-fb36-e00b-2d1b-7db27b0a09e6.htm
	
	if result != SetComparisonResult.Overlap:
		print('No Intesection')
	
	intersection = results.Item[0]
	return intersection.XYZPoint


point = get_intersection(lines[0], lines[1])
OUT = point
# ----------------------------------------
