# Dynamo graph PlaceDetailsOnSheet.dyn (Dynamo 1.3.2.2480)

# note: PATH from Script
file_path = Filename(".\START_5.03.py")
fromPath = FileObject(file_path)  # "File.FromPath"
readText = File.ReadText(fromPath)
# note: PATH from Excel
file_path_2 = Filename(".\Detail test.xlsx")
fromPath_2 = FileObject(file_path_2)  # "File.FromPath"
code_block = CodeBlock { "sheet1"; }
readFromFile = Excel.ReadFromFile(file=fromPath_2, sheetName=code_block)
deconstruct = List.Deconstruct(list=readFromFile)
transpose = List.Transpose(deconstruct.rest)
code_block_2 = CodeBlock(p=transpose) { p[0]; p[1]; p[2]; p[3]; }
python_script_from_string = PythonStringNode(script=readText, IN[0]=code_block_2.out1, IN[1]=code_block_2.out0, IN[2]=code_block_2.out2, IN[3]=code_block_2.out3)
select_model_elements = DSModelElementsSelection()  # 6 picked in the model
curve = DetailCurve.Curve(select_model_elements)
intersectAll = Curve.IntersectAll(curve)
