# Dynamo graph PlaceViewsOnSheets.dyn (Dynamo 1.3.2.2480)

sheets = Sheets("TEST : 3D TEST")
view_sets = ViewSetUi("Set 1")
python_script = Python(IN[0]=view_sets)
# ---------- python_script.python (37 lines) ----------
#Copyright(c) 2015, Konrad Sobon
# @arch_laboratory, http://archi-lab.net

import clr
clr.AddReference('ProtoGeometry')
from Autodesk.DesignScript.Geometry import *

# Import DocumentManager and TransactionManager
clr.AddReference("RevitServices")
import RevitServices
from RevitServices.Persistence import DocumentManager
from RevitServices.Transactions import TransactionManager

doc = DocumentManager.Instance.CurrentDBDocument

# Import Element wrapper extension methods
clr.AddReference("RevitNodes")
import Revit
clr.ImportExtensions(Revit.Elements)

# Import RevitAPI
clr.AddReference("RevitAPI")
import Autodesk
from Autodesk.Revit.DB import *

viewSet = UnwrapElement(IN[0])

viewSets = FilteredElementCollector(doc).OfClass(ViewSheetSet)

for i in viewSets:
	if i.Name == viewSet.Name:
		vs = i
	else:
		continue

#Assign your output to the OUT variable
OUT = [i.ToDSType(True) for i in vs.Views]
# ----------------------------------------
count = Count(python_script)
ofRepeatedItem = List.OfRepeatedItem(item=sheets, amount=count)
flatten = Flatten(ofRepeatedItem)
code_block = CodeBlock { 0; }
code_block_2 = CodeBlock { 0; }
code_block_3 = CodeBlock { 0; }
byCoordinates = Point.ByCoordinates(x=code_block, y=code_block_2, z=code_block_3)
ofRepeatedItem_2 = List.OfRepeatedItem(item=byCoordinates, amount=count)
placeViewsOnSheets = Custom[Tool.PlaceViewsOnSheets](Sheet_List=flatten, Views_List=python_script, Points_List=ofRepeatedItem_2)  # Places existing views on existing sheets
origin = Point.Origin()
code_block_4 = CodeBlock { 0; }
getItemAtIndex = List.GetItemAtIndex(list=python_script, index=code_block_4)
placeViewsOnExistingSheets = Custom[Tool.PlaceViewsOnExistingSheets](Sheet=sheets, View=getItemAtIndex, Point=byCoordinates)  # Place the views on the sheets at the points you provide.
flatten_2 = Flatten(ofRepeatedItem_2)
alignSheetViewsFromTemplateSheet = Custom[Tool.AlignSheetViewsFromTemplateSheet]()  # Align views and schedules from a sheet template; unwired: TemplateSheet, Sheets
