# Dynamo graph get location.dyn (Dynamo 1.3.2.2480)

select_model_elements = DSModelElementsSelection()  # 9 picked in the model
intersectionsFromListOfLines = Custom[RIE.IntersectionsFromListOfLines](Lines=select_model_elements)  # Outputs points on which lines in a list intersect
intersect = Geometry.Intersect()  # unwired: geometry, other
intersectAll = Geometry.IntersectAll()  # unwired: geometry, others
intersectionsFromListOfLines_2 = Custom[RIE.IntersectionsFromListOfLines]()  # unwired: Lines
python_script = Python(IN[0]=select_model_elements)
# ---------- python_script.python (51 lines) ----------
import clr
clr.AddReference("ProtoGeometry")
from Autodesk.DesignScript.Geometry import *
clr.AddReference('DSCoreNodes') 
import DSCore
from DSCore import *


import sys
pyt_path = r'C:\Program Files (x86)\IronPython 2.7\Lib'
sys.path.append(pyt_path)
import os
#The inputs to this node will be stored as a list in the IN variables.
dataEnteringNode = IN
OUT = []
pershape = []

def line_intersects(p1sp,p1ep,p2sp,p2ep):
	xdiff = (p1sp.X - p1ep.X, p2sp.X - p2ep.X)
	ydiff = (p1sp.Y - p1ep.Y, p2sp.Y - p2ep.Y)
	
	def det(a1,a2,b1,b2):
		return a1 * b2 - a2 * b1
	
	div = det(xdiff[0],xdiff[1],ydiff[0],ydiff[1])
	if div <> 0:
		d = (det(p1sp.X,p1sp.Y,p1ep.X,p1ep.Y), det(p2sp.X,p2sp.Y,p2ep.X,p2ep.Y))
		x = det(d[0],d[1], xdiff[0],xdiff[1]) / div
		y = det(d[0],d[1], ydiff[0],ydiff[1]) / div
		if x > p1sp.X and x < p1ep.X and y > p2sp.Y and y < p2ep.Y:
			return Point.ByCoordinates(x,y)
for f in range(0, IN[0].Count):			
	for l1 in IN[0][f]:
		p1sp = l1.StartPoint 
		p1ep = l1.EndPoint
		data = []
		for l2 in IN[0][f]:
			if l1 <> l2:
				p2sp = l2.StartPoint
				p2ep = l2.EndPoint
				if  p1sp.X < p2sp.X and p1ep.X > p2ep.X  or p1sp.Y > p2sp.Y and p1ep.Y < p2ep.Y:
					if not (line_intersects(p1sp,p1ep,p2sp,p2ep) is None):
						data.append(line_intersects(p1sp,p1ep,p2sp,p2ep))
		if data.Count > 0:
			pershape.append(data)
	if pershape.Count > 0:
		OUT.append(pershape)
		pershape = []
	else:
		OUT.append('No intersections found')
		pershape = []
# ----------------------------------------
