# Dynamo graph CHANGE CLOUDS TO A SELECTED REVISION.dyn (Dynamo 1.3.2.2480)

categories = Categories("Sheets")
all_elements_of_category = ElementsOfCategory(categories)
restOfItems = List.RestOfItems(all_elements_of_category)

# group: SORT SHEETS
sheetNumber = Sheet.SheetNumber(restOfItems)
code_block = CodeBlock { " "; }
add = sheetNumber + code_block
sheetName = Sheet.SheetName(restOfItems)
add_2 = add + sheetName
sortByKey = List.SortByKey(list=restOfItems, keys=add_2)

# group: FILTER FOR THIS NAME
code_block_2 = CodeBlock { "136"; }

code_block_3 = CodeBlock { "PHASE BY SUITE"; }
getParameterValueByName = Element.GetParameterValueByName(element=sortByKey.sorted_list, parameterName=code_block_3)
eq = code_block_2 == getParameterValueByName
filterByBoolMask = List.FilterByBoolMask(list=sortByKey.sorted_list, mask=eq)
code_block_4 = CodeBlock(t3=filterByBoolMask.in) { t2 = t3.SheetNumber; t4 = t2 + " "; t5 = t3.SheetName; }

# group: ALL SHEETS
add_3 = code_block_4.t4 + code_block_4.t5

# group: Select RANG OF SHEETS from list in ALL SHEETS
code_block_5 = CodeBlock { 13; }
code_block_6 = CodeBlock { 17; }

slice = List.Slice(filterByBoolMask.in, code_block_5, code_block_6)
code_block_7 = CodeBlock(t3=slice) { t2 = t3.SheetNumber; t4 = t2 + " "; t5 = t3.SheetName; }

# group: RANGE OF SHEETS
add_4 = code_block_7.t4 + code_block_7.t5

# group: If "True" then Range of Sheets If "False" then All Sheets
boolean = BoolSelector(false)
if_ = If(test=boolean, true=slice, false=filterByBoolMask.in)

watch = Watch(if_)
views = Custom[Springs.Sheet.Views+](sheet=watch)  # Extracts all views and schedules (minus the revision schedule) placed on the input sheet (or sheets). Will be depreciated once the bult in node works with all plan types.
categories_2 = Categories("RevisionClouds")
elementsOfCategoryByView = Custom[RIE.ElementsOfCategoryByView](Views=views.view_s@L2, Category=categories_2)  # Retrieves all elements of an input category in input views.
flatten = Flatten(elementsOfCategoryByView)
revision = RevisionCloud.Revision(flatten)

# group: REVISIONS ON VIEWS
elementsOfCategoryByView_2 = Custom[RIE.ElementsOfCategoryByView](Category=categories_2)  # unwired: Views
map = List.Map(list=views.view_s, f_x=elementsOfCategoryByView_2)
flatten_2 = Flatten(map)

elementsOfCategoryByView_3 = Custom[RIE.ElementsOfCategoryByView](Views=watch@L2, Category=categories_2)
flatten_3 = Flatten(elementsOfCategoryByView_3)
join = List.Join(flatten_2, flatten_3)
revision_2 = RevisionCloud.Revision(join)
id = Element.Id(revision_2)

# group: SELECT ORIGNAL REVISION
select_revision = RevitRevisions("Seq. 26 - BULLETIN #1")

id_2 = Element.Id(select_revision)
eq_2 = id == id_2
filterByBoolMask_2 = List.FilterByBoolMask(list=join, mask=eq_2)
flatten_4 = Flatten(filterByBoolMask_2.in)
code_block_8 = CodeBlock { "Revision"; }
boolean_2 = BoolSelector(true)

# group: SELECT NEW REVISION
select_revision_2 = RevitRevisions("Seq. 35 - BULLETIN #1")

runMe = Custom[Tool.RunMe](Boolean=boolean_2, ThingToDo=select_revision_2)  # Use Boolean to perform an action
setParameterByName = Element.SetParameterByName(element=flatten_4, parameterName=code_block_8, value=runMe)
