# Dynamo graph CHECK SHEET COLUMN BY REVISION.dyn (Dynamo 1.3.2.2480)

categories = Categories("Sheets")
all_elements_of_category = ElementsOfCategory(categories)
restOfItems = List.RestOfItems(all_elements_of_category)

# group: SORT SHEETS
sheetNumber = Sheet.SheetNumber(restOfItems)
code_block = CodeBlock { " "; }
add = sheetNumber + code_block
sheetName = Sheet.SheetName(restOfItems)
add_2 = add + sheetName
sortByKey = List.SortByKey(list=restOfItems, keys=add_2)

# group: FILTER FOR THIS NAME
code_block_2 = CodeBlock { "136"; }

code_block_3 = CodeBlock { "PHASE BY SUITE"; }
getParameterValueByName = Element.GetParameterValueByName(element=sortByKey.sorted_list, parameterName=code_block_3)
eq = code_block_2 == getParameterValueByName
filterByBoolMask = List.FilterByBoolMask(list=sortByKey.sorted_list, mask=eq)
code_block_4 = CodeBlock(t3=filterByBoolMask.in) { t2 = t3.SheetNumber; t4 = t2 + " "; t5 = t3.SheetName; }

# group: ALL SHEETS
add_3 = code_block_4.t4 + code_block_4.t5

# group: Select RANG OF SHEETS from list in ALL SHEETS
code_block_5 = CodeBlock { 13; }
code_block_6 = CodeBlock { 17; }

slice = List.Slice(filterByBoolMask.in, code_block_5, code_block_6)
code_block_7 = CodeBlock(t3=slice) { t2 = t3.SheetNumber; t4 = t2 + " "; t5 = t3.SheetName; }

# group: RANGE OF SHEETS
add_4 = code_block_7.t4 + code_block_7.t5

watch = Watch(slice)
revisions = archilab.Revit.Views.Sheet.Revisions(watch)
id = Element.Id(revisions)

# group: SELECT REVISION
select_revision = RevitRevisions("Seq. 35 - BULLETIN #1")

id_2 = Element.Id(select_revision)
eq_2 = _ == id_2  # unwired: arg0
trueForAny = TrueForAny(arg1=eq_2)  # unwired: arg0
map = List.Map(list=id, f_x=trueForAny)
filterByBoolMask_2 = List.FilterByBoolMask(list=watch, mask=map)

# group: SELECT COLUMN
code_block_8 = CodeBlock { "COLUMN_06"; }

boolean = BoolSelector(true)
setParameterByName = Element.SetParameterByName(element=filterByBoolMask_2.in, parameterName=code_block_8, value=boolean)
runMe = Custom[Tool.RunMe](Boolean=boolean)  # Use Boolean to perform an action; unwired: ThingToDo
parameters = Element.Parameters(filterByBoolMask_2.in)
