# Dynamo graph (1.3.2) Remove Circuits (Light Fixture Filter).dyn (Dynamo 1.3.2.2480)

select_model_elements = DSModelElementsSelection()
categories = Categories("LightingFixtures")
byCategory = Revit.ElementFilter.ByCategory(select_model_elements, categories)
code_block = CodeBlock { "L"; }
byNameBeginsWith = Revit.ElementFilter.ByNameBeginsWith(byCategory, code_block)

# group: Get Electrical Circuit from Element
python_script = Python(IN[0]=byNameBeginsWith)
# ---------- python_script.python (35 lines) ----------
import clr
clr.AddReference('ProtoGeometry')
from Autodesk.DesignScript.Geometry import *

#The inputs to this node will be stored as a list in the IN variables.
if isinstance(IN[0],list):
	toggle = 0
	element = UnwrapElement(IN[0])
else:
	toggle = 1
	element = [UnwrapElement(IN[0])]

def getSystem(elem):
	system = elem.MEPModel.ElectricalSystems
	
	if system.Size == 0:
		return None
	elif system.Size == 1:	
		for sys in system:
			return sys
	else:
		return [x for x in system]

listout = []	
for x in element:
	try:
		system = getSystem(x)
		listout.append(system)
	except:
		listout.append(None)
#Assign your output to the OUT variable.
if toggle:
	OUT = system
else:
	OUT = listout
# ----------------------------------------

removeFromCircuit = Custom[ElectricalSystem.RemoveFromCircuit](Circuit=python_script, Elements=byNameBeginsWith)  # Removes the elements from the circuit
