# Dynamo graph (1.3.2) Remove Circuits from Panel.dyn (Dynamo 1.3.2.2480)

# group: SELECT PANEL YOU WANT TO DELETE CIRCUITS FROM
select_model_element = DSModelElementSelection()  # 1 picked in the model

# group: GET ALL CIRCUITED ELEMENTS
categories = Categories("ElectricalCircuit")
all_elements_of_category = ElementsOfCategory(categories)
python_script = Python(IN[0]=all_elements_of_category)
# ---------- python_script.python (18 lines) ----------
import clr
clr.AddReference('ProtoGeometry')
from Autodesk.DesignScript.Geometry import *
#The inputs to this node will be stored as a list in the IN variables.
systems = UnwrapElement(IN[0])
panels = []
elements = []

for x in systems:
	panels.append(x.BaseEquipment)
	sublist = []
	elementset = x.Elements
	for x in elementset:
		sublist.append(x)
	elements.append(sublist)

#Assign your output to the OUT variable.
OUT = elements
# ----------------------------------------
watch = Watch(python_script)

# group: WRITE NAME OF PANEL YOU WANT TO DELETE CIRCUITS FROM
PANEL = CodeBlock { "RLBA1"; }

# group: GET ELEMENTS ONLY CIRCUITED TO CHOSEN PANEL
string = StringInput("Panel : ")
string_2 = StringInput("Panel Name")
getParameterValueByName = Element.GetParameterValueByName(parameterName=string_2)  # unwired: element
add = string + getParameterValueByName
string_3 = StringInput("Panel")
getParameterValueByName_2 = Element.GetParameterValueByName(element=all_elements_of_category, parameterName=string_3)
eq = PANEL == getParameterValueByName_2
filterByBoolMask = List.FilterByBoolMask(list=all_elements_of_category, mask=eq)

# group: DELETE
delete = archilab.Revit.Elements.Elements.Delete(filterByBoolMask.in)

# group: CIRCUIT FILTER
code_block = CodeBlock { "Load Classification"; }
getParameterValueByName_3 = Element.GetParameterValueByName(element=filterByBoolMask.in, parameterName=code_block)
code_block_2 = CodeBlock { "Lighting"; }
eq_2 = getParameterValueByName_3 == code_block_2
filterByBoolMask_2 = List.FilterByBoolMask(list=filterByBoolMask.in, mask=eq_2)

categories_2 = Categories("ElectricalEquipment")
all_elements_of_category_2 = ElementsOfCategory(categories_2)
code_block_3 = CodeBlock { "Panel Name"; }
getParameterValueByName_4 = Element.GetParameterValueByName(element=all_elements_of_category_2, parameterName=code_block_3)
eq_3 = getParameterValueByName_4 == PANEL
filterByBoolMask_3 = List.FilterByBoolMask(list=all_elements_of_category_2, mask=eq_3)
watch_2 = Watch(filterByBoolMask_3.in)
flatten = Flatten(watch_2)
