# Dynamo graph Find Rooms By Name.dyn (Dynamo 1.3.2.2480)

categories = Categories("RoomTags")
all_elements_of_category = ElementsOfCategory(categories)
code_block = CodeBlock { "Name"; }
getParameterValueByName = Element.GetParameterValueByName(element=all_elements_of_category, parameterName=code_block)
get_family_parameter = FamilyInstanceParameters(categories)
get_built_in_parameter = Custom[Get Built In Parameter]()  # This node will take an input of a built in parameter name and element to return that parameters value.; unwired: ParameterNames, Elements
Input = Input()
