# Dynamo graph SetElementLocation.dyn (Dynamo 1.3.2.2480)

getLocation = Element.GetLocation()  # unwired: arg0

# group: GEOMETRY TRANSLATION
select_model_element = DSModelElementSelection()  # 1 picked in the model
getLocation_2 = Element.GetLocation(select_model_element)
select_model_element_2 = DSModelElementSelection()  # 1 picked in the model
getLocation_3 = Element.GetLocation(select_model_element_2)
byTwoPoints = Vector.ByTwoPoints(start=getLocation_2, end=getLocation_3)
X = Vector.X(byTwoPoints)
Y = Vector.Y(byTwoPoints)
Z = Vector.Z(byTwoPoints)

translate = Geometry.Translate(geometry=getLocation, xTranslation=X, yTranslation=Y, zTranslation=Z)
setLocation = Element.SetLocation(arg1=translate)  # unwired: arg0

# group: ELEMENT IN CORRECT SPOT
select_model_element_3 = DSModelElementSelection()  # 1 picked in the model

# group: ELEMENT TO MOVE
select_model_element_4 = DSModelElementSelection()

# group: match up multiple elements
select_model_elements = DSModelElementsSelection()  # 12 picked in the model
string = StringInput("Panel Name")
getParameterValueByName = Element.GetParameterValueByName(element=select_model_elements, parameterName=string)
number = DoubleInput(4)
number_2 = DoubleInput(-4)
remove = String.Remove(str=getParameterValueByName, startIndex=number, count=number_2)
select_model_elements_2 = DSModelElementsSelection()  # 12 picked in the model

rotate = Custom[Elements.Rotate]()  # Rotates Element(s) over axis (Vector) by list of angles (radian and counterclockwise); unwired: elements, angles, vector
join = List.Join(select_model_elements_2, select_model_elements)

# group (continued): match up multiple elements
getParameterValueByName_2 = Element.GetParameterValueByName(element=join, parameterName=string)
remove_2 = String.Remove(str=getParameterValueByName_2, startIndex=number, count=number_2)

sortByKey = List.SortByKey(list=join, keys=remove_2)
number_3 = DoubleInput(2)
number_4 = DoubleInput(2)
takeEveryNthItem = List.TakeEveryNthItem(sortByKey.sorted_list, number_3, number_4)
number_5 = DoubleInput(1)
takeEveryNthItem_2 = List.TakeEveryNthItem(sortByKey.sorted_list, number_3, number_5)
rotation = Custom[Elements.get.Rotation](Elements=takeEveryNthItem_2)  # This node give the rotation in radians and degrees of elements that are placed in a project/family. The rotation is counterclockwise and based on the original orientation. Input is an elements or list of elements output is a list in radian and degrees
setRotation = FamilyInstance.SetRotation(familyInstance=takeEveryNthItem, degree=rotation.Degrees)
rotation_2 = Custom[Elements.get.Rotation](Elements=setRotation)
