# Dynamo custom node Geometry.SplitMulti.dyf (Dynamo 2.0.1.5055)
# category: EnjoyRevit
# Split geometry by mutiple tools at once

geometry = Input(geometry: var[]..[])
tools = Input(tools: var[]..[])
python_script = Python(IN[0]=geometry, IN[1]=tools)
# ---------- python_script.python (23 lines) ----------
import clr
clr.AddReference('ProtoGeometry')
from Autodesk.DesignScript.Geometry import *
clr.AddReference('DSCoreNodes')
import DSCore
from DSCore import *
#The inputs to this node will be stored as a list in the IN variable.
surfin=IN[0]
lines=IN[1]
outlist=[]
outlist.append(surfin)

ind1=0
while ind1<len(lines):
	templist=[]
	for surf in outlist:
		cuts=surf.Split(lines[ind1])
		templist.append(cuts)
	outlist=List.Flatten(templist,1)
	ind1=ind1+1
		
#Assign your output to the OUT variable
OUT = outlist
# ----------------------------------------
Geometry = Output(python_script)  # "Geometry[]"
