# Dynamo graph Polyhedron.dyn (Dynamo 2.0.1.5055)

code_block = CodeBlock { 2; }
select_model_element = DSModelElementSelection()  # 1 picked in the model
getLocation = Element.GetLocation(element=select_model_element)
code_block_2 = CodeBlock { type(1~5); }
code_block_3 = CodeBlock { centerPoint; }  # unwired: centerPoint
code_block_4 = CodeBlock { CenterToSide(radius); }  # unwired: radius
code_block_5 = CodeBlock { 1; }
code_block_6 = CodeBlock(x=code_block_5) { a1=x==1?3:x; b1=a1>3?a1+1:a1; a2=b1==6?5:b1; }
code_block_7 = CodeBlock(po1=code_block_3, r=code_block_4, n=code_block_6.a2)  # unwired: Vector
# ---------- code_block_7.designscript (16 lines) ----------
po1;
r*4;
cs1=CoordinateSystem.ByOrigin(po1);
a1=180-(360/n);
ar1=Math.DegreesToRadians(a1);
d=Math.Cos(180-a1)*Math.Tan(a1/2);
c=Math.Sin(180-a1);
ratio=d/c;
angle1=Math.Acos(ratio);
angle2=180-angle1;
angles=[angle1,angle2];
t1=[180/n,360/n];
pts1=Point.BySphericalCoordinates(cs1,angles,t1,r);
plane1=Plane.ByOriginNormal(po1,Vector.ZAxis());
a2=360/n..360..360/n;
pt1=Point.ByCoordinates(0,0,[r,-r]);
# ----------------------------------------
byCenterPointRadius = Sphere.ByCenterPointRadius(centerPoint=code_block_3, radius=code_block_7.out1)
lastItem = List.LastItem(list=code_block_7.pt1)
rotate = Geometry.Rotate(geometry=code_block_7.pts1, basePlane=code_block_7.plane1, degrees=code_block_7.a2, lacing=CrossProduct)
lastItem_2 = List.LastItem(list=rotate)
addItemToFront = List.AddItemToFront(item=lastItem, list=lastItem_2)
flatten = List.Flatten(list=addItemToFront)
join = List.Join(list0=rotate, list1=code_block_7.pt1)
flatten_2 = List.Flatten(list=join)
code_block_8 = CodeBlock(a=flatten, b=flatten_2) { x==1?a:b; }  # unwired: x
code_block_9 = CodeBlock(pt1=code_block_7.po1, pt2=code_block_8) { cv1=Line.ByStartPointEndPoint(pt1,pt2); plane1=cv1.PlaneAtParameter(1); }
python_script = Python(IN[0]=byCenterPointRadius, IN[1]=code_block_9.plane1)
# ---------- python_script.python (24 lines) ----------
import clr
clr.AddReference('ProtoGeometry')
from Autodesk.DesignScript.Geometry import *
clr.AddReference('DSCoreNodes')
import DSCore
from DSCore import *
#The inputs to this node will be stored as a list in the IN variable.
solid=IN[0]
cutter=IN[1]
cp1=solid.Centroid()

def splitCen(a,b,po1):
	c=b.Split(a)
	if c[0].DoesIntersect(po1):
		big=c[0]
	else:
		big=c[1]
	return big

for cut in cutter:
	solid=splitCen(cut,solid,cp1)
	
#Assign your output to the OUT variable
OUT = solid
# ----------------------------------------
explode = Geometry.Explode(geometry=python_script)
python_script_2 = Python(IN[0]=explode)
# ---------- python_script_2.python (26 lines) ----------
import clr
clr.AddReference('ProtoGeometry')
from Autodesk.DesignScript.Geometry import *
clr.AddReference('DSCoreNodes')
import DSCore
from DSCore import *
#The inputs to this node will be stored as a list in the IN variable.
surfins=IN[0]
outlist=[]
firstlist=surfins
ind1=0
while len(surfins)!=1:
	surf=surfins[0]
	del surfins[0]
	ind2=0
	for item in surfins:
		cuts=surf.Intersect(item)
		outlist.append(cuts)
		ind2=ind2+1
	#ind1=ind1+1
	#surfins=firstlist
outlist=List.Flatten(outlist,1)


#Assign your output to the OUT variable
OUT = outlist
# ----------------------------------------
python_script_3 = Python(IN[0]=python_script_2)
# ---------- python_script_3.python (26 lines) ----------
import clr
clr.AddReference('ProtoGeometry')
from Autodesk.DesignScript.Geometry import *
clr.AddReference('DSCoreNodes')
import DSCore
from DSCore import *
#The inputs to this node will be stored as a list in the IN variable.
surfins=IN[0]
outlist=[]
firstlist=surfins
ind1=0
while len(surfins)!=1:
	surf=surfins[0]
	del surfins[0]
	ind2=0
	for item in surfins:
		cuts=surf.Intersect(item)
		outlist.append(cuts)
		ind2=ind2+1
		
outlist=List.Flatten(outlist,1)



#Assign your output to the OUT variable
OUT = outlist
# ----------------------------------------
python_script_4 = Python(IN[0]=python_script_3)
# ---------- python_script_4.python (35 lines) ----------
import clr
clr.AddReference('ProtoGeometry')
from Autodesk.DesignScript.Geometry import *
clr.AddReference('DSCoreNodes')
import DSCore
from DSCore import *
#The inputs to this node will be stored as a list in the IN variable.
list1=IN[0]
outlist=[]

def eq(a,b):
	ax=Math.Round(a.X,3)
	ay=Math.Round(a.Y,3)
	az=Math.Round(a.Z,3)
	bx=Math.Round(b.X,3)
	by=Math.Round(b.Y,3)
	bz=Math.Round(b.Z,3)
	bool1=0
	if ax==bx:
		if ay==by:
			if az==bz:
				bool1=1
	return bool1

while len(list1)!=0:
	cnt=0
	for item in list1:
		if eq(list1[0],item)==1:
			cnt=cnt+1
	if cnt==1:
		outlist.append(list1[0])
	del list1[0]
	
#Assign your output to the OUT variable
OUT = outlist
# ----------------------------------------
code_block_10 = CodeBlock(pt1=code_block_3, pt2=python_script_4, Vector=code_block_4)  # unwired: length
# ---------- code_block_10.designscript (3 lines) ----------
vec1=Vector.ByTwoPoints(pt1,pt2);
cv1=Line.ByStartPointDirectionLength(pt1,vec1,length);
plane1=cv1.PlaneAtParameter(1);
# ----------------------------------------
python_script_5 = Python(IN[0]=byCenterPointRadius, IN[1]=code_block_10.plane1)  # same code as python_script
code_block_11 = CodeBlock(a=python_script, b=python_script_5) { x<5?a:b; }  # unwired: x
code_block_12 = CodeBlock(solid=code_block_11) { solid; }
