# Dynamo graph DuplicateSheetsAndViews-L2-L3.dyn (Dynamo 1.3.2.2480)

categories = Categories("Sheets")
all_elements_of_category = ElementsOfCategory(categories)
restOfItems = List.RestOfItems(all_elements_of_category)

# group: SORT SHEETS
sheetNumber = Sheet.SheetNumber(restOfItems)
code_block = CodeBlock { " "; }
add = sheetNumber + code_block
sheetName = Sheet.SheetName(restOfItems)
add_2 = add + sheetName
sortByKey = List.SortByKey(list=restOfItems, keys=add_2)

# group: FILTER FOR THIS NAME
code_block_2 = CodeBlock { "230"; }

code_block_3 = CodeBlock { "PHASE BY SUITE"; }
getParameterValueByName = Element.GetParameterValueByName(element=sortByKey.sorted_list, parameterName=code_block_3)
eq = code_block_2 == getParameterValueByName
filterByBoolMask = List.FilterByBoolMask(list=sortByKey.sorted_list, mask=eq)

# group: Select range in SHEETS that you want duplicated
code_block_4 = CodeBlock { 10; }
code_block_5 = CodeBlock { 11; }

slice = List.Slice(filterByBoolMask.in, code_block_4, code_block_5)
sheetNumber_2 = Sheet.SheetNumber(slice)
sheetName_2 = Sheet.SheetName(slice)

# group: RANGE
add_3 = sheetNumber_2 + sheetName_2

sheetNumber_3 = Sheet.SheetNumber(filterByBoolMask.in)
code_block_6 = CodeBlock { " "; }
add_4 = sheetNumber_3 + code_block_6
sheetName_3 = Sheet.SheetName(filterByBoolMask.in)

# group: SHEETS
add_5 = add_4 + sheetName_3

# group: TRUE WILL RUN THE PROGRAM
boolean = BoolSelector(true)

number = DoubleInput(1)
code_block_7 = CodeBlock { "242 - "; }
duplicate = Revit.Sheet.Duplicate(slice, boolean, boolean, number, arg5=code_block_7)
code_block_8 = CodeBlock { "PHASE BY SUITE"; }

# group: PHASE BY SUITE
string = StringInput("L142")

setParameterByName = Element.SetParameterByName(element=duplicate.out1, parameterName=code_block_8, value=string)
code_block_9 = CodeBlock { 1; }
getItemAtIndex = List.GetItemAtIndex(list=filterByBoolMask.in, index=code_block_9)
categories_2 = Categories("RevisionClouds")

# group: DELETES REVISION
views = Custom[Springs.Sheet.Views+](sheet=duplicate.out1)  # Extracts all views and schedules (minus the revision schedule) placed on the input sheet (or sheets). Will be depreciated once the bult in node works with all plan types.
elementsOfCategoryByView = Custom[RIE.ElementsOfCategoryByView](Views=views.view_s@L2, Category=categories_2)  # Retrieves all elements of an input category in input views.
flatten = Flatten(elementsOfCategoryByView)
delete = archilab.Revit.Elements.Elements.Delete(flatten)
elementsOfCategoryByView_2 = Custom[RIE.ElementsOfCategoryByView](Category=categories_2)  # unwired: Views
map = List.Map(list=views.view_s, f_x=elementsOfCategoryByView_2)
flatten_2 = Flatten(map)
delete_2 = archilab.Revit.Elements.Elements.Delete(flatten_2)
