# Dynamo graph GET PARENT VIEWS.dyn (Dynamo 1.3.2.2480)

categories = Categories("Sheets")
all_elements_of_category = ElementsOfCategory(categories)
restOfItems = List.RestOfItems(all_elements_of_category)
views = Sheet.Views(restOfItems)
