# Dynamo graph Copy Tag Leader Position.dyn (Dynamo 2.0.2.6826)

select_model_elements = DSModelElementsSelection()  # 17 picked in the model

# group: Filter By Category
categories = Categories(index=215)
python_script = Python(IN[0]=select_model_elements, IN[1]=categories)
# ---------- python_script.python (25 lines) ----------
# Copyright(c) 2017, Dimitar Venkov
# @5devene, dimitar.ven@gmail.com
# www.badmonkeys.net

from itertools import imap

def tolist(obj1):
	if hasattr(obj1,"__iter__"): return obj1
	else: return [obj1]

elements = tolist(IN[0])
filter = map(str.lower, imap(str, tolist(IN[1]) ) )
in1, out1, nulls = [], [], []
OUT = in1, out1, nulls

for e in elements:
	c1 = UnwrapElement(e).Category
	if c1 is None:
		nulls.append(e)
	else:
		n1 = c1.Name.lower()
		if any(f in n1 for f in filter):
			in1.append(e)
		else:
			out1.append(e)
# ----------------------------------------
code_block = CodeBlock(IN=python_script, OUT=python_script, NULL=python_script) { IN[0]; OUT[1]; NULL[2]; }

code_block_2 = CodeBlock { "TR"; }
get_tag_s_element = Python(IN[0]=code_block.out0)
# ---------- get_tag_s_element.python (49 lines) ----------
# Copyright(c) 2019, Konrad K Sobon
# @arch_laboratory, http://archi-lab.net

import clr
clr.AddReference('RevitNodes')
import Revit
clr.ImportExtensions(Revit.Elements)

clr.AddReference('RevitServices')
import RevitServices
from RevitServices.Persistence import DocumentManager
from RevitServices.Transactions import TransactionManager
doc = DocumentManager.Instance.CurrentDBDocument

clr.AddReference('RevitAPI')
import Autodesk
from Autodesk.Revit.DB import *

import sys
pyt_path = r'C:\Program Files (x86)\IronPython 2.7\Lib'
sys.path.append(pyt_path)

if isinstance(IN[0], list):
	elem = [UnwrapElement(i) for i in IN[0]]
else:
	elem = [UnwrapElement(IN[0])]

def ProcessList(_func, _list):
    return map( lambda x:
    process_list(_func, x) if type(x)==list else _func(x), _list )

def GetHostElement(tag):
	if tag.Category.Name == "Room Tags":
		hostElemId = tag.TaggedLocalRoomId
	else:
		hostElemId = tag.TaggedLocalElementId
	return doc.GetElement(hostElemId)

try:
	errorReport = None
	output = ProcessList(GetHostElement, elem)
except:
	import traceback
	errorReport = traceback.format_exc()

if errorReport == None:
	OUT = output
else:
	OUT = errorReport
# ----------------------------------------
code_block_3 = CodeBlock { "Trimble Description"; }
getParameterValueByName = Element.GetParameterValueByName(element=get_tag_s_element, parameterName=code_block_3)
eq = code_block_2 == getParameterValueByName
filterByBoolMask = List.FilterByBoolMask(list=code_block.out0, mask=eq)

# group: Insert Tags here to copy Origin Tag's Leader Position
watch = Watch(filterByBoolMask.in)

# group: Origin Tag
select_model_element = DSModelElementSelection()  # 1 picked in the model

watch_2 = Watch(select_model_element)
get_tag_elbow_location = Python(IN[0]=watch_2)
# ---------- get_tag_elbow_location.python (51 lines) ----------
# Enable Python support and load DesignScript library
import sys
import clr
clr.AddReference('ProtoGeometry')
from Autodesk.DesignScript.Geometry import *

clr.AddReference("RevitServices")
import RevitServices
from RevitServices.Persistence import DocumentManager
from RevitServices.Transactions import TransactionManager

clr.AddReference("RevitNodes")
import Revit
clr.ImportExtensions(Revit.Elements)
clr.ImportExtensions(Revit.GeometryConversion)

clr.AddReference("RevitAPI")
import Autodesk
from Autodesk.Revit.DB import *
# The inputs to this node will be stored as a list in the IN variables.

def tolist(obj):
	if isinstance(obj, list):
		return UnwrapElement(obj)
	else:
		return [UnwrapElement(obj)]


doc = DocumentManager.Instance.CurrentDBDocument

tags = tolist(IN[0])
pointX = []
pointY = []
pointZ = []

TransactionManager.Instance.EnsureInTransaction(doc)
for tag in tags:
	try:
		elbow = XYZ(tag.LeaderElbow.X, tag.LeaderElbow.Y, tag.LeaderElbow.Z)
		pointX.append(elbow.X)
		pointY.append(elbow.Y)
		pointZ.append(elbow.Z)
	except Exception:
		pointX.append("null")
		pointY.append("null")
		pointZ.append("null")

	
TransactionManager.Instance.TransactionTaskDone()
# Assign your output to the OUT variable.
OUT = pointX, pointY, pointZ
# ----------------------------------------
code_block_4 = CodeBlock(pt=get_tag_elbow_location) { pt[0]; pt[1]; pt[2]; }
byCoordinates = Point.ByCoordinates(x=code_block_4.out0, y=code_block_4.out1, z=code_block_4.out2)
get_tag_s_element_2 = Python(IN[0]=watch_2)  # same code as get_tag_s_element
getLocation = Element.GetLocation(element=get_tag_s_element_2)
get_tag_s_element_3 = Python(IN[0]=watch)  # same code as get_tag_s_element
getLocation_2 = Element.GetLocation(element=get_tag_s_element_3)
byTwoPoints = Vector.ByTwoPoints(start=getLocation, end=getLocation_2, lacing=CrossProduct)
translate = Geometry.Translate(geometry=byCoordinates, direction=byTwoPoints)
flatten = List.Flatten(list=translate)

# group: IN[0] = Tag IN[1] = Point
set_tag_elbow_location = Python(IN[0]=watch, IN[1]=flatten)
# ---------- set_tag_elbow_location.python (46 lines) ----------
# Enable Python support and load DesignScript library
import sys
import clr
clr.AddReference('ProtoGeometry')
from Autodesk.DesignScript.Geometry import *

clr.AddReference("RevitServices")
import RevitServices
from RevitServices.Persistence import DocumentManager
from RevitServices.Transactions import TransactionManager

clr.AddReference("RevitNodes")
import Revit
clr.ImportExtensions(Revit.Elements)
clr.ImportExtensions(Revit.GeometryConversion)

clr.AddReference("RevitAPI")
import Autodesk
from Autodesk.Revit.DB import *
# The inputs to this node will be stored as a list in the IN variables.

def tolist(obj):
	if isinstance(obj, list):
		return UnwrapElement(obj)
	else:
		return [UnwrapElement(obj)]


doc = DocumentManager.Instance.CurrentDBDocument

tags = tolist(IN[0])
points = tolist(IN[1])


TransactionManager.Instance.EnsureInTransaction(doc)
for tag, point in zip(tags, points):

	newElbow = XYZ(point.X, point.Y, point.Z)
	#new_ElbowLoca = XYZ(tag.LeaderElbow.X, tag.TagHeadPosition.Y, tag.LeaderElbow.Z) # make the line horizontal between TagHeadPosition and Elbow position 
	tag.LeaderElbow = newElbow
	

TransactionManager.Instance.TransactionTaskDone()

# Assign your output to the OUT variable.
OUT = tags
# ----------------------------------------

get_tag_head_location = Python(IN[0]=watch_2)
# ---------- get_tag_head_location.python (40 lines) ----------
# Enable Python support and load DesignScript library
import sys
import clr
clr.AddReference('ProtoGeometry')
from Autodesk.DesignScript.Geometry import *

clr.AddReference("RevitServices")
import RevitServices
from RevitServices.Persistence import DocumentManager
from RevitServices.Transactions import TransactionManager

clr.AddReference("RevitAPI")
import Autodesk
from Autodesk.Revit.DB import *
# The inputs to this node will be stored as a list in the IN variables.

def tolist(obj):
	if isinstance(obj, list):
		return UnwrapElement(obj)
	else:
		return [UnwrapElement(obj)]


doc = DocumentManager.Instance.CurrentDBDocument

tags = tolist(IN[0])
pointX = []
pointY = []
pointZ = []
TransactionManager.Instance.EnsureInTransaction(doc)

for tag in tags:
	head = XYZ(tag.TagHeadPosition.X, tag.TagHeadPosition.Y, tag.TagHeadPosition.Z)
	pointX.append(head.X)
	pointY.append(head.Y)
	pointZ.append(head.Z)

TransactionManager.Instance.TransactionTaskDone()
# Assign your output to the OUT variable.
OUT = pointX, pointY, pointZ
# ----------------------------------------
code_block_5 = CodeBlock(pt=get_tag_head_location) { pt[0]; pt[1]; pt[2]; }
byCoordinates_2 = Point.ByCoordinates(x=code_block_5.out0, y=code_block_5.out1, z=code_block_5.out2)
translate_2 = Geometry.Translate(geometry=byCoordinates_2, direction=byTwoPoints)
flatten_2 = List.Flatten(list=translate_2)

# group: IN[0] = Tag IN[1] = Point
set_tag_head_location = Python(IN[0]=watch, IN[1]=flatten_2)
# ---------- set_tag_head_location.python (43 lines) ----------
# Enable Python support and load DesignScript library
import sys
import clr
clr.AddReference('ProtoGeometry')
from Autodesk.DesignScript.Geometry import *

clr.AddReference("RevitServices")
import RevitServices
from RevitServices.Persistence import DocumentManager
from RevitServices.Transactions import TransactionManager

clr.AddReference("RevitNodes")
import Revit
clr.ImportExtensions(Revit.Elements)
clr.ImportExtensions(Revit.GeometryConversion)

clr.AddReference("RevitAPI")
import Autodesk
from Autodesk.Revit.DB import *
# The inputs to this node will be stored as a list in the IN variables.

def tolist(obj):
	if isinstance(obj, list):
		return UnwrapElement(obj)
	else:
		return [UnwrapElement(obj)]


doc = DocumentManager.Instance.CurrentDBDocument

tags = tolist(IN[0])
points = tolist(IN[1])

TransactionManager.Instance.EnsureInTransaction(doc)
for tag, point in zip(tags, points):

	newHead = XYZ(point.X, point.Y, point.Z)
	tag.TagHeadPosition = newHead
	

TransactionManager.Instance.TransactionTaskDone()
# Assign your output to the OUT variable.
OUT = tags
# ----------------------------------------

watch_3 = Watch(code_block.out0)
select_model_element_2 = DSModelElementSelection()  # 1 picked in the model
code_block_6 = CodeBlock { 2; }
code_block_7 = CodeBlock { 0; }
takeEveryNthItem = List.TakeEveryNthItem(list=filterByBoolMask.in, n=code_block_6, offset=code_block_7)
