# Dynamo graph Staighten tags Python.dyn (Dynamo 2.0.2.6826)

select_model_element = DSModelElementSelection()  # 1 picked in the model

# group: Get Leader By View
views = Views(index=544)
elements_by_view = Python(IN[0]=views)
# ---------- elements_by_view.python (28 lines) ----------
#Made by Marc Tavenier @marctavenier
import clr
clr.AddReference('RevitAPI')
from Autodesk.Revit.DB import *

clr.AddReference('RevitServices')
import RevitServices
from RevitServices.Persistence import DocumentManager

doc = DocumentManager.Instance.CurrentDBDocument

def tolist(obj):
	if isinstance(obj, list):
		return UnwrapElement(obj)
	else:
		return [UnwrapElement(obj)]

views = tolist(IN[0])
elems = []

for view in views:
	filter = FilteredElementCollector(doc, view.Id)
	elems.append(filter.ToElements())

if len(elems) == 1:
	OUT = elems[0]
else:
	OUT = elems
# ----------------------------------------
code_block = CodeBlock { 1; }
code_block_2 = CodeBlock { "Leader Line"; }
getParameterValueByName = Element.GetParameterValueByName(element=elements_by_view, parameterName=code_block_2)
eq = code_block == getParameterValueByName
filterByBoolMask = List.FilterByBoolMask(list=elements_by_view, mask=eq)

watch = Watch(filterByBoolMask.in)
has_elbow = Python(IN[0]=watch)
# ---------- has_elbow.python (51 lines) ----------
# Enable Python support and load DesignScript library
import sys
import clr
clr.AddReference('ProtoGeometry')
from Autodesk.DesignScript.Geometry import *

clr.AddReference("RevitServices")
import RevitServices
from RevitServices.Persistence import DocumentManager
from RevitServices.Transactions import TransactionManager

clr.AddReference("RevitNodes")
import Revit
clr.ImportExtensions(Revit.Elements)
clr.ImportExtensions(Revit.GeometryConversion)

clr.AddReference("RevitAPI")
import Autodesk
from Autodesk.Revit.DB import *
# The inputs to this node will be stored as a list in the IN variables.

def tolist(obj):
	if isinstance(obj, list):
		return UnwrapElement(obj)
	else:
		return [UnwrapElement(obj)]


doc = DocumentManager.Instance.CurrentDBDocument

tags = tolist(IN[0])
pointX = []
pointY = []
pointZ = []

TransactionManager.Instance.EnsureInTransaction(doc)
for tag in tags:
	try:
		elbow = XYZ(tag.LeaderElbow.X, tag.LeaderElbow.Y, tag.LeaderElbow.Z)
		pointX.append(elbow.X)
		pointY.append(elbow.Y)
		pointZ.append(elbow.Z)
	except Exception:
		pointX.append("null")
		pointY.append("null")
		pointZ.append("null")

	
TransactionManager.Instance.TransactionTaskDone()
# Assign your output to the OUT variable.
OUT = pointX
# ----------------------------------------
code_block_3 = CodeBlock { "null"; }
ne = has_elbow != code_block_3
filterByBoolMask_2 = List.FilterByBoolMask(list=watch, mask=ne)
get_tag_elbow_location = Python(IN[0]=filterByBoolMask_2.in)
# ---------- get_tag_elbow_location.python (51 lines) ----------
# Enable Python support and load DesignScript library
import sys
import clr
clr.AddReference('ProtoGeometry')
from Autodesk.DesignScript.Geometry import *

clr.AddReference("RevitServices")
import RevitServices
from RevitServices.Persistence import DocumentManager
from RevitServices.Transactions import TransactionManager

clr.AddReference("RevitNodes")
import Revit
clr.ImportExtensions(Revit.Elements)
clr.ImportExtensions(Revit.GeometryConversion)

clr.AddReference("RevitAPI")
import Autodesk
from Autodesk.Revit.DB import *
# The inputs to this node will be stored as a list in the IN variables.

def tolist(obj):
	if isinstance(obj, list):
		return UnwrapElement(obj)
	else:
		return [UnwrapElement(obj)]


doc = DocumentManager.Instance.CurrentDBDocument

tags = tolist(IN[0])
pointX = []
pointY = []
pointZ = []

TransactionManager.Instance.EnsureInTransaction(doc)
for tag in tags:
	try:
		elbow = XYZ(tag.LeaderElbow.X, tag.LeaderElbow.Y, tag.LeaderElbow.Z)
		pointX.append(elbow.X)
		pointY.append(elbow.Y)
		pointZ.append(elbow.Z)
	except Exception:
		pointX.append("null")
		pointY.append("null")
		pointZ.append("null")

	
TransactionManager.Instance.TransactionTaskDone()
# Assign your output to the OUT variable.
OUT = pointX, pointY, pointZ
# ----------------------------------------
code_block_4 = CodeBlock(pt=get_tag_elbow_location) { pt[0]; pt[1]; pt[2]; }
get_tag_head_location = Python(IN[0]=filterByBoolMask_2.in)
# ---------- get_tag_head_location.python (40 lines) ----------
# Enable Python support and load DesignScript library
import sys
import clr
clr.AddReference('ProtoGeometry')
from Autodesk.DesignScript.Geometry import *

clr.AddReference("RevitServices")
import RevitServices
from RevitServices.Persistence import DocumentManager
from RevitServices.Transactions import TransactionManager

clr.AddReference("RevitAPI")
import Autodesk
from Autodesk.Revit.DB import *
# The inputs to this node will be stored as a list in the IN variables.

def tolist(obj):
	if isinstance(obj, list):
		return UnwrapElement(obj)
	else:
		return [UnwrapElement(obj)]


doc = DocumentManager.Instance.CurrentDBDocument

tags = tolist(IN[0])
pointX = []
pointY = []
pointZ = []
TransactionManager.Instance.EnsureInTransaction(doc)

for tag in tags:
	head = XYZ(tag.TagHeadPosition.X, tag.TagHeadPosition.Y, tag.TagHeadPosition.Z)
	pointX.append(head.X)
	pointY.append(head.Y)
	pointZ.append(head.Z)

TransactionManager.Instance.TransactionTaskDone()
# Assign your output to the OUT variable.
OUT = pointX, pointY, pointZ
# ----------------------------------------
code_block_5 = CodeBlock(pt=get_tag_head_location) { pt[0]; pt[1]; pt[2]; }

# group: Additional Y distance for text size
code_block_6 = CodeBlock { -0.320495061; }

code_block_7 = CodeBlock(x=code_block_5.out1, y=code_block_6) { x+y; }
byCoordinates = Point.ByCoordinates(x=code_block_4.out0, y=code_block_7, z=code_block_4.out2)
set_tag_elbow_location = Python(IN[0]=filterByBoolMask_2.in, IN[1]=byCoordinates)
# ---------- set_tag_elbow_location.python (45 lines) ----------
# Enable Python support and load DesignScript library
import sys
import clr
clr.AddReference('ProtoGeometry')
from Autodesk.DesignScript.Geometry import *

clr.AddReference("RevitServices")
import RevitServices
from RevitServices.Persistence import DocumentManager
from RevitServices.Transactions import TransactionManager

clr.AddReference("RevitNodes")
import Revit
clr.ImportExtensions(Revit.Elements)
clr.ImportExtensions(Revit.GeometryConversion)

clr.AddReference("RevitAPI")
import Autodesk
from Autodesk.Revit.DB import *
# The inputs to this node will be stored as a list in the IN variables.

def tolist(obj):
	if isinstance(obj, list):
		return UnwrapElement(obj)
	else:
		return [UnwrapElement(obj)]


doc = DocumentManager.Instance.CurrentDBDocument

tags = tolist(IN[0])
points = tolist(IN[1])


TransactionManager.Instance.EnsureInTransaction(doc)
for tag, point in zip(tags, points):

	newElbow = XYZ(point.X, point.Y, point.Z)
	#new_ElbowLoca = XYZ(tag.LeaderElbow.X, tag.TagHeadPosition.Y, tag.LeaderElbow.Z) # make the line horizontal between TagHeadPosition and Elbow position 
	tag.LeaderElbow = newElbow
	

TransactionManager.Instance.TransactionTaskDone()
# Assign your output to the OUT variable.
OUT = tags
# ----------------------------------------
select_model_elements = DSModelElementsSelection()  # 2 picked in the model
