# Dynamo graph Staighten tags.dyn (Dynamo 2.0.2.6826)

select_model_element = DSModelElementSelection()  # 1 picked in the model
python_script = Python(IN[0]=select_model_element)
# ---------- python_script.python (27 lines) ----------
# Enable Python support and load DesignScript library
import sys
import clr
clr.AddReference('ProtoGeometry')
from Autodesk.DesignScript.Geometry import *

clr.AddReference("RevitServices")
import RevitServices
from RevitServices.Persistence import DocumentManager
from RevitServices.Transactions import TransactionManager

clr.AddReference("RevitAPI")
import Autodesk
from Autodesk.Revit.DB import *
# The inputs to this node will be stored as a list in the IN variables.



doc = DocumentManager.Instance.CurrentDBDocument

tag = (UnwrapElement(IN[0]))

TransactionManager.Instance.EnsureInTransaction(doc)
head = XYZ(tag.LeaderElbow.X, tag.TagHeadPosition.Y, tag.LeaderElbow.Z)
TransactionManager.Instance.TransactionTaskDone()
# Assign your output to the OUT variable.
OUT = head
# ----------------------------------------
views = Views(index=544)
elements_by_view = Python(IN[0]=views)
# ---------- elements_by_view.python (28 lines) ----------
#Made by Marc Tavenier @marctavenier
import clr
clr.AddReference('RevitAPI')
from Autodesk.Revit.DB import *

clr.AddReference('RevitServices')
import RevitServices
from RevitServices.Persistence import DocumentManager

doc = DocumentManager.Instance.CurrentDBDocument

def tolist(obj):
	if isinstance(obj, list):
		return UnwrapElement(obj)
	else:
		return [UnwrapElement(obj)]

views = tolist(IN[0])
elems = []

for view in views:
	filter = FilteredElementCollector(doc, view.Id)
	elems.append(filter.ToElements())

if len(elems) == 1:
	OUT = elems[0]
else:
	OUT = elems
# ----------------------------------------
code_block = CodeBlock { 1; }
code_block_2 = CodeBlock { "Leader Line"; }
getParameterValueByName = Element.GetParameterValueByName(element=elements_by_view, parameterName=code_block_2)
eq = code_block == getParameterValueByName
filterByBoolMask = List.FilterByBoolMask(list=elements_by_view, mask=eq)
watch = Watch(filterByBoolMask.in)
ʳʰʸᵗʰᵐ_tags_getleaderelbow = Rhythm.Revit.Elements.Tags.GetLeaderElbow(tag=watch)
X = Point.X(point=ʳʰʸᵗʰᵐ_tags_getleaderelbow)
ʳʰʸᵗʰᵐ_tags_getheadposition = Rhythm.Revit.Elements.Tags.GetHeadPosition(tag=watch)
Y = Point.Y(point=ʳʰʸᵗʰᵐ_tags_getheadposition)
code_block_3 = CodeBlock { -0.320495061; }
code_block_4 = CodeBlock(x=Y, y=code_block_3) { x+y; }
Z = Point.Z(point=ʳʰʸᵗʰᵐ_tags_getleaderelbow)
byCoordinates = Point.ByCoordinates(x=X, y=code_block_4, z=Z)
ʳʰʸᵗʰᵐ_tags = Rhythm.Revit.Elements.Tags.SetLeaderElbowPosition(tag=watch, location=byCoordinates)
python_script_2 = Python(IN[0]=select_model_element)
# ---------- python_script_2.python (28 lines) ----------
# Enable Python support and load DesignScript library
import sys
import clr
clr.AddReference('ProtoGeometry')
from Autodesk.DesignScript.Geometry import *

clr.AddReference("RevitServices")
import RevitServices
from RevitServices.Persistence import DocumentManager
from RevitServices.Transactions import TransactionManager

clr.AddReference("RevitAPI")
import Autodesk
from Autodesk.Revit.DB import *
# The inputs to this node will be stored as a list in the IN variables.



doc = DocumentManager.Instance.CurrentDBDocument

tag = (UnwrapElement(IN[0]))

TransactionManager.Instance.EnsureInTransaction(doc)
head = Point.Create(XYZ(tag.LeaderElbow.X, tag.LeaderElbow.Y, tag.LeaderElbow.Z))

TransactionManager.Instance.TransactionTaskDone()
# Assign your output to the OUT variable.
OUT = head
# ----------------------------------------
