# Dynamo graph Delete Tags that contain nothing.dyn (Dynamo 2.0.2.6826)

# group: Get Leader By View
views = Views(index=546)
get_all_elements_in_view = Python(IN[0]=views)
# ---------- get_all_elements_in_view.python (28 lines) ----------
#Made by Marc Tavenier @marctavenier
import clr
clr.AddReference('RevitAPI')
from Autodesk.Revit.DB import *

clr.AddReference('RevitServices')
import RevitServices
from RevitServices.Persistence import DocumentManager

doc = DocumentManager.Instance.CurrentDBDocument

def tolist(obj):
	if isinstance(obj, list):
		return UnwrapElement(obj)
	else:
		return [UnwrapElement(obj)]

views = tolist(IN[0])
elems = []

for view in views:
	filter = FilteredElementCollector(doc, view.Id)
	elems.append(filter.ToElements())

if len(elems) == 1:
	OUT = elems[0]
else:
	OUT = elems
# ----------------------------------------
code_block = CodeBlock { 0; }
code_block_2 = CodeBlock { "Leader Line"; }
getParameterValueByName = Element.GetParameterValueByName(element=get_all_elements_in_view, parameterName=code_block_2)
eq = code_block == getParameterValueByName
filterByBoolMask = List.FilterByBoolMask(list=get_all_elements_in_view, mask=eq)

watch = Watch(filterByBoolMask.in)
tag_text = Python(IN[0]=watch)
# ---------- tag_text.python (44 lines) ----------
# Enable Python support and load DesignScript library
import sys
import clr
clr.AddReference('ProtoGeometry')
from Autodesk.DesignScript.Geometry import *

clr.AddReference("RevitServices")
import RevitServices
from RevitServices.Persistence import DocumentManager
from RevitServices.Transactions import TransactionManager

clr.AddReference("RevitNodes")
import Revit
clr.ImportExtensions(Revit.Elements)
clr.ImportExtensions(Revit.GeometryConversion)

clr.AddReference("RevitAPI")
import Autodesk
from Autodesk.Revit.DB import *
# The inputs to this node will be stored as a list in the IN variables.

def tolist(obj):
	if isinstance(obj, list):
		return UnwrapElement(obj)
	else:
		return [UnwrapElement(obj)]


doc = DocumentManager.Instance.CurrentDBDocument

tags = tolist(IN[0])
tagString = []

TransactionManager.Instance.EnsureInTransaction(doc)
for tag in tags:
	try:
		tagString.append(tag.TagText)
	except Exception:
		pass

	
TransactionManager.Instance.TransactionTaskDone()
# Assign your output to the OUT variable.
OUT = tagString
# ----------------------------------------
code_block_3 = CodeBlock { ""; }
eq_2 = tag_text == code_block_3
filterByBoolMask_2 = List.FilterByBoolMask(list=watch, mask=eq_2)
watch_2 = Watch(filterByBoolMask_2.in)
delete = archilab.Revit.Elements.Elements.Delete()  # unwired: element

# group: Filter By Category
categories = Categories(index=216)
filter_elements_by_category = Python(IN[0]=get_all_elements_in_view, IN[1]=categories)
# ---------- filter_elements_by_category.python (25 lines) ----------
# Copyright(c) 2017, Dimitar Venkov
# @5devene, dimitar.ven@gmail.com
# www.badmonkeys.net

from itertools import imap

def tolist(obj1):
	if hasattr(obj1,"__iter__"): return obj1
	else: return [obj1]

elements = tolist(IN[0])
filter = map(str.lower, imap(str, tolist(IN[1]) ) )
in1, out1, nulls = [], [], []
OUT = in1, out1, nulls

for e in elements:
	c1 = UnwrapElement(e).Category
	if c1 is None:
		nulls.append(e)
	else:
		n1 = c1.Name.lower()
		if any(f in n1 for f in filter):
			in1.append(e)
		else:
			out1.append(e)
# ----------------------------------------
code_block_4 = CodeBlock(IN=filter_elements_by_category) { IN[0]; OUT[1]; NULL[2]; }  # unwired: OUT, NULL

watch_3 = Watch(code_block_4.out0)

# group: Turn on Leaders
code_block_5 = CodeBlock { "Leader Line"; }
code_block_6 = CodeBlock { 1; }
setParameterByName = Element.SetParameterByName(parameterName=code_block_5, value=code_block_6)  # unwired: element
