# Dynamo graph Find Untagged Elements in View.dyn (Dynamo 2.0.2.6826)

# group: SELECTS ELEMENTS IN REVIT
python_script = Python()  # unwired: IN[0]
# ---------- python_script.python (44 lines) ----------
# Copyright(c) 2017, Dimitar Venkov
# @5devene, dimitar.ven@gmail.com
# www.badmonkeys.net

import clr
import System

clr.AddReference("RevitNodes")
import Revit
clr.ImportExtensions(Revit.Elements)
clr.ImportExtensions(Revit.GeometryConversion)

clr.AddReference('RevitServices')
from RevitServices.Persistence import DocumentManager
from RevitServices.Transactions import TransactionManager
doc = DocumentManager.Instance.CurrentDBDocument

clr.AddReference('System')
from System.Collections.Generic import List

clr.AddReference("RevitAPI")
from Autodesk.Revit.DB import *

def tolist(obj1):
	if hasattr(obj1,"__iter__"): return obj1
	else: return [obj1]

doc = DocumentManager.Instance.CurrentDBDocument
uiapp = DocumentManager.Instance.CurrentUIApplication
app = uiapp.Application
uidoc=DocumentManager.Instance.CurrentUIApplication.ActiveUIDocument

eleId=[]

for i in UnwrapElement(IN[0]):
	eleId.append(i.Id)
	
elemIds = List[ElementId](eleId)

try:
	uidoc.Selection.SetElementIds(elemIds)
	OUT = IN[0]
except:
	OUT = "Failed to set selection"
# ----------------------------------------

# group: Select Element Category
categories = Categories(index=216)  # graph input

all_elements_of_category = ElementsOfCategory(Category=categories)
id = Element.Id(element=all_elements_of_category)
groupByKey = List.GroupByKey(list=all_elements_of_category, keys=id)
code_block = CodeBlock(tag=groupByKey.groups, taggedElement=groupByKey.unique_keys)
# ---------- code_block.designscript (4 lines) ----------
//declare a new dictionary to store this in
tagDictionary = [];
//dictionary[whatToLookUpBy] = tagElement
tagDictionary[taggedElement] = tag;
# ----------------------------------------

# group: Select Element Tag Category
categories_2 = Categories(index=215)  # graph input

all_elements_of_category_2 = ElementsOfCategory(Category=categories_2)
taggedElement = Tag.TaggedElement(tag=all_elements_of_category_2)
id_2 = Element.Id(element=taggedElement)
join = List.Join(list0=id_2, list1=id)
groupByKey_2 = List.GroupByKey(list=join, keys=join)
code_block_2 = CodeBlock { 1; }
count = List.Count(list=groupByKey_2.groups@L2)
eq = code_block_2 == count
filterByBoolMask = List.FilterByBoolMask(list=groupByKey_2.unique_keys, mask=eq)
code_block_3 = CodeBlock(tagDictionary=code_block.tagDictionary, taggedElement=filterByBoolMask.in) { tagDictionary[taggedElement]; }

# group: Remove Nulls
python_script_2 = Python(IN[0]=code_block_3)
# ---------- python_script_2.python (23 lines) ----------
#Copyright(c) 2015, Konrad K Sobon
# @arch_laboratory, http://archi-lab.net

import clr
clr.AddReference('ProtoGeometry')
from Autodesk.DesignScript.Geometry import *
#The inputs to this node will be stored as a list in the IN variable.
dataEnteringNode = IN

def ClearList(_list):
    out = []
    for _list1 in _list:
        if _list1 is None:
            continue
        if isinstance(_list1, list):
             _list1 = ClearList(_list1)
             if not _list1:
                 continue
        out.append(_list1)
    return out

#Assign your output to the OUT variable
OUT = ClearList(IN[0])
# ----------------------------------------

flatten = List.Flatten(list=python_script_2)
watch = Watch(flatten)

# group: FILTER FOR ELEMENTS CONTAINGING STEEL
code_block_4 = CodeBlock { "Structural Material"; }
code_block_5 = CodeBlock { "Steel"; }

getParameterValueByName = Element.GetParameterValueByName(element=watch, parameterName=code_block_4)

# group (continued): FILTER FOR ELEMENTS CONTAINGING STEEL
name = Material.Name(material=getParameterValueByName)
contains = String.Contains(str=name, searchFor=code_block_5)
filterByBoolMask_2 = List.FilterByBoolMask(list=watch, mask=contains)

watch_2 = Watch(filterByBoolMask_2.in)
categories_3 = Categories(index=216)
all_elements_of_category_3 = ElementsOfCategory(Category=categories_3)
code_block_6 = CodeBlock { "Mark"; }
getParameterValueByName_2 = Element.GetParameterValueByName(element=all_elements_of_category_3, parameterName=code_block_6)
code_block_7 = CodeBlock { "TRIMBLE"; }
contains_2 = String.Contains(str=getParameterValueByName_2, searchFor=code_block_7)
filterByBoolMask_3 = List.FilterByBoolMask(list=all_elements_of_category_3, mask=contains_2)
views = Views()  # nothing selected
elements_in_views = Python(IN[0]=views)
# ---------- elements_in_views.python (28 lines) ----------
#Made by Marc Tavenier @marctavenier
import clr
clr.AddReference('RevitAPI')
from Autodesk.Revit.DB import *

clr.AddReference('RevitServices')
import RevitServices
from RevitServices.Persistence import DocumentManager

doc = DocumentManager.Instance.CurrentDBDocument

def tolist(obj):
	if isinstance(obj, list):
		return UnwrapElement(obj)
	else:
		return [UnwrapElement(obj)]

views = tolist(IN[0])
elems = []

for view in views:
	filter = FilteredElementCollector(doc, view.Id)
	elems.append(filter.ToElements())

if len(elems) == 1:
	OUT = elems[0]
else:
	OUT = elems
# ----------------------------------------
