# Dynamo graph Tag Light Fixtures 7-27-18.dyn (Dynamo 1.3.2.2480)

element_types = ElementTypes("ElectricalSystem")
elementsByView = Custom[RIE.ElementsByView]()  # Selects elements that are visible in input view. Forked from Marc; unwired: Views

# group: SELECT GROUP OF ELEMENTS. THE TYPE OF ELEMENTS SELECTED WILL BE PICKED FROM THIS GROUP
select_model_elements = DSModelElementsSelection()  # 46 picked in the model

# group: SELECT ELEMENT TYPE TO BE BE TAGGED
select_model_element = DSModelElementSelection()  # 1 picked in the model

type = archilab.Revit.Elements.Elements.Type(select_model_element)
all_elements_of_family_type = ElementsOfFamilyType(type)

# group: SELECT ELEMENT TYPE TO BE BE TAGGED
select_model_element_2 = DSModelElementSelection()  # 1 picked in the model

type_2 = archilab.Revit.Elements.Elements.Type(select_model_element_2)
all_elements_of_family_type_2 = ElementsOfFamilyType(type_2)
join = List.Join(all_elements_of_family_type, all_elements_of_family_type_2)
setIntersection = SetIntersection(select_model_elements, join)
getLocation = Element.GetLocation(setIntersection)

# group: SELECT TAG TYPE
select_model_element_3 = DSModelElementSelection()  # 1 picked in the model

type_3 = archilab.Revit.Elements.Elements.Type(select_model_element_3)
activeView = Custom[Springs.Doc.ActiveView]()  # Selects the current document's active view. Supports more view types than the built-in option. Will be depreciated once the bult in node works with all plan types.
boolean = BoolSelector(true)
create_annotation_tag = Custom[Create Annotation Tag](TagLocations=getLocation, TagType=type_3, Elements=setIntersection, Views=activeView, RunIt=boolean)  # This node will create an annotation tag at a given location, of given type and in a supplied view. If only single view is supplied then all tags will be created in that view.
setRevitSelection = Custom[RIE.SetRevitSelection](Elements=create_annotation_tag)  # Input elements to select in Revit model
tag_host_element = Custom[Tag Host Element]()  # This node will retrieve an element that is hosting a given tag.; unwired: Tag
byElementAndOffset = Tag.ByElementAndOffset()  # unwired: arg0, arg1
isTagged = Custom[Element.IsTagged]()  # Checks if all Elements are tagged in the project; unwired: Tags_of_Category, Elements_of_Category
tag_host_element_2 = Custom[Tag Host Element]()  # unwired: Tag
activeView_2 = Custom[Springs.Doc.ActiveView]()
byElementAndLocation = Tag.ByElementAndLocation()  # unwired: view, element, location
activeView_3 = Document.ActiveView()  # unwired: arg0
