# Dynamo graph Tag Light Fixtures.dyn (Dynamo 1.3.2.2480)

family_types = FamilyTypes("ID LIGHTS (SQUARE):2 x 4 LP4")
all_elements_of_family_type = Custom[All Elements of Family Type+](familyType=family_types)  # Unlike the built-in node, this node retrieves all placed instances of a given loadable *or* system family type
location = FamilyInstance.Location(all_elements_of_family_type)
watch = Watch(location)
code_block = CodeBlock { -2; 4; 0; }
translate = Geometry.Translate(geometry=watch, xTranslation=code_block.out0, yTranslation=code_block.out1, zTranslation=code_block.out2)
family_types_2 = FamilyTypes("ID LITE FIXTURE TAG:LIGHT FIXTURE TYPE")
all_elements_of_family_type_2 = ElementsOfFamilyType(family_types)
views = Views("FIRST FLOOR - lighting tag demo")
boolean = BoolSelector(false)
create_annotation_tag = Custom[Create Annotation Tag](TagLocations=translate, TagType=family_types_2, Elements=all_elements_of_family_type_2, Views=views, RunIt=boolean)  # This node will create an annotation tag at a given location, of given type and in a supplied view. If only single view is supplied then all tags will be created in that view.
code_block_2 = CodeBlock { 3; }
cycle = List.Cycle(list=location, amount=code_block_2)
cycle_2 = List.Cycle()  # unwired: list, amount
number = DoubleInput(100)
current = Document.Current()
activeView = Document.ActiveView(current)
code_block_3 = CodeBlock(IN=activeView) { {IN}; }
views_2 = Views("Project View")
create = List.Create(family_types_2)
code_block_4 = CodeBlock { 25; }
cycle_3 = List.Cycle(list=create, amount=code_block_4)
categories = Categories("LightingFixtures")
all_elements_of_category = ElementsOfCategory(categories)
code_block_5 = CodeBlock { 22..23; }
removeItemAtIndex = List.RemoveItemAtIndex(list=all_elements_of_category, indices=code_block_5)
code_block_6 = CodeBlock { 0; }
getItemAtIndex = List.GetItemAtIndex(list=removeItemAtIndex, index=code_block_6)
all_elements_of_type = ElementsOfType()  # unwired: arg0
