# Dynamo graph Find Trimble Points.dyn (Dynamo 2.0.2.6826)

parameters = Element.Parameters()  # unwired: element
categories = Categories(index=216)
all_elements_of_category = ElementsOfCategory(Category=categories)
code_block = CodeBlock { "Mark"; }
getParameterValueByName = Element.GetParameterValueByName(element=all_elements_of_category, parameterName=code_block)
code_block_2 = CodeBlock { "TRIMBLE"; }
contains = String.Contains(str=getParameterValueByName, searchFor=code_block_2)
filterByBoolMask = List.FilterByBoolMask(list=all_elements_of_category, mask=contains)
elementsOnSheet = Custom[RIE.ElementsOnSheet]()  # Input Sheet and retrieve all elements. This nodes get all elementIds by performing a deletion of the sheet, then undoing the transaction whilst retrieving all deleted elementIds, then retrieves all the elements that were restored. Therefore the sheets you input must be closed in the UI, or they cannot be deleted, hence this node will output null.; unwired: Sheets
views = Views(index=528)
elements_in_views = Python(IN[0]=views)
# ---------- elements_in_views.python (28 lines) ----------
#Made by Marc Tavenier @marctavenier
import clr
clr.AddReference('RevitAPI')
from Autodesk.Revit.DB import *

clr.AddReference('RevitServices')
import RevitServices
from RevitServices.Persistence import DocumentManager

doc = DocumentManager.Instance.CurrentDBDocument

def tolist(obj):
	if isinstance(obj, list):
		return UnwrapElement(obj)
	else:
		return [UnwrapElement(obj)]

views = tolist(IN[0])
elems = []

for view in views:
	filter = FilteredElementCollector(doc, view.Id)
	elems.append(filter.ToElements())

if len(elems) == 1:
	OUT = elems[0]
else:
	OUT = elems
# ----------------------------------------
